% Simulink data dictionary uorb_msg.sldd

action_request_s = Simulink.Bus()
  timestamp: uint64  % # time since system start (microseconds)
  action: uint8  % # what action is requested
  source: uint8  % # how the request was triggered
  mode: uint8  % # for ACTION_SWITCH_MODE what mode is requested according to vehicle_status_s::NAVIGATION_STATE_*

actuator_armed_s = Simulink.Bus()
  timestamp: uint64  % # time since system start (microseconds)
  armed: logical  % # Set to true if system is armed
  prearmed: logical  % # Set to true if the actuator safety is disabled but motors are not armed
  ready_to_arm: logical  % # Set to true if system is ready to be armed
  lockdown: logical  % # Set to true if actuators are forced to being disabled (due to emergency or HIL)
  manual_lockdown: logical  % # Set to true if manual throttle kill switch is engaged
  force_failsafe: logical  % # Set to true if the actuators are forced to the failsafe position
  in_esc_calibration_mode: logical  % # IO/FMU should ignore messages from the actuator controls topics

actuator_controls_status_0_s = Simulink.Bus()
  timestamp: uint64  % # time since system start (microseconds)
  control_power: single[3]

actuator_controls_status_1_s = Simulink.Bus()
  timestamp: uint64  % # time since system start (microseconds)
  control_power: single[3]

actuator_motors_s = Simulink.Bus()
  timestamp: uint64  % # time since system start (microseconds)
  timestamp_sample: uint64  % # the timestamp the data this control response is based on was sampled
  reversible_flags: uint16  % # bitset which motors are configured to be reversible
  control: single[12]  % # range: [-1, 1], where 1 means maximum positive thrust,

actuator_outputs_s = Simulink.Bus()
  timestamp: uint64  % # time since system start (microseconds)
  noutputs: uint32  % # valid outputs
  output: single[16]  % # output data, in natural output units

actuator_outputs_sim_s = Simulink.Bus()
  timestamp: uint64  % # time since system start (microseconds)
  noutputs: uint32  % # valid outputs
  output: single[16]  % # output data, in natural output units

actuator_outputs_debug_s = Simulink.Bus()
  timestamp: uint64  % # time since system start (microseconds)
  noutputs: uint32  % # valid outputs
  output: single[16]  % # output data, in natural output units

actuator_servos_s = Simulink.Bus()
  timestamp: uint64  % # time since system start (microseconds)
  timestamp_sample: uint64  % # the timestamp the data this control response is based on was sampled
  control: single[8]  % # range: [-1, 1], where 1 means maximum positive position,

actuator_servos_trim_s = Simulink.Bus()
  timestamp: uint64  % # time since system start (microseconds)
  trim: single[8]  % # range: [-1, 1]

actuator_test_s = Simulink.Bus()
  timestamp: uint64  % # time since system start (microseconds)
  action: uint8  % # one of ACTION_*
  function: uint16  % # actuator output function
  value: single  % # range: [-1, 1], where 1 means maximum positive output,
  timeout_ms: uint32  % # timeout in ms after which to exit test mode (if 0, do not time out)

adc_report_s = Simulink.Bus()
  timestamp: uint64  % # time since system start (microseconds)
  device_id: uint32  % # unique device ID for the sensor that does not change between power cycles
  channel_id: int16[12]  % # ADC channel IDs, negative for non-existent, TODO: should be kept same as array index
  raw_data: int32[12]  % # ADC channel raw value, accept negative value, valid if channel ID is positive
  resolution: uint32  % # ADC channel resolution
  v_ref: single  % # ADC channel voltage reference, use to calculate LSB voltage(lsb=scale/resolution)

airspeed_s = Simulink.Bus()
  timestamp: uint64  % # time since system start (microseconds)
  timestamp_sample: uint64
  indicated_airspeed_m_s: single  % # indicated airspeed in m/s
  true_airspeed_m_s: single  % # true filtered airspeed in m/s
  air_temperature_celsius: single  % # air temperature in degrees Celsius, -1000 if unknown
  confidence: single  % # confidence value from 0 to 1 for this sensor

airspeed_validated_s = Simulink.Bus()
  timestamp: uint64  % # time since system start (microseconds)
  indicated_airspeed_m_s: single  % # indicated airspeed in m/s (IAS), set to NAN if invalid
  calibrated_airspeed_m_s: single  % # calibrated airspeed in m/s (CAS, accounts for instrumentation errors), set to NAN if invalid
  true_airspeed_m_s: single  % # true filtered airspeed in m/s (TAS), set to NAN if invalid
  calibrated_ground_minus_wind_m_s: single  % # CAS calculated from groundspeed - windspeed, where windspeed is estimated based on a zero-sideslip assumption, set to NAN if invalid
  true_ground_minus_wind_m_s: single  % # TAS calculated from groundspeed - windspeed, where windspeed is estimated based on a zero-sideslip assumption, set to NAN if invalid
  airspeed_sensor_measurement_valid: logical  % # True if data from at least one airspeed sensor is declared valid.
  selected_airspeed_index: int8  % # 1-3: airspeed sensor index, 0: groundspeed-windspeed, -1: airspeed invalid

airspeed_wind_s = Simulink.Bus()
  timestamp: uint64  % # time since system start (microseconds)
  timestamp_sample: uint64  % # the timestamp of the raw data (microseconds)
  windspeed_north: single  % # Wind component in north / X direction (m/sec)
  windspeed_east: single  % # Wind component in east / Y direction (m/sec)
  variance_north: single  % # Wind estimate error variance in north / X direction (m/sec)**2 - set to zero (no uncertainty) if not estimated
  variance_east: single  % # Wind estimate error variance in east / Y direction (m/sec)**2 - set to zero (no uncertainty) if not estimated
  tas_innov: single  % # True airspeed innovation
  tas_innov_var: single  % # True airspeed innovation variance
  tas_scale_raw: single  % # Estimated true airspeed scale factor (not validated)
  tas_scale_raw_var: single  % # True airspeed scale factor variance
  tas_scale_validated: single  % # Estimated true airspeed scale factor after validation
  beta_innov: single  % # Sideslip measurement innovation
  beta_innov_var: single  % # Sideslip measurement innovation variance
  source: uint8  % # source of wind estimate

autotune_attitude_control_status_s = Simulink.Bus()
  timestamp: uint64  % # time since system start (microseconds)
  coeff: single[5]  % # coefficients of the identified discrete-time model
  coeff_var: single[5]  % # coefficients' variance of the identified discrete-time model
  fitness: single  % # fitness of the parameter estimate
  innov: single
  dt_model: single
  kc: single
  ki: single
  kd: single
  kff: single
  att_p: single
  rate_sp: single[3]
  u_filt: single
  y_filt: single
  state: uint8

battery_status_s = Simulink.Bus()
  timestamp: uint64  % # time since system start (microseconds)
  connected: logical  % # Whether or not a battery is connected, based on a voltage threshold
  voltage_v: single  % # Battery voltage in volts, 0 if unknown
  voltage_filtered_v: single  % # Battery voltage in volts, filtered, 0 if unknown
  current_a: single  % # Battery current in amperes, -1 if unknown
  current_filtered_a: single  % # Battery current in amperes, filtered, 0 if unknown
  current_average_a: single  % # Battery current average in amperes, -1 if unknown
  discharged_mah: single  % # Discharged amount in mAh, -1 if unknown
  remaining: single  % # From 1 to 0, -1 if unknown
  scale: single  % # Power scaling factor, >= 1, or -1 if unknown
  time_remaining_s: single  % # predicted time in seconds remaining until battery is empty under previous averaged load, NAN if unknown
  temperature: single  % # temperature of the battery. NaN if unknown
  cell_count: uint8  % # Number of cells, 0 if unknown
  source: uint8  % # Battery source
  priority: uint8  % # Zero based priority is the connection on the Power Controller V1..Vn AKA BrickN-1
  capacity: uint16  % # actual capacity of the battery
  cycle_count: uint16  % # number of discharge cycles the battery has experienced
  average_time_to_empty: uint16  % # predicted remaining battery capacity based on the average rate of discharge in min
  serial_number: uint16  % # serial number of the battery pack
  manufacture_date: uint16  % # manufacture date, part of serial number of the battery pack. Formatted as: Day + Month×32 + (Year–1980)×512
  state_of_health: uint16  % # state of health. FullChargeCapacity/DesignCapacity, 0-100%.
  max_error: uint16  % # max error, expected margin of error in % in the state-of-charge calculation with a range of 1 to 100%
  id: uint8  % # ID number of a battery. Should be unique and consistent for the lifetime of a vehicle. 1-indexed.
  interface_error: uint16  % # interface error counter
  voltage_cell_v: single[14]  % # Battery individual cell voltages, 0 if unknown
  max_cell_voltage_delta: single  % # Max difference between individual cell voltages
  is_powering_off: logical  % # Power off event imminent indication, false if unknown
  is_required: logical  % # Set if the battery is explicitly required before arming
  faults: uint16  % # Smart battery supply status/fault flags (bitmask) for health indication.
  custom_faults: uint32  % # Bitmask indicating smart battery internal manufacturer faults, those are not user actionable.
  warning: uint8  % # Current battery warning
  mode: uint8  % # Battery mode. Note, the normal operation mode
  average_power: single  % # The average power of the current discharge
  available_energy: single  % # The predicted charge or energy remaining in the battery
  full_charge_capacity_wh: single  % # The compensated battery capacity
  remaining_capacity_wh: single  % # The compensated battery capacity remaining
  design_capacity: single  % # The design capacity of the battery
  average_time_to_full: uint16  % # The predicted remaining time until the battery reaches full charge, in minutes
  over_discharge_count: uint16  % # Number of battery overdischarge
  nominal_voltage: single  % # Nominal voltage of the battery pack

button_event_s = Simulink.Bus()
  timestamp: uint64  % # time since system start (microseconds)
  triggered: logical  % # Set to true if the event is triggered

safety_button_s = Simulink.Bus()
  timestamp: uint64  % # time since system start (microseconds)
  triggered: logical  % # Set to true if the event is triggered

camera_capture_s = Simulink.Bus()
  timestamp: uint64  % # time since system start (microseconds)
  timestamp_utc: uint64  % # Capture time in UTC / GPS time
  seq: uint32  % # Image sequence number
  lat: double  % # Latitude in degrees (WGS84)
  lon: double  % # Longitude in degrees (WGS84)
  alt: single  % # Altitude (AMSL)
  ground_distance: single  % # Altitude above ground (meters)
  q: single[4]  % # Attitude of the camera relative to NED earth-fixed frame when using a gimbal, otherwise vehicle attitude
  result: int8  % # 1 for success, 0 for failure, -1 if camera does not provide feedback

camera_status_s = Simulink.Bus()
  timestamp: uint64  % # time since system start (microseconds)
  active_sys_id: uint8  % # mavlink system id of the currently active camera
  active_comp_id: uint8  % # mavlink component id of currently active camera

camera_trigger_s = Simulink.Bus()
  timestamp: uint64  % # time since system start (microseconds)
  timestamp_utc: uint64  % # UTC timestamp
  seq: uint32  % # Image sequence number
  feedback: logical  % # Trigger feedback from camera

cellular_status_s = Simulink.Bus()
  timestamp: uint64  % # time since system start (microseconds)
  status: uint16  % # Status bitmap 1: Roaming is active
  failure_reason: uint8  % #Failure reason when status in in CELLUAR_STATUS_FAILED
  type: uint8  % # Cellular network radio type 0: none 1: gsm 2: cdma 3: wcdma 4: lte
  quality: uint8  % # Cellular network RSSI/RSRP in dBm, absolute value
  mcc: uint16  % # Mobile country code. If unknown, set to: UINT16_MAX
  mnc: uint16  % # Mobile network code. If unknown, set to: UINT16_MAX
  lac: uint16  % # Location area code. If unknown, set to: 0

collision_constraints_s = Simulink.Bus()
  timestamp: uint64  % # time since system start (microseconds)
  original_setpoint: single[2]  % # velocities demanded
  adapted_setpoint: single[2]  % # velocities allowed

collision_report_s = Simulink.Bus()
  timestamp: uint64  % # time since system start (microseconds)
  src: uint8
  id: uint32
  action: uint8
  threat_level: uint8
  time_to_minimum_delta: single
  altitude_minimum_delta: single
  horizontal_minimum_delta: single

control_allocator_status_s = Simulink.Bus()
  timestamp: uint64  % # time since system start (microseconds)
  torque_setpoint_achieved: logical  % # Boolean indicating whether the 3D torque setpoint was correctly allocated to actuators. 0 if not achieved, 1 if achieved.
  unallocated_torque: single[3]  % # Unallocated torque. Equal to 0 if the setpoint was achieved.
  thrust_setpoint_achieved: logical  % # Boolean indicating whether the 3D thrust setpoint was correctly allocated to actuators. 0 if not achieved, 1 if achieved.
  unallocated_thrust: single[3]  % # Unallocated thrust. Equal to 0 if the setpoint was achieved.
  actuator_saturation: int8[16]  % # Indicates actuator saturation status.
  handled_motor_failure_mask: uint16  % # Bitmask of failed motors that were removed from the allocation / effectiveness matrix. Not necessarily identical to the report from FailureDetector

cpuload_s = Simulink.Bus()
  timestamp: uint64  % # time since system start (microseconds)
  load: single  % # processor load from 0 to 1
  ram_usage: single  % # RAM usage from 0 to 1

debug_array_s = Simulink.Bus()
  timestamp: uint64  % # time since system start (microseconds)
  id: uint16  % # unique ID of debug array, used to discriminate between arrays
  name: int8[10]  % # name of the debug array (max. 10 characters)
  data: single[58]  % # data

debug_key_value_s = Simulink.Bus()
  timestamp: uint64  % # time since system start (microseconds)
  key: int8[10]  % # max. 10 characters as key / name
  value: single  % # the value to send as debug output

debug_value_s = Simulink.Bus()
  timestamp: uint64  % # time since system start (microseconds)
  ind: int8  % # index of debug variable
  value: single  % # the value to send as debug output

debug_vect_s = Simulink.Bus()
  timestamp: uint64  % # time since system start (microseconds)
  name: int8[10]  % # max. 10 characters as key / name
  x: single  % # x value
  y: single  % # y value
  z: single  % # z value

differential_pressure_s = Simulink.Bus()
  timestamp: uint64  % # time since system start (microseconds)
  timestamp_sample: uint64
  device_id: uint32  % # unique device ID for the sensor that does not change between power cycles
  differential_pressure_pa: single  % # differential pressure reading in Pascals (may be negative)
  temperature: single  % # Temperature provided by sensor in degrees Celsius, NAN if unknown
  error_count: uint32  % # Number of errors detected by driver

distance_sensor_s = Simulink.Bus()
  timestamp: uint64  % # time since system start (microseconds)
  device_id: uint32  % # unique device ID for the sensor that does not change between power cycles
  min_distance: single  % # Minimum distance the sensor can measure (in m)
  max_distance: single  % # Maximum distance the sensor can measure (in m)
  current_distance: single  % # Current distance reading (in m)
  variance: single  % # Measurement variance (in m^2), 0 for unknown / invalid readings
  signal_quality: int8  % # Signal quality in percent (0...100%), where 0 = invalid signal, 100 = perfect signal, and -1 = unknown signal quality.
  type: uint8  % # Type from MAV_DISTANCE_SENSOR enum
  h_fov: single  % # Sensor horizontal field of view (rad)
  v_fov: single  % # Sensor vertical field of view (rad)
  q: single[4]  % # Quaterion sensor orientation with respect to the vehicle body frame to specify the orientation ROTATION_CUSTOM
  orientation: uint8  % # Direction the sensor faces from MAV_SENSOR_ORIENTATION enum

ekf2_timestamps_s = Simulink.Bus()
  timestamp: uint64  % # time since system start (microseconds)
  airspeed_timestamp_rel: int16
  distance_sensor_timestamp_rel: int16
  optical_flow_timestamp_rel: int16
  vehicle_air_data_timestamp_rel: int16
  vehicle_magnetometer_timestamp_rel: int16
  visual_odometry_timestamp_rel: int16

esc_report_s = Simulink.Bus()
  timestamp: uint64  % # time since system start (microseconds)
  esc_errorcount: uint32  % # Number of reported errors by ESC - if supported
  esc_rpm: int32  % # Motor RPM, negative for reverse rotation [RPM] - if supported
  esc_voltage: single  % # Voltage measured from current ESC [V] - if supported
  esc_current: single  % # Current measured from current ESC [A] - if supported
  esc_temperature: single  % # Temperature measured from current ESC [degC] - if supported
  esc_address: uint8  % # Address of current ESC (in most cases 1-8 / must be set by driver)
  esc_cmdcount: uint8  % # Counter of number of commands
  esc_state: uint8  % # State of ESC - depend on Vendor
  actuator_function: uint8  % # actuator output function (one of Motor1...MotorN)
  failures: uint16  % # Bitmask to indicate the internal ESC faults
  esc_power: int8  % # Applied power 0-100 in % (negative values reserved)

esc_status_s = Simulink.Bus()
  timestamp: uint64  % # time since system start (microseconds)
  counter: uint16  % # incremented by the writing thread everytime new data is stored
  esc_count: uint8  % # number of connected ESCs
  esc_connectiontype: uint8  % # how ESCs connected to the system
  esc_online_flags: uint8  % # Bitmask indicating which ESC is online/offline
  esc_armed_flags: uint8  % # Bitmask indicating which ESC is armed. For ESC's where the arming state is not known (returned by the ESC), the arming bits should always be set.
  esc: escreport[8]

estimator_aid_src_mag_heading_s = Simulink.Bus()
  timestamp: uint64  % # time since system start (microseconds)
  timestamp_sample: uint64  % # the timestamp of the raw data (microseconds)
  estimator_instance: uint8
  device_id: uint32
  time_last_fuse: uint64
  observation: single
  observation_variance: single
  innovation: single
  innovation_variance: single
  test_ratio: single
  fusion_enabled: logical  % # true when measurements are being fused
  innovation_rejected: logical  % # true if the observation has been rejected
  fused: logical  % # true if the sample was successfully fused

estimator_aid_src_gnss_yaw_s = Simulink.Bus()
  timestamp: uint64  % # time since system start (microseconds)
  timestamp_sample: uint64  % # the timestamp of the raw data (microseconds)
  estimator_instance: uint8
  device_id: uint32
  time_last_fuse: uint64
  observation: single
  observation_variance: single
  innovation: single
  innovation_variance: single
  test_ratio: single
  fusion_enabled: logical  % # true when measurements are being fused
  innovation_rejected: logical  % # true if the observation has been rejected
  fused: logical  % # true if the sample was successfully fused

estimator_aid_src_ev_yaw_s = Simulink.Bus()
  timestamp: uint64  % # time since system start (microseconds)
  timestamp_sample: uint64  % # the timestamp of the raw data (microseconds)
  estimator_instance: uint8
  device_id: uint32
  time_last_fuse: uint64
  observation: single
  observation_variance: single
  innovation: single
  innovation_variance: single
  test_ratio: single
  fusion_enabled: logical  % # true when measurements are being fused
  innovation_rejected: logical  % # true if the observation has been rejected
  fused: logical  % # true if the sample was successfully fused

estimator_aid_src_aux_vel_s = Simulink.Bus()
  timestamp: uint64  % # time since system start (microseconds)
  timestamp_sample: uint64  % # the timestamp of the raw data (microseconds)
  estimator_instance: uint8
  device_id: uint32
  time_last_fuse: uint64
  observation: single[2]
  observation_variance: single[2]
  innovation: single[2]
  innovation_variance: single[2]
  test_ratio: single[2]
  fusion_enabled: logical  % # true when measurements are being fused
  innovation_rejected: logical  % # true if the observation has been rejected
  fused: logical  % # true if the sample was successfully fused

estimator_aid_src_optical_flow_s = Simulink.Bus()
  timestamp: uint64  % # time since system start (microseconds)
  timestamp_sample: uint64  % # the timestamp of the raw data (microseconds)
  estimator_instance: uint8
  device_id: uint32
  time_last_fuse: uint64
  observation: single[2]
  observation_variance: single[2]
  innovation: single[2]
  innovation_variance: single[2]
  test_ratio: single[2]
  fusion_enabled: logical  % # true when measurements are being fused
  innovation_rejected: logical  % # true if the observation has been rejected
  fused: logical  % # true if the sample was successfully fused

estimator_aid_src_terrain_optical_flow_s = Simulink.Bus()
  timestamp: uint64  % # time since system start (microseconds)
  timestamp_sample: uint64  % # the timestamp of the raw data (microseconds)
  estimator_instance: uint8
  device_id: uint32
  time_last_fuse: uint64
  observation: single[2]
  observation_variance: single[2]
  innovation: single[2]
  innovation_variance: single[2]
  test_ratio: single[2]
  fusion_enabled: logical  % # true when measurements are being fused
  innovation_rejected: logical  % # true if the observation has been rejected
  fused: logical  % # true if the sample was successfully fused

estimator_aid_src_ev_vel_s = Simulink.Bus()
  timestamp: uint64  % # time since system start (microseconds)
  timestamp_sample: uint64  % # the timestamp of the raw data (microseconds)
  estimator_instance: uint8
  device_id: uint32
  time_last_fuse: uint64
  observation: single[3]
  observation_variance: single[3]
  innovation: single[3]
  innovation_variance: single[3]
  test_ratio: single[3]
  fusion_enabled: logical  % # true when measurements are being fused
  innovation_rejected: logical  % # true if the observation has been rejected
  fused: logical  % # true if the sample was successfully fused

estimator_aid_src_gnss_vel_s = Simulink.Bus()
  timestamp: uint64  % # time since system start (microseconds)
  timestamp_sample: uint64  % # the timestamp of the raw data (microseconds)
  estimator_instance: uint8
  device_id: uint32
  time_last_fuse: uint64
  observation: single[3]
  observation_variance: single[3]
  innovation: single[3]
  innovation_variance: single[3]
  test_ratio: single[3]
  fusion_enabled: logical  % # true when measurements are being fused
  innovation_rejected: logical  % # true if the observation has been rejected
  fused: logical  % # true if the sample was successfully fused

estimator_aid_src_gravity_s = Simulink.Bus()
  timestamp: uint64  % # time since system start (microseconds)
  timestamp_sample: uint64  % # the timestamp of the raw data (microseconds)
  estimator_instance: uint8
  device_id: uint32
  time_last_fuse: uint64
  observation: single[3]
  observation_variance: single[3]
  innovation: single[3]
  innovation_variance: single[3]
  test_ratio: single[3]
  fusion_enabled: logical  % # true when measurements are being fused
  innovation_rejected: logical  % # true if the observation has been rejected
  fused: logical  % # true if the sample was successfully fused

estimator_aid_src_mag_s = Simulink.Bus()
  timestamp: uint64  % # time since system start (microseconds)
  timestamp_sample: uint64  % # the timestamp of the raw data (microseconds)
  estimator_instance: uint8
  device_id: uint32
  time_last_fuse: uint64
  observation: single[3]
  observation_variance: single[3]
  innovation: single[3]
  innovation_variance: single[3]
  test_ratio: single[3]
  fusion_enabled: logical  % # true when measurements are being fused
  innovation_rejected: logical  % # true if the observation has been rejected
  fused: logical  % # true if the sample was successfully fused

estimator_baro_bias_s = Simulink.Bus()
  timestamp: uint64  % # time since system start (microseconds)
  timestamp_sample: uint64  % # the timestamp of the raw data (microseconds)
  device_id: uint32  % # unique device ID for the sensor that does not change between power cycles
  bias: single  % # estimated barometric altitude bias (m)
  bias_var: single  % # estimated barometric altitude bias variance (m^2)
  innov: single  % # innovation of the last measurement fusion (m)
  innov_var: single  % # innovation variance of the last measurement fusion (m^2)
  innov_test_ratio: single  % # normalized innovation squared test ratio

estimator_gnss_hgt_bias_s = Simulink.Bus()
  timestamp: uint64  % # time since system start (microseconds)
  timestamp_sample: uint64  % # the timestamp of the raw data (microseconds)
  device_id: uint32  % # unique device ID for the sensor that does not change between power cycles
  bias: single  % # estimated barometric altitude bias (m)
  bias_var: single  % # estimated barometric altitude bias variance (m^2)
  innov: single  % # innovation of the last measurement fusion (m)
  innov_var: single  % # innovation variance of the last measurement fusion (m^2)
  innov_test_ratio: single  % # normalized innovation squared test ratio

estimator_rng_hgt_bias_s = Simulink.Bus()
  timestamp: uint64  % # time since system start (microseconds)
  timestamp_sample: uint64  % # the timestamp of the raw data (microseconds)
  device_id: uint32  % # unique device ID for the sensor that does not change between power cycles
  bias: single  % # estimated barometric altitude bias (m)
  bias_var: single  % # estimated barometric altitude bias variance (m^2)
  innov: single  % # innovation of the last measurement fusion (m)
  innov_var: single  % # innovation variance of the last measurement fusion (m^2)
  innov_test_ratio: single  % # normalized innovation squared test ratio

estimator_ev_pos_bias_s = Simulink.Bus()
  timestamp: uint64  % # time since system start (microseconds)
  timestamp_sample: uint64  % # the timestamp of the raw data (microseconds)
  device_id: uint32  % # unique device ID for the sensor that does not change between power cycles
  bias: single[3]  % # estimated barometric altitude bias (m)
  bias_var: single[3]  % # estimated barometric altitude bias variance (m^2)
  innov: single[3]  % # innovation of the last measurement fusion (m)
  innov_var: single[3]  % # innovation variance of the last measurement fusion (m^2)
  innov_test_ratio: single[3]  % # normalized innovation squared test ratio

estimator_event_flags_s = Simulink.Bus()
  timestamp: uint64  % # time since system start (microseconds)
  timestamp_sample: uint64  % # the timestamp of the raw data (microseconds)
  information_event_changes: uint32  % # number of information event changes
  gps_checks_passed: logical  % #  0 - true when gps quality checks are passing passed
  reset_vel_to_gps: logical  % #  1 - true when the velocity states are reset to the gps measurement
  reset_vel_to_flow: logical  % #  2 - true when the velocity states are reset using the optical flow measurement
  reset_vel_to_vision: logical  % #  3 - true when the velocity states are reset to the vision system measurement
  reset_vel_to_zero: logical  % #  4 - true when the velocity states are reset to zero
  reset_pos_to_last_known: logical  % #  5 - true when the position states are reset to the last known position
  reset_pos_to_gps: logical  % #  6 - true when the position states are reset to the gps measurement
  reset_pos_to_vision: logical  % #  7 - true when the position states are reset to the vision system measurement
  starting_gps_fusion: logical  % #  8 - true when the filter starts using gps measurements to correct the state estimates
  starting_vision_pos_fusion: logical  % #  9 - true when the filter starts using vision system position measurements to correct the state estimates
  starting_vision_vel_fusion: logical  % # 10 - true when the filter starts using vision system velocity measurements to correct the state estimates
  starting_vision_yaw_fusion: logical  % # 11 - true when the filter starts using vision system yaw  measurements to correct the state estimates
  yaw_aligned_to_imu_gps: logical  % # 12 - true when the filter resets the yaw to an estimate derived from IMU and GPS data
  reset_hgt_to_baro: logical  % # 13 - true when the vertical position state is reset to the baro measurement
  reset_hgt_to_gps: logical  % # 14 - true when the vertical position state is reset to the gps measurement
  reset_hgt_to_rng: logical  % # 15 - true when the vertical position state is reset to the rng measurement
  reset_hgt_to_ev: logical  % # 16 - true when the vertical position state is reset to the ev measurement
  warning_event_changes: uint32  % # number of warning event changes
  gps_quality_poor: logical  % #  0 - true when the gps is failing quality checks
  gps_fusion_timout: logical  % #  1 - true when the gps data has not been used to correct the state estimates for a significant time period
  gps_data_stopped: logical  % #  2 - true when the gps data has stopped for a significant time period
  gps_data_stopped_using_alternate: logical  % #  3 - true when the gps data has stopped for a significant time period but the filter is able to use other sources of data to maintain navigation
  height_sensor_timeout: logical  % #  4 - true when the height sensor has not been used to correct the state estimates for a significant time period
  stopping_navigation: logical  % #  5 - true when the filter has insufficient data to estimate velocity and position and is falling back to an attitude, height and height rate mode of operation
  invalid_accel_bias_cov_reset: logical  % #  6 - true when the filter has detected bad acceerometer bias state esitmstes and has reset the corresponding covariance matrix elements
  bad_yaw_using_gps_course: logical  % #  7 - true when the filter has detected an invalid yaw estimate and has reset the yaw angle to the GPS ground course
  stopping_mag_use: logical  % #  8 - true when the filter has detected bad magnetometer data and is stopping further use of the magnetometer data
  vision_data_stopped: logical  % #  9 - true when the vision system data has stopped for a significant time period
  emergency_yaw_reset_mag_stopped: logical  % # 10 - true when the filter has detected bad magnetometer data, has reset the yaw to anothter source of data and has stopped further use of the magnetometer data
  emergency_yaw_reset_gps_yaw_stopped: logical  % # 11 - true when the filter has detected bad GNSS yaw data, has reset the yaw to anothter source of data and has stopped further use of the GNSS yaw data

estimator_gps_status_s = Simulink.Bus()
  timestamp: uint64  % # time since system start (microseconds)
  timestamp_sample: uint64  % # the timestamp of the raw data (microseconds)
  checks_passed: logical
  check_fail_gps_fix: logical  % # 0 : insufficient fix type (no 3D solution)
  check_fail_min_sat_count: logical  % # 1 : minimum required sat count fail
  check_fail_max_pdop: logical  % # 2 : maximum allowed PDOP fail
  check_fail_max_horz_err: logical  % # 3 : maximum allowed horizontal position error fail
  check_fail_max_vert_err: logical  % # 4 : maximum allowed vertical position error fail
  check_fail_max_spd_err: logical  % # 5 : maximum allowed speed error fail
  check_fail_max_horz_drift: logical  % # 6 : maximum allowed horizontal position drift fail - requires stationary vehicle
  check_fail_max_vert_drift: logical  % # 7 : maximum allowed vertical position drift fail - requires stationary vehicle
  check_fail_max_horz_spd_err: logical  % # 8 : maximum allowed horizontal speed fail - requires stationary vehicle
  check_fail_max_vert_spd_err: logical  % # 9 : maximum allowed vertical velocity discrepancy fail
  position_drift_rate_horizontal_m_s: single  % # Horizontal position rate magnitude (m/s)
  position_drift_rate_vertical_m_s: single  % # Vertical position rate magnitude (m/s)
  filtered_horizontal_speed_m_s: single  % # Filtered horizontal velocity magnitude (m/s)

estimator_innovations_s = Simulink.Bus()
  timestamp: uint64  % # time since system start (microseconds)
  timestamp_sample: uint64  % # the timestamp of the raw data (microseconds)
  gps_hvel: single[2]  % # horizontal GPS velocity innovation (m/sec) and innovation variance ((m/sec)**2)
  gps_vvel: single  % # vertical GPS velocity innovation (m/sec) and innovation variance ((m/sec)**2)
  gps_hpos: single[2]  % # horizontal GPS position innovation (m) and innovation variance (m**2)
  gps_vpos: single  % # vertical GPS position innovation (m) and innovation variance (m**2)
  ev_hvel: single[2]  % # horizontal external vision velocity innovation (m/sec) and innovation variance ((m/sec)**2)
  ev_vvel: single  % # vertical external vision velocity innovation (m/sec) and innovation variance ((m/sec)**2)
  ev_hpos: single[2]  % # horizontal external vision position innovation (m) and innovation variance (m**2)
  ev_vpos: single  % # vertical external vision position innovation (m) and innovation variance (m**2)
  rng_vpos: single  % # range sensor height innovation (m) and innovation variance (m**2)
  baro_vpos: single  % # barometer height innovation (m) and innovation variance (m**2)
  aux_hvel: single[2]  % # horizontal auxiliary velocity innovation from landing target measurement (m/sec) and innovation variance ((m/sec)**2)
  aux_vvel: single  % # vertical auxiliary velocity innovation from landing target measurement (m/sec) and innovation variance ((m/sec)**2)
  flow: single[2]  % # flow innvoation (rad/sec) and innovation variance ((rad/sec)**2)
  terr_flow: single[2]  % # flow innvoation (rad/sec) and innovation variance computed by the terrain estimator ((rad/sec)**2)
  heading: single  % # heading innovation (rad) and innovation variance (rad**2)
  mag_field: single[3]  % # earth magnetic field innovation (Gauss) and innovation variance (Gauss**2)
  gravity: single[3]  % # gravity innovation from accelerometerr vector (m/s**2)
  drag: single[2]  % # drag specific force innovation (m/sec**2) and innovation variance ((m/sec)**2)
  airspeed: single  % # airspeed innovation (m/sec) and innovation variance ((m/sec)**2)
  beta: single  % # synthetic sideslip innovation (rad) and innovation variance (rad**2)
  hagl: single  % # height of ground innovation (m) and innovation variance (m**2)
  hagl_rate: single  % # height of ground rate innovation (m/s) and innovation variance ((m/s)**2)

estimator_innovation_variances_s = Simulink.Bus()
  timestamp: uint64  % # time since system start (microseconds)
  timestamp_sample: uint64  % # the timestamp of the raw data (microseconds)
  gps_hvel: single[2]  % # horizontal GPS velocity innovation (m/sec) and innovation variance ((m/sec)**2)
  gps_vvel: single  % # vertical GPS velocity innovation (m/sec) and innovation variance ((m/sec)**2)
  gps_hpos: single[2]  % # horizontal GPS position innovation (m) and innovation variance (m**2)
  gps_vpos: single  % # vertical GPS position innovation (m) and innovation variance (m**2)
  ev_hvel: single[2]  % # horizontal external vision velocity innovation (m/sec) and innovation variance ((m/sec)**2)
  ev_vvel: single  % # vertical external vision velocity innovation (m/sec) and innovation variance ((m/sec)**2)
  ev_hpos: single[2]  % # horizontal external vision position innovation (m) and innovation variance (m**2)
  ev_vpos: single  % # vertical external vision position innovation (m) and innovation variance (m**2)
  rng_vpos: single  % # range sensor height innovation (m) and innovation variance (m**2)
  baro_vpos: single  % # barometer height innovation (m) and innovation variance (m**2)
  aux_hvel: single[2]  % # horizontal auxiliary velocity innovation from landing target measurement (m/sec) and innovation variance ((m/sec)**2)
  aux_vvel: single  % # vertical auxiliary velocity innovation from landing target measurement (m/sec) and innovation variance ((m/sec)**2)
  flow: single[2]  % # flow innvoation (rad/sec) and innovation variance ((rad/sec)**2)
  terr_flow: single[2]  % # flow innvoation (rad/sec) and innovation variance computed by the terrain estimator ((rad/sec)**2)
  heading: single  % # heading innovation (rad) and innovation variance (rad**2)
  mag_field: single[3]  % # earth magnetic field innovation (Gauss) and innovation variance (Gauss**2)
  gravity: single[3]  % # gravity innovation from accelerometerr vector (m/s**2)
  drag: single[2]  % # drag specific force innovation (m/sec**2) and innovation variance ((m/sec)**2)
  airspeed: single  % # airspeed innovation (m/sec) and innovation variance ((m/sec)**2)
  beta: single  % # synthetic sideslip innovation (rad) and innovation variance (rad**2)
  hagl: single  % # height of ground innovation (m) and innovation variance (m**2)
  hagl_rate: single  % # height of ground rate innovation (m/s) and innovation variance ((m/s)**2)

estimator_innovation_test_ratios_s = Simulink.Bus()
  timestamp: uint64  % # time since system start (microseconds)
  timestamp_sample: uint64  % # the timestamp of the raw data (microseconds)
  gps_hvel: single[2]  % # horizontal GPS velocity innovation (m/sec) and innovation variance ((m/sec)**2)
  gps_vvel: single  % # vertical GPS velocity innovation (m/sec) and innovation variance ((m/sec)**2)
  gps_hpos: single[2]  % # horizontal GPS position innovation (m) and innovation variance (m**2)
  gps_vpos: single  % # vertical GPS position innovation (m) and innovation variance (m**2)
  ev_hvel: single[2]  % # horizontal external vision velocity innovation (m/sec) and innovation variance ((m/sec)**2)
  ev_vvel: single  % # vertical external vision velocity innovation (m/sec) and innovation variance ((m/sec)**2)
  ev_hpos: single[2]  % # horizontal external vision position innovation (m) and innovation variance (m**2)
  ev_vpos: single  % # vertical external vision position innovation (m) and innovation variance (m**2)
  rng_vpos: single  % # range sensor height innovation (m) and innovation variance (m**2)
  baro_vpos: single  % # barometer height innovation (m) and innovation variance (m**2)
  aux_hvel: single[2]  % # horizontal auxiliary velocity innovation from landing target measurement (m/sec) and innovation variance ((m/sec)**2)
  aux_vvel: single  % # vertical auxiliary velocity innovation from landing target measurement (m/sec) and innovation variance ((m/sec)**2)
  flow: single[2]  % # flow innvoation (rad/sec) and innovation variance ((rad/sec)**2)
  terr_flow: single[2]  % # flow innvoation (rad/sec) and innovation variance computed by the terrain estimator ((rad/sec)**2)
  heading: single  % # heading innovation (rad) and innovation variance (rad**2)
  mag_field: single[3]  % # earth magnetic field innovation (Gauss) and innovation variance (Gauss**2)
  gravity: single[3]  % # gravity innovation from accelerometerr vector (m/s**2)
  drag: single[2]  % # drag specific force innovation (m/sec**2) and innovation variance ((m/sec)**2)
  airspeed: single  % # airspeed innovation (m/sec) and innovation variance ((m/sec)**2)
  beta: single  % # synthetic sideslip innovation (rad) and innovation variance (rad**2)
  hagl: single  % # height of ground innovation (m) and innovation variance (m**2)
  hagl_rate: single  % # height of ground rate innovation (m/s) and innovation variance ((m/s)**2)

estimator_selector_status_s = Simulink.Bus()
  timestamp: uint64  % # time since system start (microseconds)
  primary_instance: uint8
  instances_available: uint8
  instance_changed_count: uint32
  last_instance_change: uint64
  accel_device_id: uint32
  baro_device_id: uint32
  gyro_device_id: uint32
  mag_device_id: uint32
  combined_test_ratio: single[9]
  relative_test_ratio: single[9]
  healthy: logical[9]
  accumulated_gyro_error: single[4]
  accumulated_accel_error: single[4]
  gyro_fault_detected: logical
  accel_fault_detected: logical

estimator_sensor_bias_s = Simulink.Bus()
  timestamp: uint64  % # time since system start (microseconds)
  timestamp_sample: uint64  % # the timestamp of the raw data (microseconds)
  gyro_device_id: uint32  % # unique device ID for the sensor that does not change between power cycles
  gyro_bias: single[3]  % # gyroscope in-run bias in body frame (rad/s)
  gyro_bias_limit: single  % # magnitude of maximum gyroscope in-run bias in body frame (rad/s)
  gyro_bias_variance: single[3]
  gyro_bias_valid: logical
  gyro_bias_stable: logical  % # true when the gyro bias estimate is stable enough to use for calibration
  accel_device_id: uint32  % # unique device ID for the sensor that does not change between power cycles
  accel_bias: single[3]  % # accelerometer in-run bias in body frame (m/s^2)
  accel_bias_limit: single  % # magnitude of maximum accelerometer in-run bias in body frame (m/s^2)
  accel_bias_variance: single[3]
  accel_bias_valid: logical
  accel_bias_stable: logical  % # true when the accel bias estimate is stable enough to use for calibration
  mag_device_id: uint32  % # unique device ID for the sensor that does not change between power cycles
  mag_bias: single[3]  % # magnetometer in-run bias in body frame (Gauss)
  mag_bias_limit: single  % # magnitude of maximum magnetometer in-run bias in body frame (Gauss)
  mag_bias_variance: single[3]
  mag_bias_valid: logical
  mag_bias_stable: logical  % # true when the mag bias estimate is stable enough to use for calibration

estimator_states_s = Simulink.Bus()
  timestamp: uint64  % # time since system start (microseconds)
  timestamp_sample: uint64  % # the timestamp of the raw data (microseconds)
  states: single[24]  % # Internal filter states
  n_states: uint8  % # Number of states effectively used
  covariances: single[24]  % # Diagonal Elements of Covariance Matrix

estimator_status_s = Simulink.Bus()
  timestamp: uint64  % # time since system start (microseconds)
  timestamp_sample: uint64  % # the timestamp of the raw data (microseconds)
  output_tracking_error: single[3]  % # return a vector containing the output predictor angular, velocity and position tracking error magnitudes (rad), (m/s), (m)
  gps_check_fail_flags: uint16  % # Bitmask to indicate status of GPS checks - see definition below
  control_mode_flags: uint64  % # Bitmask to indicate EKF logic state
  filter_fault_flags: uint32  % # Bitmask to indicate EKF internal faults
  pos_horiz_accuracy: single  % # 1-Sigma estimated horizontal position accuracy relative to the estimators origin (m)
  pos_vert_accuracy: single  % # 1-Sigma estimated vertical position accuracy relative to the estimators origin (m)
  innovation_check_flags: uint16  % # Bitmask to indicate pass/fail status of innovation consistency checks
  mag_test_ratio: single  % # ratio of the largest magnetometer innovation component to the innovation test limit
  vel_test_ratio: single  % # ratio of the largest velocity innovation component to the innovation test limit
  pos_test_ratio: single  % # ratio of the largest horizontal position innovation component to the innovation test limit
  hgt_test_ratio: single  % # ratio of the vertical position innovation to the innovation test limit
  tas_test_ratio: single  % # ratio of the true airspeed innovation to the innovation test limit
  hagl_test_ratio: single  % # ratio of the height above ground innovation to the innovation test limit
  beta_test_ratio: single  % # ratio of the synthetic sideslip innovation to the innovation test limit
  solution_status_flags: uint16  % # Bitmask indicating which filter kinematic state outputs are valid for flight control use.
  reset_count_vel_ne: uint8  % # number of horizontal position reset events (allow to wrap if count exceeds 255)
  reset_count_vel_d: uint8  % # number of vertical velocity reset events (allow to wrap if count exceeds 255)
  reset_count_pos_ne: uint8  % # number of horizontal position reset events (allow to wrap if count exceeds 255)
  reset_count_pod_d: uint8  % # number of vertical position reset events (allow to wrap if count exceeds 255)
  reset_count_quat: uint8  % # number of quaternion reset events (allow to wrap if count exceeds 255)
  time_slip: single  % # cumulative amount of time in seconds that the EKF inertial calculation has slipped relative to system time
  pre_flt_fail_innov_heading: logical
  pre_flt_fail_innov_vel_horiz: logical
  pre_flt_fail_innov_vel_vert: logical
  pre_flt_fail_innov_height: logical
  pre_flt_fail_mag_field_disturbed: logical
  accel_device_id: uint32
  gyro_device_id: uint32
  baro_device_id: uint32
  mag_device_id: uint32
  health_flags: uint8  % # Bitmask to indicate sensor health states (vel, pos, hgt)
  timeout_flags: uint8  % # Bitmask to indicate timeout flags (vel, pos, hgt)

estimator_status_flags_s = Simulink.Bus()
  timestamp: uint64  % # time since system start (microseconds)
  timestamp_sample: uint64  % # the timestamp of the raw data (microseconds)
  control_status_changes: uint32  % # number of filter control status (cs) changes
  cs_tilt_align: logical  % #  0 - true if the filter tilt alignment is complete
  cs_yaw_align: logical  % #  1 - true if the filter yaw alignment is complete
  cs_gps: logical  % #  2 - true if GPS measurement fusion is intended
  cs_opt_flow: logical  % #  3 - true if optical flow measurements fusion is intended
  cs_mag_hdg: logical  % #  4 - true if a simple magnetic yaw heading fusion is intended
  cs_mag_3d: logical  % #  5 - true if 3-axis magnetometer measurement fusion is intended
  cs_mag_dec: logical  % #  6 - true if synthetic magnetic declination measurements fusion is intended
  cs_in_air: logical  % #  7 - true when the vehicle is airborne
  cs_wind: logical  % #  8 - true when wind velocity is being estimated
  cs_baro_hgt: logical  % #  9 - true when baro height is being fused as a primary height reference
  cs_rng_hgt: logical  % # 10 - true when range finder height is being fused as a primary height reference
  cs_gps_hgt: logical  % # 11 - true when GPS height is being fused as a primary height reference
  cs_ev_pos: logical  % # 12 - true when local position data fusion from external vision is intended
  cs_ev_yaw: logical  % # 13 - true when yaw data from external vision measurements fusion is intended
  cs_ev_hgt: logical  % # 14 - true when height data from external vision measurements is being fused
  cs_fuse_beta: logical  % # 15 - true when synthetic sideslip measurements are being fused
  cs_mag_field_disturbed: logical  % # 16 - true when the mag field does not match the expected strength
  cs_fixed_wing: logical  % # 17 - true when the vehicle is operating as a fixed wing vehicle
  cs_mag_fault: logical  % # 18 - true when the magnetometer has been declared faulty and is no longer being used
  cs_fuse_aspd: logical  % # 19 - true when airspeed measurements are being fused
  cs_gnd_effect: logical  % # 20 - true when protection from ground effect induced static pressure rise is active
  cs_rng_stuck: logical  % # 21 - true when rng data wasn't ready for more than 10s and new rng values haven't changed enough
  cs_gps_yaw: logical  % # 22 - true when yaw (not ground course) data fusion from a GPS receiver is intended
  cs_mag_aligned_in_flight: logical  % # 23 - true when the in-flight mag field alignment has been completed
  cs_ev_vel: logical  % # 24 - true when local frame velocity data fusion from external vision measurements is intended
  cs_synthetic_mag_z: logical  % # 25 - true when we are using a synthesized measurement for the magnetometer Z component
  cs_vehicle_at_rest: logical  % # 26 - true when the vehicle is at rest
  cs_gps_yaw_fault: logical  % # 27 - true when the GNSS heading has been declared faulty and is no longer being used
  cs_rng_fault: logical  % # 28 - true when the range finder has been declared faulty and is no longer being used
  cs_inertial_dead_reckoning: logical  % # 29 - true if we are no longer fusing measurements that constrain horizontal velocity drift
  cs_wind_dead_reckoning: logical  % # 30 - true if we are navigationg reliant on wind relative measurements
  cs_rng_kin_consistent: logical  % # 31 - true when the range finder kinematic consistency check is passing
  cs_fake_pos: logical  % # 32 - true when fake position measurements are being fused
  cs_fake_hgt: logical  % # 33 - true when fake height measurements are being fused
  cs_gravity_vector: logical  % # 34 - true when gravity vector measurements are being fused
  fault_status_changes: uint32  % # number of filter fault status (fs) changes
  fs_bad_mag_x: logical  % #  0 - true if the fusion of the magnetometer X-axis has encountered a numerical error
  fs_bad_mag_y: logical  % #  1 - true if the fusion of the magnetometer Y-axis has encountered a numerical error
  fs_bad_mag_z: logical  % #  2 - true if the fusion of the magnetometer Z-axis has encountered a numerical error
  fs_bad_hdg: logical  % #  3 - true if the fusion of the heading angle has encountered a numerical error
  fs_bad_mag_decl: logical  % #  4 - true if the fusion of the magnetic declination has encountered a numerical error
  fs_bad_airspeed: logical  % #  5 - true if fusion of the airspeed has encountered a numerical error
  fs_bad_sideslip: logical  % #  6 - true if fusion of the synthetic sideslip constraint has encountered a numerical error
  fs_bad_optflow_x: logical  % #  7 - true if fusion of the optical flow X axis has encountered a numerical error
  fs_bad_optflow_y: logical  % #  8 - true if fusion of the optical flow Y axis has encountered a numerical error
  fs_bad_vel_n: logical  % #  9 - true if fusion of the North velocity has encountered a numerical error
  fs_bad_vel_e: logical  % # 10 - true if fusion of the East velocity has encountered a numerical error
  fs_bad_vel_d: logical  % # 11 - true if fusion of the Down velocity has encountered a numerical error
  fs_bad_pos_n: logical  % # 12 - true if fusion of the North position has encountered a numerical error
  fs_bad_pos_e: logical  % # 13 - true if fusion of the East position has encountered a numerical error
  fs_bad_pos_d: logical  % # 14 - true if fusion of the Down position has encountered a numerical error
  fs_bad_acc_bias: logical  % # 15 - true if bad delta velocity bias estimates have been detected
  fs_bad_acc_vertical: logical  % # 16 - true if bad vertical accelerometer data has been detected
  fs_bad_acc_clipping: logical  % # 17 - true if delta velocity data contains clipping (asymmetric railing)
  innovation_fault_status_changes: uint32  % # number of innovation fault status (reject) changes
  reject_hor_vel: logical  % #  0 - true if horizontal velocity observations have been rejected
  reject_ver_vel: logical  % #  1 - true if vertical velocity observations have been rejected
  reject_hor_pos: logical  % #  2 - true if horizontal position observations have been rejected
  reject_ver_pos: logical  % #  3 - true if vertical position observations have been rejected
  reject_yaw: logical  % #  7 - true if the yaw observation has been rejected
  reject_airspeed: logical  % #  8 - true if the airspeed observation has been rejected
  reject_sideslip: logical  % #  9 - true if the synthetic sideslip observation has been rejected
  reject_hagl: logical  % # 10 - true if the height above ground observation has been rejected
  reject_optflow_x: logical  % # 11 - true if the X optical flow observation has been rejected
  reject_optflow_y: logical  % # 12 - true if the Y optical flow observation has been rejected

event_s = Simulink.Bus()
  timestamp: uint64  % # time since system start (microseconds)
  id: uint32  % # Event ID
  event_sequence: uint16  % # Event sequence number
  arguments: uint8[25]  % # (optional) arguments, depend on event id
  log_levels: uint8  % # Log levels: 4 bits MSB: internal, 4 bits LSB: external

failsafe_flags_s = Simulink.Bus()
  timestamp: uint64  % # time since system start (microseconds)
  mode_req_angular_velocity: uint32
  mode_req_attitude: uint32
  mode_req_local_alt: uint32
  mode_req_local_position: uint32
  mode_req_local_position_relaxed: uint32
  mode_req_global_position: uint32
  mode_req_mission: uint32
  mode_req_offboard_signal: uint32
  mode_req_home_position: uint32
  mode_req_wind_and_flight_time_compliance: uint32  % # if set, mode cannot be entered if wind or flight time limit exceeded
  mode_req_prevent_arming: uint32  % # if set, cannot arm while in this mode
  mode_req_manual_control: uint32
  mode_req_other: uint32  % # other requirements, not covered above (for external modes)
  angular_velocity_invalid: logical  % # Angular velocity invalid
  attitude_invalid: logical  % # Attitude invalid
  local_altitude_invalid: logical  % # Local altitude invalid
  local_position_invalid: logical  % # Local position estimate invalid
  local_position_invalid_relaxed: logical  % # Local position with reduced accuracy requirements invalid (e.g. flying with optical flow)
  local_velocity_invalid: logical  % # Local velocity estimate invalid
  global_position_invalid: logical  % # Global position estimate invalid
  auto_mission_missing: logical  % # No mission available
  offboard_control_signal_lost: logical  % # Offboard signal lost
  home_position_invalid: logical  % # No home position available
  manual_control_signal_lost: logical  % # Manual control (RC) signal lost
  gcs_connection_lost: logical  % # GCS connection lost
  battery_warning: uint8  % # Battery warning level
  battery_low_remaining_time: logical  % # Low battery based on remaining flight time
  battery_unhealthy: logical  % # Battery unhealthy
  primary_geofence_breached: logical  % # Primary Geofence breached
  mission_failure: logical  % # Mission failure
  vtol_fixed_wing_system_failure: logical  % # vehicle in fixed-wing system failure failsafe mode (after quad-chute)
  wind_limit_exceeded: logical  % # Wind limit exceeded
  flight_time_limit_exceeded: logical  % # Maximum flight time exceeded
  local_position_accuracy_low: logical  % # Local position estimate has dropped below threshold, but is currently still declared valid
  fd_critical_failure: logical  % # Critical failure (attitude/altitude limit exceeded, or external ATS)
  fd_esc_arming_failure: logical  % # ESC failed to arm
  fd_imbalanced_prop: logical  % # Imbalanced propeller detected
  fd_motor_failure: logical  % # Motor failure

failure_detector_status_s = Simulink.Bus()
  timestamp: uint64  % # time since system start (microseconds)
  fd_roll: logical
  fd_pitch: logical
  fd_alt: logical
  fd_ext: logical
  fd_arm_escs: logical
  fd_battery: logical
  fd_imbalanced_prop: logical
  fd_motor: logical
  imbalanced_prop_metric: single  % # Metric of the imbalanced propeller check (low-passed)
  motor_failure_mask: uint16  % # Bit-mask with motor indices, indicating critical motor failures

follow_target_s = Simulink.Bus()
  timestamp: uint64  % # time since system start (microseconds)
  lat: double  % # target position (deg * 1e7)
  lon: double  % # target position (deg * 1e7)
  alt: single  % # target position
  vy: single  % # target vel in y
  vx: single  % # target vel in x
  vz: single  % # target vel in z
  est_cap: uint8  % # target reporting capabilities

follow_target_estimator_s = Simulink.Bus()
  timestamp: uint64  % # time since system start (microseconds)
  last_filter_reset_timestamp: uint64  % # time of last filter reset (microseconds)
  valid: logical  % # True if estimator states are okay to be used
  stale: logical  % # True if estimator stopped receiving follow_target messages for some time. The estimate can still be valid, though it might be inaccurate.
  lat_est: double  % # Estimated target latitude
  lon_est: double  % # Estimated target longitude
  alt_est: single  % # Estimated target altitude
  pos_est: single[3]  % # Estimated target NED position (m)
  vel_est: single[3]  % # Estimated target NED velocity (m/s)
  acc_est: single[3]  % # Estimated target NED acceleration (m^2/s)
  prediction_count: uint64
  fusion_count: uint64

follow_target_status_s = Simulink.Bus()
  timestamp: uint64  % # [microseconds] time since system start
  tracked_target_course: single  % # [rad] Tracked target course in NED local frame (North is course zero)
  follow_angle: single  % # [rad] Current follow angle setting
  orbit_angle_setpoint: single  % # [rad] Current orbit angle setpoint from the smooth trajectory generator
  angular_rate_setpoint: single  % # [rad/s] Angular rate commanded from Jerk-limited Orbit Angle trajectory for Orbit Angle
  desired_position_raw: single[3]  % # [m] Raw 'idealistic' desired drone position if a drone could teleport from place to places
  in_emergency_ascent: logical  % # [bool] True when doing emergency ascent (when distance to ground is below safety altitude)
  gimbal_pitch: single  % # [rad] Gimbal pitch commanded to track target in the center of the frame

generator_status_s = Simulink.Bus()
  timestamp: uint64  % # time since system start (microseconds)
  status: uint64  % # Status flags
  battery_current: single  % # [A] Current into/out of battery. Positive for out. Negative for in. NaN: field not provided.
  load_current: single  % # [A] Current going to the UAV. If battery current not available this is the DC current from the generator. Positive for out. Negative for in. NaN: field not provided
  power_generated: single  % # [W] The power being generated. NaN: field not provided
  bus_voltage: single  % # [V] Voltage of the bus seen at the generator, or battery bus if battery bus is controlled by generator and at a different voltage to main bus.
  bat_current_setpoint: single  % # [A] The target battery current. Positive for out. Negative for in. NaN: field not provided
  runtime: uint32  % # [s] Seconds this generator has run since it was rebooted. UINT32_MAX: field not provided.
  time_until_maintenance: int32  % # [s] Seconds until this generator requires maintenance.  A negative value indicates maintenance is past-due. INT32_MAX: field not provided.
  generator_speed: uint16  % # [rpm] Speed of electrical generator or alternator. UINT16_MAX: field not provided.
  rectifier_temperature: int16  % # [degC] The temperature of the rectifier or power converter. INT16_MAX: field not provided.
  generator_temperature: int16  % # [degC] The temperature of the mechanical motor, fuel cell core or generator. INT16_MAX: field not provided.

geofence_result_s = Simulink.Bus()
  timestamp: uint64  % # time since system start (microseconds)
  geofence_violation_reason: uint8  % # one of geofence_violation_reason_t::*
  primary_geofence_breached: logical  % # true if the primary geofence is breached
  primary_geofence_action: uint8  % # action to take when the primary geofence is breached
  home_required: logical  % # true if the geofence requires a valid home position

gimbal_controls_s = Simulink.Bus()
  timestamp: uint64  % # time since system start (microseconds)
  timestamp_sample: uint64  % # the timestamp the data this control response is based on was sampled
  control: single[3]

gimbal_device_attitude_status_s = Simulink.Bus()
  timestamp: uint64  % # time since system start (microseconds)
  target_system: uint8
  target_component: uint8
  device_flags: uint16
  q: single[4]
  angular_velocity_x: single
  angular_velocity_y: single
  angular_velocity_z: single
  failure_flags: uint32
  received_from_mavlink: logical

gimbal_device_information_s = Simulink.Bus()
  timestamp: uint64  % # time since system start (microseconds)
  vendor_name: uint8[32]
  model_name: uint8[32]
  custom_name: uint8[32]
  firmware_version: uint32
  hardware_version: uint32
  uid: uint64
  cap_flags: uint16
  custom_cap_flags: uint16
  roll_min: single  % # [rad]
  roll_max: single  % # [rad]
  pitch_min: single  % # [rad]
  pitch_max: single  % # [rad]
  yaw_min: single  % # [rad]
  yaw_max: single  % # [rad]
  gimbal_device_compid: uint8

gimbal_device_set_attitude_s = Simulink.Bus()
  timestamp: uint64  % # time since system start (microseconds)
  target_system: uint8
  target_component: uint8
  flags: uint16
  q: single[4]
  angular_velocity_x: single
  angular_velocity_y: single
  angular_velocity_z: single

gimbal_manager_information_s = Simulink.Bus()
  timestamp: uint64  % # time since system start (microseconds)
  cap_flags: uint32
  gimbal_device_id: uint8
  roll_min: single  % # [rad]
  roll_max: single  % # [rad]
  pitch_min: single  % # [rad]
  pitch_max: single  % # [rad]
  yaw_min: single  % # [rad]
  yaw_max: single  % # [rad]

gimbal_manager_set_attitude_s = Simulink.Bus()
  timestamp: uint64  % # time since system start (microseconds)
  origin_sysid: uint8
  origin_compid: uint8
  target_system: uint8
  target_component: uint8
  flags: uint32
  gimbal_device_id: uint8
  q: single[4]
  angular_velocity_x: single
  angular_velocity_y: single
  angular_velocity_z: single

gimbal_manager_set_manual_control_s = Simulink.Bus()
  timestamp: uint64  % # time since system start (microseconds)
  origin_sysid: uint8
  origin_compid: uint8
  target_system: uint8
  target_component: uint8
  flags: uint32
  gimbal_device_id: uint8
  pitch: single  % # unitless -1..1, can be NAN
  yaw: single  % # unitless -1..1, can be NAN
  pitch_rate: single  % # unitless -1..1, can be NAN
  yaw_rate: single  % # unitless -1..1, can be NAN

gimbal_manager_status_s = Simulink.Bus()
  timestamp: uint64  % # time since system start (microseconds)
  flags: uint32
  gimbal_device_id: uint8
  primary_control_sysid: uint8
  primary_control_compid: uint8
  secondary_control_sysid: uint8
  secondary_control_compid: uint8

gps_dump_s = Simulink.Bus()
  timestamp: uint64  % # time since system start (microseconds)
  instance: uint8  % # Instance of GNSS receiver
  len: uint8  % # length of data, MSB bit set = message to the gps device,
  data: uint8[79]  % # data to write to the log

gps_inject_data_s = Simulink.Bus()
  timestamp: uint64  % # time since system start (microseconds)
  device_id: uint32  % # unique device ID for the sensor that does not change between power cycles
  len: uint16  % # length of data
  flags: uint8  % # LSB: 1=fragmented
  data: uint8[300]  % # data to write to GPS device (RTCM message)

gripper_s = Simulink.Bus()
  timestamp: uint64
  command: int8  % # Commanded state for the gripper

health_report_s = Simulink.Bus()
  timestamp: uint64  % # time since system start (microseconds)
  can_arm_mode_flags: uint64  % # bitfield for each flight mode (NAVIGATION_STATE_*) if arming is possible
  can_run_mode_flags: uint64  % # bitfield for each flight mode if it can run
  health_is_present_flags: uint64  % # flags for each health_component_t
  health_warning_flags: uint64
  health_error_flags: uint64
  arming_check_warning_flags: uint64
  arming_check_error_flags: uint64

heater_status_s = Simulink.Bus()
  timestamp: uint64  % # time since system start (microseconds)
  device_id: uint32
  heater_on: logical
  temperature_target_met: logical
  temperature_sensor: single
  temperature_target: single
  controller_period_usec: uint32
  controller_time_on_usec: uint32
  proportional_value: single
  integrator_value: single
  feed_forward_value: single
  mode: uint8

home_position_s = Simulink.Bus()
  timestamp: uint64  % # time since system start (microseconds)
  lat: double  % # Latitude in degrees
  lon: double  % # Longitude in degrees
  alt: single  % # Altitude in meters (AMSL)
  x: single  % # X coordinate in meters
  y: single  % # Y coordinate in meters
  z: single  % # Z coordinate in meters
  yaw: single  % # Yaw angle in radians
  valid_alt: logical  % # true when the altitude has been set
  valid_hpos: logical  % # true when the latitude and longitude have been set
  valid_lpos: logical  % # true when the local position (xyz) has been set
  manual_home: logical  % # true when home position was set manually

hover_thrust_estimate_s = Simulink.Bus()
  timestamp: uint64  % # time since system start (microseconds)
  timestamp_sample: uint64  % # time of corresponding sensor data last used for this estimate
  hover_thrust: single  % # estimated hover thrust [0.1, 0.9]
  hover_thrust_var: single  % # estimated hover thrust variance
  accel_innov: single  % # innovation of the last acceleration fusion
  accel_innov_var: single  % # innovation variance of the last acceleration fusion
  accel_innov_test_ratio: single  % # normalized innovation squared test ratio
  accel_noise_var: single  % # vertical acceleration noise variance estimated form innovation residual
  valid: logical

input_rc_s = Simulink.Bus()
  timestamp: uint64  % # time since system start (microseconds)
  timestamp_last_signal: uint64  % # last valid reception time
  channel_count: uint8  % # number of channels actually being seen
  rssi: int32  % # receive signal strength indicator (RSSI): < 0: Undefined, 0: no signal, 100: full reception
  rc_failsafe: logical  % # explicit failsafe flag: true on TX failure or TX out of range , false otherwise. Only the true state is reliable, as there are some (PPM) receivers on the market going into failsafe without telling us explicitly.
  rc_lost: logical  % # RC receiver connection status: True,if no frame has arrived in the expected time, false otherwise. True usually means that the receiver has been disconnected, but can also indicate a radio link loss on "stupid" systems. Will remain false, if a RX with failsafe option continues to transmit frames after a link loss.
  rc_lost_frame_count: uint16  % # Number of lost RC frames. Note: intended purpose: observe the radio link quality if RSSI is not available. This value must not be used to trigger any failsafe-alike functionality.
  rc_total_frame_count: uint16  % # Number of total RC frames. Note: intended purpose: observe the radio link quality if RSSI is not available. This value must not be used to trigger any failsafe-alike functionality.
  rc_ppm_frame_length: uint16  % # Length of a single PPM frame. Zero for non-PPM systems
  input_source: uint8  % # Input source
  values: uint16[18]  % # measured pulse widths for each of the supported channels
  link_quality: int8  % # link quality. Percentage 0-100%. -1 = invalid
  rssi_dbm: single  % # Actual rssi in units of dBm. NaN = invalid

internal_combustion_engine_status_s = Simulink.Bus()
  timestamp: uint64  % # time since system start (microseconds)
  state: uint8
  flags: uint32
  engine_load_percent: uint8  % # Engine load estimate, percent, [0, 127]
  engine_speed_rpm: uint32  % # Engine speed, revolutions per minute
  spark_dwell_time_ms: single  % # Spark dwell time, millisecond
  atmospheric_pressure_kpa: single  % # Atmospheric (barometric) pressure, kilopascal
  intake_manifold_pressure_kpa: single  % # Engine intake manifold pressure, kilopascal
  intake_manifold_temperature: single  % # Engine intake manifold temperature, kelvin
  coolant_temperature: single  % # Engine coolant temperature, kelvin
  oil_pressure: single  % # Oil pressure, kilopascal
  oil_temperature: single  % # Oil temperature, kelvin
  fuel_pressure: single  % # Fuel pressure, kilopascal
  fuel_consumption_rate_cm3pm: single  % # Instant fuel consumption estimate, (centimeter^3)/minute
  estimated_consumed_fuel_volume_cm3: single  % # Estimate of the consumed fuel since the start of the engine, centimeter^3
  throttle_position_percent: uint8  % # Throttle position, percent
  ecu_index: uint8  % # The index of the publishing ECU
  spark_plug_usage: uint8  % # Spark plug activity report.
  ignition_timing_deg: single  % # Cylinder ignition timing, angular degrees of the crankshaft
  injection_time_ms: single  % # Fuel injection time, millisecond
  cylinder_head_temperature: single  % # Cylinder head temperature (CHT), kelvin
  exhaust_gas_temperature: single  % # Exhaust gas temperature (EGT), kelvin
  lambda_coefficient: single  % # Estimated lambda coefficient, dimensionless ratio

iridiumsbd_status_s = Simulink.Bus()
  timestamp: uint64  % # time since system start (microseconds)
  last_heartbeat: uint64  % # timestamp of the last successful sbd session
  tx_buf_write_index: uint16  % # current size of the tx buffer
  rx_buf_read_index: uint16  % # the rx buffer is parsed up to that index
  rx_buf_end_index: uint16  % # current size of the rx buffer
  failed_sbd_sessions: uint16  % # number of failed sbd sessions
  successful_sbd_sessions: uint16  % # number of successful sbd sessions
  num_tx_buf_reset: uint16  % # number of times the tx buffer was reset
  signal_quality: uint8  % # current signal quality, 0 is no signal, 5 the best
  state: uint8  % # current state of the driver, see the satcom_state of IridiumSBD.h for the definition
  ring_pending: logical  % # indicates if a ring call is pending
  tx_buf_write_pending: logical  % # indicates if a tx buffer write is pending
  tx_session_pending: logical  % # indicates if a tx session is pending
  rx_read_pending: logical  % # indicates if a rx read is pending
  rx_session_pending: logical  % # indicates if a rx session is pending

irlock_report_s = Simulink.Bus()
  timestamp: uint64  % # time since system start (microseconds)
  signature: uint16
  pos_x: single  % # tan(theta), where theta is the angle between the target and the camera center of projection in camera x-axis
  pos_y: single  % # tan(theta), where theta is the angle between the target and the camera center of projection in camera y-axis
  size_x: single  % #/** size of target along camera x-axis in units of tan(theta) **/
  size_y: single  % #/** size of target along camera y-axis in units of tan(theta) **/

landing_gear_s = Simulink.Bus()
  timestamp: uint64  % # time since system start (microseconds)
  landing_gear: int8

landing_gear_wheel_s = Simulink.Bus()
  timestamp: uint64  % # time since system start (microseconds)
  normalized_wheel_setpoint: single  % # negative is turning left, positive turning right [-1, 1]

landing_target_innovations_s = Simulink.Bus()
  timestamp: uint64  % # time since system start (microseconds)
  innov_x: single
  innov_y: single
  innov_cov_x: single
  innov_cov_y: single

landing_target_pose_s = Simulink.Bus()
  timestamp: uint64  % # time since system start (microseconds)
  is_static: logical  % # Flag indicating whether the landing target is static or moving with respect to the ground
  rel_pos_valid: logical  % # Flag showing whether relative position is valid
  rel_vel_valid: logical  % # Flag showing whether relative velocity is valid
  x_rel: single  % # X/north position of target, relative to vehicle (navigation frame) [meters]
  y_rel: single  % # Y/east position of target, relative to vehicle (navigation frame) [meters]
  z_rel: single  % # Z/down position of target, relative to vehicle (navigation frame) [meters]
  vx_rel: single  % # X/north velocity  of target, relative to vehicle (navigation frame) [meters/second]
  vy_rel: single  % # Y/east velocity of target, relative to vehicle (navigation frame) [meters/second]
  cov_x_rel: single  % # X/north position variance [meters^2]
  cov_y_rel: single  % # Y/east position variance [meters^2]
  cov_vx_rel: single  % # X/north velocity variance [(meters/second)^2]
  cov_vy_rel: single  % # Y/east velocity variance [(meters/second)^2]
  abs_pos_valid: logical  % # Flag showing whether absolute position is valid
  x_abs: single  % # X/north position of target, relative to origin (navigation frame) [meters]
  y_abs: single  % # Y/east position of target, relative to origin (navigation frame) [meters]
  z_abs: single  % # Z/down position of target, relative to origin (navigation frame) [meters]

launch_detection_status_s = Simulink.Bus()
  timestamp: uint64  % # time since system start (microseconds)
  launch_detection_state: uint8

led_control_s = Simulink.Bus()
  timestamp: uint64  % # time since system start (microseconds)
  led_mask: uint8  % # bitmask which LED(s) to control, set to 0xff for all
  color: uint8  % # see COLOR_*
  mode: uint8  % # see MODE_*
  num_blinks: uint8  % # how many times to blink (number of on-off cycles if mode is one of MODE_BLINK_*) . Set to 0 for infinite
  priority: uint8  % # priority: higher priority events will override current lower priority events (see MAX_PRIORITY)

log_message_s = Simulink.Bus()
  timestamp: uint64  % # time since system start (microseconds)
  severity: uint8  % # log level (same as in the linux kernel, starting with 0)
  text: int8[127]

logger_status_s = Simulink.Bus()
  timestamp: uint64  % # time since system start (microseconds)
  type: uint8
  backend: uint8
  total_written_kb: single  % # total written to log in kiloBytes
  write_rate_kb_s: single  % # write rate in kiloBytes/s
  dropouts: uint32  % # number of failed buffer writes due to buffer overflow
  message_gaps: uint32  % # messages misssed
  buffer_used_bytes: uint32  % # current buffer fill in Bytes
  buffer_size_bytes: uint32  % # total buffer size in Bytes
  num_messages: uint8

mag_worker_data_s = Simulink.Bus()
  timestamp: uint64  % # time since system start (microseconds)
  timestamp_sample: uint64
  done_count: uint32
  calibration_points_perside: uint32
  calibration_interval_perside_us: uint64
  calibration_counter_total: uint32[4]
  side_data_collected: logical[4]
  x: single[4]
  y: single[4]
  z: single[4]

magnetometer_bias_estimate_s = Simulink.Bus()
  timestamp: uint64  % # time since system start (microseconds)
  bias_x: single[4]  % # estimated X-bias of all the sensors
  bias_y: single[4]  % # estimated Y-bias of all the sensors
  bias_z: single[4]  % # estimated Z-bias of all the sensors
  valid: logical[4]  % # true if the estimator has converged
  stable: logical[4]

manual_control_setpoint_s = Simulink.Bus()
  timestamp: uint64  % # time since system start (microseconds)
  timestamp_sample: uint64  % # the timestamp of the raw data (microseconds)
  valid: logical
  data_source: uint8
  roll: single  % # move right,   positive roll rotation,  right side down
  pitch: single  % # move forward, negative pitch rotation, nose down
  yaw: single  % #               positive yaw rotation,   clockwise when seen top down
  throttle: single  % # move up,      positive thrust,         -1 is minimum available 0% or -100% +1 is 100% thrust
  flaps: single  % # position of flaps switch/knob/lever [-1, 1]
  aux1: single
  aux2: single
  aux3: single
  aux4: single
  aux5: single
  aux6: single
  sticks_moving: logical

manual_control_input_s = Simulink.Bus()
  timestamp: uint64  % # time since system start (microseconds)
  timestamp_sample: uint64  % # the timestamp of the raw data (microseconds)
  valid: logical
  data_source: uint8
  roll: single  % # move right,   positive roll rotation,  right side down
  pitch: single  % # move forward, negative pitch rotation, nose down
  yaw: single  % #               positive yaw rotation,   clockwise when seen top down
  throttle: single  % # move up,      positive thrust,         -1 is minimum available 0% or -100% +1 is 100% thrust
  flaps: single  % # position of flaps switch/knob/lever [-1, 1]
  aux1: single
  aux2: single
  aux3: single
  aux4: single
  aux5: single
  aux6: single
  sticks_moving: logical

manual_control_switches_s = Simulink.Bus()
  timestamp: uint64  % # time since system start (microseconds)
  timestamp_sample: uint64  % # the timestamp of the raw data (microseconds)
  mode_slot: uint8  % # the slot a specific model selector is in
  arm_switch: uint8  % # arm/disarm switch: _DISARMED_, ARMED
  return_switch: uint8  % # return to launch 2 position switch (mandatory): _NORMAL_, RTL
  loiter_switch: uint8  % # loiter 2 position switch (optional): _MISSION_, LOITER
  offboard_switch: uint8  % # offboard 2 position switch (optional): _NORMAL_, OFFBOARD
  kill_switch: uint8  % # throttle kill: _NORMAL_, KILL
  gear_switch: uint8  % # landing gear switch: _DOWN_, UP
  transition_switch: uint8  % # VTOL transition switch: _HOVER, FORWARD_FLIGHT
  photo_switch: uint8  % # Photo trigger switch
  video_switch: uint8  % # Photo trigger switch
  engage_main_motor_switch: uint8  % # Engage the main motor (for helicopters)
  switch_changes: uint32  % # number of switch changes

mavlink_log_s = Simulink.Bus()
  timestamp: uint64  % # time since system start (microseconds)
  text: int8[127]
  severity: uint8  % # log level (same as in the linux kernel, starting with 0)

mavlink_tunnel_s = Simulink.Bus()
  timestamp: uint64  % # Time since system start (microseconds)
  payload_type: uint16  % # A code that identifies the content of the payload (0 for unknown, which is the default). If this code is less than 32768, it is a 'registered' payload type and the corresponding code should be added to the MAV_TUNNEL_PAYLOAD_TYPE enum. Software creators can register blocks of types as needed. Codes greater than 32767 are considered local experiments and should not be checked in to any widely distributed codebase.
  target_system: uint8  % # System ID (can be 0 for broadcast, but this is discouraged)
  target_component: uint8  % # Component ID (can be 0 for broadcast, but this is discouraged)
  payload_length: uint8  % # Length of the data transported in payload
  payload: uint8[128]  % # Data itself

mission_s = Simulink.Bus()
  timestamp: uint64  % # time since system start (microseconds)
  dataman_id: uint8  % # default 0, there are two offboard storage places in the dataman: 0 or 1
  count: uint16  % # count of the missions stored in the dataman
  current_seq: int32  % # default -1, start at the one changed latest

mission_result_s = Simulink.Bus()
  timestamp: uint64  % # time since system start (microseconds)
  instance_count: uint32  % # Instance count of this mission. Increments monotonically whenever the mission is modified
  seq_reached: int32  % # Sequence of the mission item which has been reached, default -1
  seq_current: uint16  % # Sequence of the current mission item
  seq_total: uint16  % # Total number of mission items
  valid: logical  % # true if mission is valid
  warning: logical  % # true if mission is valid, but has potentially problematic items leading to safety warnings
  finished: logical  % # true if mission has been completed
  failure: logical  % # true if the mission cannot continue or be completed for some reason
  item_do_jump_changed: logical  % # true if the number of do jumps remaining has changed
  item_changed_index: uint16  % # indicate which item has changed
  item_do_jump_remaining: uint16  % # set to the number of do jumps remaining for that item
  execution_mode: uint8  % # indicates the mode in which the mission is executed

mode_completed_s = Simulink.Bus()
  timestamp: uint64  % # time since system start (microseconds)
  result: uint8  % # One of RESULT_*
  nav_state: uint8  % # Source mode

mount_orientation_s = Simulink.Bus()
  timestamp: uint64  % # time since system start (microseconds)
  attitude_euler_angle: single[3]  % # Attitude/direction of the mount as euler angles in rad

navigator_mission_item_s = Simulink.Bus()
  timestamp: uint64  % # time since system start (microseconds)
  instance_count: uint32  % # Instance count of this mission. Increments monotonically whenever the mission is modified
  sequence_current: uint16  % # Sequence of the current mission item
  nav_cmd: uint16
  latitude: single
  longitude: single
  time_inside: single  % # time that the MAV should stay inside the radius before advancing in seconds
  acceptance_radius: single  % # default radius in which the mission is accepted as reached in meters
  loiter_radius: single  % # loiter radius in meters, 0 for a VTOL to hover, negative for counter-clockwise
  yaw: single  % # in radians NED -PI..+PI, NAN means don't change yaw
  altitude: single  % # altitude in meters (AMSL)
  frame: uint8  % # mission frame
  origin: uint8  % # mission item origin (onboard or mavlink)
  loiter_exit_xtrack: logical  % # exit xtrack location: 0 for center of loiter wp, 1 for exit location
  force_heading: logical  % # heading needs to be reached
  altitude_is_relative: logical  % # true if altitude is relative from start point
  autocontinue: logical  % # true if next waypoint should follow after this one
  vtol_back_transition: logical  % # part of the vtol back transition sequence

flaps_setpoint_s = Simulink.Bus()
  timestamp: uint64  % # time since system start (microseconds)
  normalized_setpoint: single  % # [0, 1]

spoilers_setpoint_s = Simulink.Bus()
  timestamp: uint64  % # time since system start (microseconds)
  normalized_setpoint: single  % # [0, 1]

npfg_status_s = Simulink.Bus()
  timestamp: uint64  % # time since system start (microseconds)
  wind_est_valid: uint8  % # (boolean) true = wind estimate is valid and/or being used by controller (also indicates if wind est usage is disabled despite being valid)
  lat_accel: single  % # resultant lateral acceleration reference [m/s^2]
  lat_accel_ff: single  % # lateral acceleration demand only for maintaining curvature [m/s^2]
  bearing_feas: single  % # bearing feasibility [0,1]
  bearing_feas_on_track: single  % # on-track bearing feasibility [0,1]
  signed_track_error: single  % # signed track error [m]
  track_error_bound: single  % # track error bound [m]
  airspeed_ref: single  % # (true) airspeed reference [m/s]
  bearing: single  % # bearing angle [rad]
  heading_ref: single  % # heading angle reference [rad]
  min_ground_speed_ref: single  % # minimum forward ground speed reference [m/s]
  adapted_period: single  % # adapted period (if auto-tuning enabled) [s]
  p_gain: single  % # controller proportional gain [rad/s]
  time_const: single  % # controller time constant [s]

obstacle_distance_s = Simulink.Bus()
  timestamp: uint64  % # time since system start (microseconds)
  frame: uint8  % #Coordinate frame of reference for the yaw rotation and offset of the sensor data. Defaults to MAV_FRAME_GLOBAL, which is North aligned. For body-mounted sensors use MAV_FRAME_BODY_FRD, which is vehicle front aligned.
  sensor_type: uint8  % # Type from MAV_DISTANCE_SENSOR enum.
  distances: uint16[72]  % # Distance of obstacles around the UAV with index 0 corresponding to local North. A value of 0 means that the obstacle is right in front of the sensor. A value of max_distance +1 means no obstacle is present. A value of UINT16_MAX for unknown/not used. In a array element, one unit corresponds to 1cm.
  increment: single  % # Angular width in degrees of each array element.
  min_distance: uint16  % # Minimum distance the sensor can measure in centimeters.
  max_distance: uint16  % # Maximum distance the sensor can measure in centimeters.
  angle_offset: single  % # Relative angle offset of the 0-index element in the distances array. Value of 0 corresponds to forward. Positive values are offsets to the right.

obstacle_distance_fused_s = Simulink.Bus()
  timestamp: uint64  % # time since system start (microseconds)
  frame: uint8  % #Coordinate frame of reference for the yaw rotation and offset of the sensor data. Defaults to MAV_FRAME_GLOBAL, which is North aligned. For body-mounted sensors use MAV_FRAME_BODY_FRD, which is vehicle front aligned.
  sensor_type: uint8  % # Type from MAV_DISTANCE_SENSOR enum.
  distances: uint16[72]  % # Distance of obstacles around the UAV with index 0 corresponding to local North. A value of 0 means that the obstacle is right in front of the sensor. A value of max_distance +1 means no obstacle is present. A value of UINT16_MAX for unknown/not used. In a array element, one unit corresponds to 1cm.
  increment: single  % # Angular width in degrees of each array element.
  min_distance: uint16  % # Minimum distance the sensor can measure in centimeters.
  max_distance: uint16  % # Maximum distance the sensor can measure in centimeters.
  angle_offset: single  % # Relative angle offset of the 0-index element in the distances array. Value of 0 corresponds to forward. Positive values are offsets to the right.

offboard_control_mode_s = Simulink.Bus()
  timestamp: uint64  % # time since system start (microseconds)
  position: logical
  velocity: logical
  acceleration: logical
  attitude: logical
  body_rate: logical
  actuator: logical

onboard_computer_status_s = Simulink.Bus()
  timestamp: uint64  % # [us] time since system start (microseconds)
  uptime: uint32  % # [ms] time since system boot of the companion (milliseconds)
  type: uint8  % # type of onboard computer 0: Mission computer primary, 1: Mission computer backup 1, 2: Mission computer backup 2, 3: Compute node, 4-5: Compute spares, 6-9: Payload computers.
  cpu_cores: uint8[8]  % # CPU usage on the component in percent
  cpu_combined: uint8[10]  % # Combined CPU usage as the last 10 slices of 100 MS
  gpu_cores: uint8[4]  % # GPU usage on the component in percent
  gpu_combined: uint8[10]  % # Combined GPU usage as the last 10 slices of 100 MS
  temperature_board: int8  % # [degC] Temperature of the board
  temperature_core: int8[8]  % # [degC] Temperature of the CPU core
  fan_speed: int16[4]  % # [rpm] Fan speeds
  ram_usage: uint32  % # [MB] Amount of used RAM on the component system
  ram_total: uint32  % # [MB] Total amount of RAM on the component system
  storage_type: uint32[4]  % # Storage type: 0: HDD, 1: SSD, 2: EMMC, 3: SD card (non-removable), 4: SD card (removable)
  storage_usage: uint32[4]  % # [MB] Amount of used storage space on the component system
  storage_total: uint32[4]  % # [MB] Total amount of storage space on the component system
  link_type: uint32[6]  % # [Kb/s] Link type: 0-9: UART, 10-19: Wired network, 20-29: Wifi, 30-39: Point-to-point proprietary, 40-49: Mesh proprietary
  link_tx_rate: uint32[6]  % # [Kb/s] Network traffic from the component system
  link_rx_rate: uint32[6]  % # [Kb/s] Network traffic to the component system
  link_tx_max: uint32[6]  % # [Kb/s] Network capacity from the component system
  link_rx_max: uint32[6]  % # [Kb/s] Network capacity to the component system

orb_test_s = Simulink.Bus()
  timestamp: uint64  % # time since system start (microseconds)
  val: int32

orb_multitest_s = Simulink.Bus()
  timestamp: uint64  % # time since system start (microseconds)
  val: int32

orb_test_large_s = Simulink.Bus()
  timestamp: uint64  % # time since system start (microseconds)
  val: int32
  junk: uint8[512]

orb_test_medium_s = Simulink.Bus()
  timestamp: uint64  % # time since system start (microseconds)
  val: int32
  junk: uint8[64]

orb_test_medium_multi_s = Simulink.Bus()
  timestamp: uint64  % # time since system start (microseconds)
  val: int32
  junk: uint8[64]

orb_test_medium_wrap_around_s = Simulink.Bus()
  timestamp: uint64  % # time since system start (microseconds)
  val: int32
  junk: uint8[64]

orb_test_medium_queue_s = Simulink.Bus()
  timestamp: uint64  % # time since system start (microseconds)
  val: int32
  junk: uint8[64]

orb_test_medium_queue_poll_s = Simulink.Bus()
  timestamp: uint64  % # time since system start (microseconds)
  val: int32
  junk: uint8[64]

orbit_status_s = Simulink.Bus()
  timestamp: uint64  % # time since system start (microseconds)
  radius: single  % # Radius of the orbit circle. Positive values orbit clockwise, negative values orbit counter-clockwise. [m]
  frame: uint8  % # The coordinate system of the fields: x, y, z.
  x: double  % # X coordinate of center point. Coordinate system depends on frame field: local = x position in meters * 1e4, global = latitude in degrees * 1e7.
  y: double  % # Y coordinate of center point. Coordinate system depends on frame field: local = y position in meters * 1e4, global = latitude in degrees * 1e7.
  z: single  % # Altitude of center point. Coordinate system depends on frame field.
  yaw_behaviour: uint8

parameter_update_s = Simulink.Bus()
  timestamp: uint64  % # time since system start (microseconds)
  instance: uint32  % # Instance count - constantly incrementing
  get_count: uint32
  set_count: uint32
  find_count: uint32
  export_count: uint32
  active: uint16
  changed: uint16
  custom_default: uint16

ping_s = Simulink.Bus()
  timestamp: uint64  % # time since system start (microseconds)
  ping_time: uint64  % # Timestamp of the ping packet
  ping_sequence: uint32  % # Sequence number of the ping packet
  dropped_packets: uint32  % # Number of dropped ping packets
  rtt_ms: single  % # Round trip time (in ms)
  system_id: uint8  % # System ID of the remote system
  component_id: uint8  % # Component ID of the remote system

position_controller_landing_status_s = Simulink.Bus()
  timestamp: uint64  % # [us] time since system start
  lateral_touchdown_offset: single  % # [m] lateral touchdown position offset manually commanded during landing
  flaring: logical  % # true if the aircraft is flaring
  abort_status: uint8

position_controller_status_s = Simulink.Bus()
  timestamp: uint64  % # time since system start (microseconds)
  nav_roll: single  % # Roll setpoint [rad]
  nav_pitch: single  % # Pitch setpoint [rad]
  nav_bearing: single  % # Bearing angle[rad]
  target_bearing: single  % # Bearing angle from aircraft to current target [rad]
  xtrack_error: single  % # Signed track error [m]
  wp_dist: single  % # Distance to active (next) waypoint [m]
  acceptance_radius: single  % # Current horizontal acceptance radius [m]
  yaw_acceptance: single  % # Yaw acceptance error[rad]
  altitude_acceptance: single  % # Current vertical acceptance error [m]
  type: uint8  % # Current (applied) position setpoint type (see PositionSetpoint.msg)

position_setpoint_s = Simulink.Bus()
  timestamp: uint64  % # time since system start (microseconds)
  valid: logical  % # true if setpoint is valid
  type: uint8  % # setpoint type to adjust behavior of position controller
  vx: single  % # local velocity setpoint in m/s in NED
  vy: single  % # local velocity setpoint in m/s in NED
  vz: single  % # local velocity setpoint in m/s in NED
  lat: double  % # latitude, in deg
  lon: double  % # longitude, in deg
  alt: single  % # altitude AMSL, in m
  yaw: single  % # yaw (only for multirotors), in rad [-PI..PI), NaN = hold current yaw
  yaw_valid: logical  % # true if yaw setpoint valid
  yawspeed: single  % # yawspeed (only for multirotors, in rad/s)
  yawspeed_valid: logical  % # true if yawspeed setpoint valid
  loiter_radius: single  % # loiter radius (only for fixed wing), in m
  loiter_direction_counter_clockwise: logical  % # loiter direction is clockwise by default and can be changed using this field
  acceptance_radius: single  % # navigation acceptance_radius if we're doing waypoint navigation
  cruising_speed: single  % # the generally desired cruising speed (not a hard constraint)
  gliding_enabled: logical  % # commands the vehicle to glide if the capability is available (fixed wing only)
  cruising_throttle: single  % # the generally desired cruising throttle (not a hard constraint), only has an effect for rover
  disable_weather_vane: logical  % # VTOL: disable (in auto mode) the weather vane feature that turns the nose into the wind

position_setpoint_triplet_s = Simulink.Bus()
  timestamp: uint64  % # time since system start (microseconds)
  previous: positionsetpoint
  current: positionsetpoint
  next: positionsetpoint

power_button_state_s = Simulink.Bus()
  timestamp: uint64  % # time since system start (microseconds)
  event: uint8  % # one of PWR_BUTTON_STATE_*

power_monitor_s = Simulink.Bus()
  timestamp: uint64  % # Time since system start (microseconds)
  voltage_v: single  % # Voltage in volts, 0 if unknown
  current_a: single  % # Current in amperes, -1 if unknown
  power_w: single  % # power in watts, -1 if unknown
  rconf: int16
  rsv: int16
  rbv: int16
  rp: int16
  rc: int16
  rcal: int16
  me: int16
  al: int16

pps_capture_s = Simulink.Bus()
  timestamp: uint64  % # time since system start (microseconds) at PPS capture event
  rtc_timestamp: uint64  % # Corrected GPS UTC timestamp at PPS capture event
  pps_rate_exceeded_counter: uint8  % # Increments when PPS dt < 50ms

pwm_input_s = Simulink.Bus()
  timestamp: uint64  % # Time since system start (microseconds)
  error_count: uint64  % # Timer overcapture error flag (AUX5 or MAIN5)
  pulse_width: uint32  % # Pulse width, timer counts
  period: uint32  % # Period, timer counts

px4io_status_s = Simulink.Bus()
  timestamp: uint64  % # time since system start (microseconds)
  free_memory_bytes: uint16
  voltage_v: single  % # Servo rail voltage in volts
  rssi_v: single  % # RSSI pin voltage in volts
  status_arm_sync: logical
  status_failsafe: logical
  status_fmu_initialized: logical
  status_fmu_ok: logical
  status_init_ok: logical
  status_outputs_armed: logical
  status_raw_pwm: logical
  status_rc_ok: logical
  status_rc_dsm: logical
  status_rc_ppm: logical
  status_rc_sbus: logical
  status_rc_st24: logical
  status_rc_sumd: logical
  status_safety_button_event: logical  % # px4io safety button was pressed for longer than 1 second
  alarm_pwm_error: logical
  alarm_rc_lost: logical
  arming_failsafe_custom: logical
  arming_fmu_armed: logical
  arming_fmu_prearmed: logical
  arming_force_failsafe: logical
  arming_io_arm_ok: logical
  arming_lockdown: logical
  arming_termination_failsafe: logical
  pwm: uint16[8]
  pwm_disarmed: uint16[8]
  pwm_failsafe: uint16[8]
  pwm_rate_hz: uint16[8]
  raw_inputs: uint16[18]

qshell_req_s = Simulink.Bus()
  timestamp: uint64  % # time since system start (microseconds)
  cmd: int8[100]
  strlen: uint32
  request_sequence: uint32

qshell_retval_s = Simulink.Bus()
  timestamp: uint64  % # time since system start (microseconds)
  return_value: int32
  return_sequence: uint32

radio_status_s = Simulink.Bus()
  timestamp: uint64  % # time since system start (microseconds)
  rssi: uint8  % # local signal strength
  remote_rssi: uint8  % # remote signal strength
  txbuf: uint8  % # how full the tx buffer is as a percentage
  noise: uint8  % # background noise level
  remote_noise: uint8  % # remote background noise level
  rxerrors: uint16  % # receive errors
  fix: uint16  % # count of error corrected packets

rate_ctrl_status_s = Simulink.Bus()
  timestamp: uint64  % # time since system start (microseconds)
  rollspeed_integ: single
  pitchspeed_integ: single
  yawspeed_integ: single
  wheel_rate_integ: single  % # FW only and optional

rc_channels_s = Simulink.Bus()
  timestamp: uint64  % # time since system start (microseconds)
  timestamp_last_valid: uint64  % # Timestamp of last valid RC signal
  channels: single[18]  % # Scaled to -1..1 (throttle: 0..1)
  channel_count: uint8  % # Number of valid channels
  function: int8[28]  % # Functions mapping
  rssi: uint8  % # Receive signal strength index
  signal_lost: logical  % # Control signal lost, should be checked together with topic timeout
  frame_drop_count: uint32  % # Number of dropped frames

rc_parameter_map_s = Simulink.Bus()
  timestamp: uint64  % # time since system start (microseconds)
  valid: logical[3]  % #true for RC-Param channels which are mapped to a param
  param_index: int32[3]  % # corresponding param index, this field is ignored if set to -1, in this case param_id will be used
  param_id: int8[51]  % # MAP_NCHAN * (ID_LEN + 1) chars, corresponding param id, null terminated
  scale: single[3]  % # scale to map the RC input [-1, 1] to a parameter value
  value0: single[3]  % # initial value around which the parameter value is changed
  value_min: single[3]  % # minimal parameter value
  value_max: single[3]  % # minimal parameter value

rpm_s = Simulink.Bus()
  timestamp: uint64  % # time since system start (microseconds)
  indicated_frequency_rpm: single  % # indicated rotor Frequency in Revolution per minute
  estimated_accurancy_rpm: single  % # estimated accuracy in Revolution per minute

rtl_time_estimate_s = Simulink.Bus()
  timestamp: uint64  % # time since system start (microseconds)
  valid: logical  % # Flag indicating whether the time estiamtes are valid
  time_estimate: single  % # [s] Estimated time for RTL
  safe_time_estimate: single  % # [s] Same as time_estimate, but with safety factor and safety margin included (factor*t + margin)

satellite_info_s = Simulink.Bus()
  timestamp: uint64  % # time since system start (microseconds)
  count: uint8  % # Number of satellites visible to the receiver
  svid: uint8[20]  % # Space vehicle ID [1..255], see scheme below
  used: uint8[20]  % # 0: Satellite not used, 1: used for navigation
  elevation: uint8[20]  % # Elevation (0: right on top of receiver, 90: on the horizon) of satellite
  azimuth: uint8[20]  % # Direction of satellite, 0: 0 deg, 255: 360 deg.
  snr: uint8[20]  % # dBHz, Signal to noise ratio of satellite C/N0, range 0..99, zero when not tracking this satellite.
  prn: uint8[20]  % # Satellite PRN code assignment, (psuedorandom number SBAS, valid codes are 120-144)

sensor_accel_s = Simulink.Bus()
  timestamp: uint64  % # time since system start (microseconds)
  timestamp_sample: uint64
  device_id: uint32  % # unique device ID for the sensor that does not change between power cycles
  x: single  % # acceleration in the FRD board frame X-axis in m/s^2
  y: single  % # acceleration in the FRD board frame Y-axis in m/s^2
  z: single  % # acceleration in the FRD board frame Z-axis in m/s^2
  temperature: single  % # temperature in degrees Celsius
  error_count: uint32
  clip_counter: uint8[3]  % # clip count per axis in the sample period
  samples: uint8  % # number of raw samples that went into this message

sensor_accel_fifo_s = Simulink.Bus()
  timestamp: uint64  % # time since system start (microseconds)
  timestamp_sample: uint64
  device_id: uint32  % # unique device ID for the sensor that does not change between power cycles
  dt: single  % # delta time between samples (microseconds)
  scale: single
  samples: uint8  % # number of valid samples
  x: int16[32]  % # acceleration in the FRD board frame X-axis in m/s^2
  y: int16[32]  % # acceleration in the FRD board frame Y-axis in m/s^2
  z: int16[32]  % # acceleration in the FRD board frame Z-axis in m/s^2

sensor_baro_s = Simulink.Bus()
  timestamp: uint64  % # time since system start (microseconds)
  timestamp_sample: uint64
  device_id: uint32  % # unique device ID for the sensor that does not change between power cycles
  pressure: single  % # static pressure measurement in Pascals
  temperature: single  % # temperature in degrees Celsius
  error_count: uint32

sensor_combined_s = Simulink.Bus()
  timestamp: uint64  % # time since system start (microseconds)
  gyro_rad: single[3]  % # average angular rate measured in the FRD body frame XYZ-axis in rad/s over the last gyro sampling period
  gyro_integral_dt: uint32  % # gyro measurement sampling period in microseconds
  accelerometer_timestamp_relative: int32  % # timestamp + accelerometer_timestamp_relative = Accelerometer timestamp
  accelerometer_m_s2: single[3]  % # average value acceleration measured in the FRD body frame XYZ-axis in m/s^2 over the last accelerometer sampling period
  accelerometer_integral_dt: uint32  % # accelerometer measurement sampling period in microseconds
  accelerometer_clipping: uint8  % # bitfield indicating if there was any accelerometer clipping (per axis) during the integration time frame
  gyro_clipping: uint8  % # bitfield indicating if there was any gyro clipping (per axis) during the integration time frame
  accel_calibration_count: uint8  % # Calibration changed counter. Monotonically increases whenever accelermeter calibration changes.
  gyro_calibration_count: uint8  % # Calibration changed counter. Monotonically increases whenever rate gyro calibration changes.

sensor_correction_s = Simulink.Bus()
  timestamp: uint64  % # time since system start (microseconds)
  gyro_device_ids: uint32[4]
  gyro_temperature: single[4]
  gyro_offset_0: single[3]  % # gyro 0 XYZ offsets in the sensor frame in rad/s
  gyro_offset_1: single[3]  % # gyro 1 XYZ offsets in the sensor frame in rad/s
  gyro_offset_2: single[3]  % # gyro 2 XYZ offsets in the sensor frame in rad/s
  gyro_offset_3: single[3]  % # gyro 3 XYZ offsets in the sensor frame in rad/s
  accel_device_ids: uint32[4]
  accel_temperature: single[4]
  accel_offset_0: single[3]  % # accelerometer 0 offsets in the FRD board frame XYZ-axis in m/s^s
  accel_offset_1: single[3]  % # accelerometer 1 offsets in the FRD board frame XYZ-axis in m/s^s
  accel_offset_2: single[3]  % # accelerometer 2 offsets in the FRD board frame XYZ-axis in m/s^s
  accel_offset_3: single[3]  % # accelerometer 3 offsets in the FRD board frame XYZ-axis in m/s^s
  baro_device_ids: uint32[4]
  baro_temperature: single[4]
  baro_offset_0: single  % # barometric pressure 0 offsets in the sensor frame in Pascals
  baro_offset_1: single  % # barometric pressure 1 offsets in the sensor frame in Pascals
  baro_offset_2: single  % # barometric pressure 2 offsets in the sensor frame in Pascals
  baro_offset_3: single  % # barometric pressure 3 offsets in the sensor frame in Pascals

sensor_gnss_relative_s = Simulink.Bus()
  timestamp: uint64  % # time since system start (microseconds)
  timestamp_sample: uint64  % # time since system start (microseconds)
  device_id: uint32  % # unique device ID for the sensor that does not change between power cycles
  time_utc_usec: uint64  % # Timestamp (microseconds, UTC), this is the timestamp which comes from the gps module. It might be unavailable right after cold start, indicated by a value of 0
  reference_station_id: uint16  % # Reference Station ID
  position: single[3]  % # GPS NED relative position vector (m)
  position_accuracy: single[3]  % # Accuracy of relative position (m)
  heading: single  % # Heading of the relative position vector (radians)
  heading_accuracy: single  % # Accuracy of heading of the relative position vector (radians)
  position_length: single
  accuracy_length: single
  gnss_fix_ok: logical  % # GNSS valid fix (i.e within DOP & accuracy masks)
  differential_solution: logical  % # differential corrections were applied
  relative_position_valid: logical
  carrier_solution_floating: logical  % # carrier phase range solution with floating ambiguities
  carrier_solution_fixed: logical  % # carrier phase range solution with fixed ambiguities
  moving_base_mode: logical  % # if the receiver is operating in moving base mode
  reference_position_miss: logical  % # extrapolated reference position was used to compute moving base solution this epoch
  reference_observations_miss: logical  % # extrapolated reference observations were used to compute moving base solution this epoch
  heading_valid: logical
  relative_position_normalized: logical  % # the components of the relative position vector (including the high-precision parts) are normalized

sensor_gps_s = Simulink.Bus()
  timestamp: uint64  % # time since system start (microseconds)
  timestamp_sample: uint64
  device_id: uint32  % # unique device ID for the sensor that does not change between power cycles
  lat: int32  % # Latitude in 1E-7 degrees
  lon: int32  % # Longitude in 1E-7 degrees
  alt: int32  % # Altitude in 1E-3 meters above MSL, (millimetres)
  alt_ellipsoid: int32  % # Altitude in 1E-3 meters bove Ellipsoid, (millimetres)
  s_variance_m_s: single  % # GPS speed accuracy estimate, (metres/sec)
  c_variance_rad: single  % # GPS course accuracy estimate, (radians)
  fix_type: uint8  % # 0-1: no fix, 2: 2D fix, 3: 3D fix, 4: RTCM code differential, 5: Real-Time Kinematic, float, 6: Real-Time Kinematic, fixed, 8: Extrapolated. Some applications will not use the value of this field unless it is at least two, so always correctly fill in the fix.
  eph: single  % # GPS horizontal position accuracy (metres)
  epv: single  % # GPS vertical position accuracy (metres)
  hdop: single  % # Horizontal dilution of precision
  vdop: single  % # Vertical dilution of precision
  noise_per_ms: int32  % # GPS noise per millisecond
  automatic_gain_control: uint16  % # Automatic gain control monitor
  jamming_state: uint8  % # indicates whether jamming has been detected or suspected by the receivers. O: Unknown, 1: OK, 2: Warning, 3: Critical
  jamming_indicator: int32  % # indicates jamming is occurring
  spoofing_state: uint8  % # indicates whether spoofing has been detected or suspected by the receivers. O: Unknown, 1: OK, 2: Warning, 3: Critical
  vel_m_s: single  % # GPS ground speed, (metres/sec)
  vel_n_m_s: single  % # GPS North velocity, (metres/sec)
  vel_e_m_s: single  % # GPS East velocity, (metres/sec)
  vel_d_m_s: single  % # GPS Down velocity, (metres/sec)
  cog_rad: single  % # Course over ground (NOT heading, but direction of movement), -PI..PI, (radians)
  vel_ned_valid: logical  % # True if NED velocity is valid
  timestamp_time_relative: int32  % # timestamp + timestamp_time_relative = Time of the UTC timestamp since system start, (microseconds)
  time_utc_usec: uint64  % # Timestamp (microseconds, UTC), this is the timestamp which comes from the gps module. It might be unavailable right after cold start, indicated by a value of 0
  satellites_used: uint8  % # Number of satellites used
  heading: single  % # heading angle of XYZ body frame rel to NED. Set to NaN if not available and updated (used for dual antenna GPS), (rad, [-PI, PI])
  heading_offset: single  % # heading offset of dual antenna array in body frame. Set to NaN if not applicable. (rad, [-PI, PI])
  heading_accuracy: single  % # heading accuracy (rad, [0, 2PI])
  rtcm_injection_rate: single  % # RTCM message injection rate Hz
  selected_rtcm_instance: uint8  % # uorb instance that is being used for RTCM corrections

vehicle_gps_position_s = Simulink.Bus()
  timestamp: uint64  % # time since system start (microseconds)
  timestamp_sample: uint64
  device_id: uint32  % # unique device ID for the sensor that does not change between power cycles
  lat: int32  % # Latitude in 1E-7 degrees
  lon: int32  % # Longitude in 1E-7 degrees
  alt: int32  % # Altitude in 1E-3 meters above MSL, (millimetres)
  alt_ellipsoid: int32  % # Altitude in 1E-3 meters bove Ellipsoid, (millimetres)
  s_variance_m_s: single  % # GPS speed accuracy estimate, (metres/sec)
  c_variance_rad: single  % # GPS course accuracy estimate, (radians)
  fix_type: uint8  % # 0-1: no fix, 2: 2D fix, 3: 3D fix, 4: RTCM code differential, 5: Real-Time Kinematic, float, 6: Real-Time Kinematic, fixed, 8: Extrapolated. Some applications will not use the value of this field unless it is at least two, so always correctly fill in the fix.
  eph: single  % # GPS horizontal position accuracy (metres)
  epv: single  % # GPS vertical position accuracy (metres)
  hdop: single  % # Horizontal dilution of precision
  vdop: single  % # Vertical dilution of precision
  noise_per_ms: int32  % # GPS noise per millisecond
  automatic_gain_control: uint16  % # Automatic gain control monitor
  jamming_state: uint8  % # indicates whether jamming has been detected or suspected by the receivers. O: Unknown, 1: OK, 2: Warning, 3: Critical
  jamming_indicator: int32  % # indicates jamming is occurring
  spoofing_state: uint8  % # indicates whether spoofing has been detected or suspected by the receivers. O: Unknown, 1: OK, 2: Warning, 3: Critical
  vel_m_s: single  % # GPS ground speed, (metres/sec)
  vel_n_m_s: single  % # GPS North velocity, (metres/sec)
  vel_e_m_s: single  % # GPS East velocity, (metres/sec)
  vel_d_m_s: single  % # GPS Down velocity, (metres/sec)
  cog_rad: single  % # Course over ground (NOT heading, but direction of movement), -PI..PI, (radians)
  vel_ned_valid: logical  % # True if NED velocity is valid
  timestamp_time_relative: int32  % # timestamp + timestamp_time_relative = Time of the UTC timestamp since system start, (microseconds)
  time_utc_usec: uint64  % # Timestamp (microseconds, UTC), this is the timestamp which comes from the gps module. It might be unavailable right after cold start, indicated by a value of 0
  satellites_used: uint8  % # Number of satellites used
  heading: single  % # heading angle of XYZ body frame rel to NED. Set to NaN if not available and updated (used for dual antenna GPS), (rad, [-PI, PI])
  heading_offset: single  % # heading offset of dual antenna array in body frame. Set to NaN if not applicable. (rad, [-PI, PI])
  heading_accuracy: single  % # heading accuracy (rad, [0, 2PI])
  rtcm_injection_rate: single  % # RTCM message injection rate Hz
  selected_rtcm_instance: uint8  % # uorb instance that is being used for RTCM corrections

sensor_gyro_s = Simulink.Bus()
  timestamp: uint64  % # time since system start (microseconds)
  timestamp_sample: uint64
  device_id: uint32  % # unique device ID for the sensor that does not change between power cycles
  x: single  % # angular velocity in the FRD board frame X-axis in rad/s
  y: single  % # angular velocity in the FRD board frame Y-axis in rad/s
  z: single  % # angular velocity in the FRD board frame Z-axis in rad/s
  temperature: single  % # temperature in degrees Celsius
  error_count: uint32
  clip_counter: uint8[3]  % # clip count per axis in the sample period
  samples: uint8  % # number of raw samples that went into this message

sensor_gyro_fft_s = Simulink.Bus()
  timestamp: uint64  % # time since system start (microseconds)
  timestamp_sample: uint64
  device_id: uint32  % # unique device ID for the sensor that does not change between power cycles
  sensor_sample_rate_hz: single
  resolution_hz: single
  peak_frequencies_x: single[3]  % # x axis peak frequencies
  peak_frequencies_y: single[3]  % # y axis peak frequencies
  peak_frequencies_z: single[3]  % # z axis peak frequencies
  peak_snr_x: single[3]  % # x axis peak SNR
  peak_snr_y: single[3]  % # y axis peak SNR
  peak_snr_z: single[3]  % # z axis peak SNR

sensor_gyro_fifo_s = Simulink.Bus()
  timestamp: uint64  % # time since system start (microseconds)
  timestamp_sample: uint64
  device_id: uint32  % # unique device ID for the sensor that does not change between power cycles
  dt: single  % # delta time between samples (microseconds)
  scale: single
  samples: uint8  % # number of valid samples
  x: int16[32]  % # angular velocity in the FRD board frame X-axis in rad/s
  y: int16[32]  % # angular velocity in the FRD board frame Y-axis in rad/s
  z: int16[32]  % # angular velocity in the FRD board frame Z-axis in rad/s

sensor_hygrometer_s = Simulink.Bus()
  timestamp: uint64  % # time since system start (microseconds)
  timestamp_sample: uint64
  device_id: uint32  % # unique device ID for the sensor that does not change between power cycles
  temperature: single  % # Temperature provided by sensor (Celsius)
  humidity: single  % # Humidity provided by sensor

sensor_mag_s = Simulink.Bus()
  timestamp: uint64  % # time since system start (microseconds)
  timestamp_sample: uint64
  device_id: uint32  % # unique device ID for the sensor that does not change between power cycles
  x: single  % # magnetic field in the FRD board frame X-axis in Gauss
  y: single  % # magnetic field in the FRD board frame Y-axis in Gauss
  z: single  % # magnetic field in the FRD board frame Z-axis in Gauss
  temperature: single  % # temperature in degrees Celsius
  error_count: uint32

sensor_optical_flow_s = Simulink.Bus()
  timestamp: uint64  % # time since system start (microseconds)
  timestamp_sample: uint64
  device_id: uint32  % # unique device ID for the sensor that does not change between power cycles
  pixel_flow: single[2]  % # (radians) optical flow in radians where a positive value is produced by a RH rotation about the body axis
  delta_angle: single[3]  % # (radians) accumulated gyro radians where a positive value is produced by a RH rotation about the body axis. Set to NaN if flow sensor does not have 3-axis gyro data.
  delta_angle_available: logical
  distance_m: single  % # (meters) Distance to the center of the flow field
  distance_available: logical
  integration_timespan_us: uint32  % # (microseconds) accumulation timespan in microseconds
  quality: uint8  % # quality, 0: bad quality, 255: maximum quality
  error_count: uint32
  max_flow_rate: single  % # (radians/s) Magnitude of maximum angular which the optical flow sensor can measure reliably
  min_ground_distance: single  % # (meters) Minimum distance from ground at which the optical flow sensor operates reliably
  max_ground_distance: single  % # (meters) Maximum distance from ground at which the optical flow sensor operates reliably
  mode: uint8

sensor_preflight_mag_s = Simulink.Bus()
  timestamp: uint64  % # time since system start (microseconds)
  mag_inconsistency_angle: single  % # maximum angle between magnetometer instance field vectors in radians.

sensor_selection_s = Simulink.Bus()
  timestamp: uint64  % # time since system start (microseconds)
  accel_device_id: uint32  % # unique device ID for the selected accelerometers
  gyro_device_id: uint32  % # unique device ID for the selected rate gyros

sensor_uwb_s = Simulink.Bus()
  timestamp: uint64  % # time since system start (microseconds)
  sessionid: uint32  % # UWB SessionID
  time_offset: uint32  % # Time between Ranging Rounds in ms
  counter: uint32  % # Number of Ranges since last Start of Ranging
  mac: uint16  % # MAC adress of Initiator (controller)
  mac_dest: uint16  % # MAC adress of Responder (Controlee)
  status: uint16  % # status feedback #
  nlos: uint8  % # None line of site condition y/n
  distance: single  % # distance in m to the UWB receiver
  aoa_azimuth_dev: single  % # Angle of arrival of first incomming RX msg
  aoa_elevation_dev: single  % # Angle of arrival of first incomming RX msg
  aoa_azimuth_resp: single  % # Angle of arrival of first incomming RX msg at the responder
  aoa_elevation_resp: single  % # Angle of arrival of first incomming RX msg at the responder
  aoa_azimuth_fom: uint8  % # AOA Azimuth FOM
  aoa_elevation_fom: uint8  % # AOA Elevation FOM
  aoa_dest_azimuth_fom: uint8  % # AOA Azimuth FOM
  aoa_dest_elevation_fom: uint8  % # AOA Elevation FOM
  orientation: uint8  % # Direction the sensor faces from MAV_SENSOR_ORIENTATION enum
  offset_x: single  % # UWB initiator offset in X axis (NED drone frame)
  offset_y: single  % # UWB initiator offset in Y axis (NED drone frame)
  offset_z: single  % # UWB initiator offset in Z axis (NED drone frame)

sensors_status_baro_s = Simulink.Bus()
  timestamp: uint64  % # time since system start (microseconds)
  device_id_primary: uint32  % # current primary device id for reference
  device_ids: uint32[4]
  inconsistency: single[4]  % # magnitude of difference between sensor instance and mean
  healthy: logical[4]  % # sensor healthy
  priority: uint8[4]
  enabled: logical[4]
  external: logical[4]

sensors_status_mag_s = Simulink.Bus()
  timestamp: uint64  % # time since system start (microseconds)
  device_id_primary: uint32  % # current primary device id for reference
  device_ids: uint32[4]
  inconsistency: single[4]  % # magnitude of difference between sensor instance and mean
  healthy: logical[4]  % # sensor healthy
  priority: uint8[4]
  enabled: logical[4]
  external: logical[4]

sensors_status_imu_s = Simulink.Bus()
  timestamp: uint64  % # time since system start (microseconds)
  accel_device_id_primary: uint32  % # current primary accel device id for reference
  accel_device_ids: uint32[4]
  accel_inconsistency_m_s_s: single[4]  % # magnitude of acceleration difference between IMU instance and mean in m/s^2.
  accel_healthy: logical[4]
  accel_priority: uint8[4]
  gyro_device_id_primary: uint32  % # current primary gyro device id for reference
  gyro_device_ids: uint32[4]
  gyro_inconsistency_rad_s: single[4]  % # magnitude of angular rate difference between IMU instance and mean in (rad/s).
  gyro_healthy: logical[4]
  gyro_priority: uint8[4]

system_power_s = Simulink.Bus()
  timestamp: uint64  % # time since system start (microseconds)
  voltage5v_v: single  % # peripheral 5V rail voltage
  sensors3v3: single[4]  % # Sensors 3V3 rail voltage
  sensors3v3_valid: uint8  % # Sensors 3V3 rail voltage was read (bitfield).
  usb_connected: uint8  % # USB is connected when 1
  brick_valid: uint8  % # brick bits power is good when bit 1
  usb_valid: uint8  % # USB is valid when 1
  servo_valid: uint8  % # servo power is good when 1
  periph_5v_oc: uint8  % # peripheral overcurrent when 1
  hipower_5v_oc: uint8  % # high power peripheral overcurrent when 1
  comp_5v_valid: uint8  % # 5V to companion valid
  can1_gps1_5v_valid: uint8  % # 5V for CAN1/GPS1 valid

takeoff_status_s = Simulink.Bus()
  timestamp: uint64  % # time since system start (microseconds)
  takeoff_state: uint8
  tilt_limit: single  % # limited tilt feasibility during takeoff, contains maximum tilt otherwise

task_stack_info_s = Simulink.Bus()
  timestamp: uint64  % # time since system start (microseconds)
  stack_free: uint16
  task_name: int8[24]

tecs_status_s = Simulink.Bus()
  timestamp: uint64  % # time since system start (microseconds)
  altitude_sp: single  % # Altitude setpoint AMSL [m]
  altitude_reference: single  % # Altitude setpoint reference AMSL [m]
  height_rate_reference: single  % # Height rate setpoint reference [m/s]
  height_rate_direct: single  % # Direct height rate setpoint from velocity reference generator [m/s]
  height_rate_setpoint: single  % # Height rate setpoint [m/s]
  height_rate: single  % # Height rate [m/s]
  equivalent_airspeed_sp: single  % # Equivalent airspeed setpoint [m/s]
  true_airspeed_sp: single  % # True airspeed setpoint [m/s]
  true_airspeed_filtered: single  % # True airspeed filtered [m/s]
  true_airspeed_derivative_sp: single  % # True airspeed derivative setpoint [m/s^2]
  true_airspeed_derivative: single  % # True airspeed derivative [m/s^2]
  true_airspeed_derivative_raw: single  % # True airspeed derivative raw [m/s^2]
  total_energy_rate_sp: single  % # Total energy rate setpoint [m^2/s^3]
  total_energy_rate: single  % # Total energy rate estimate [m^2/s^3]
  total_energy_balance_rate_sp: single  % # Energy balance rate setpoint [m^2/s^3]
  total_energy_balance_rate: single  % # Energy balance rate estimate [m^2/s^3]
  throttle_integ: single  % # Throttle integrator value [-]
  pitch_integ: single  % # Pitch integrator value [rad]
  throttle_sp: single  % # Current throttle setpoint [-]
  pitch_sp_rad: single  % # Current pitch setpoint [rad]
  throttle_trim: single  % # estimated throttle value [0,1] required to fly level at equivalent_airspeed_sp in the current atmospheric conditions
  mode: uint8

telemetry_status_s = Simulink.Bus()
  timestamp: uint64  % # time since system start (microseconds)
  type: uint8  % #  type of the radio hardware (LINK_TYPE_*)
  mode: uint8
  flow_control: logical
  forwarding: logical
  mavlink_v2: logical
  ftp: logical
  streams: uint8
  data_rate: single  % # configured maximum data rate (Bytes/s)
  rate_multiplier: single
  tx_rate_avg: single  % # transmit rate average (Bytes/s)
  tx_error_rate_avg: single  % # transmit error rate average (Bytes/s)
  tx_message_count: uint32  % # total message sent count
  tx_buffer_overruns: uint32  % # number of TX buffer overruns
  rx_rate_avg: single  % # transmit rate average (Bytes/s)
  rx_message_count: uint32  % # count of total messages received
  rx_message_lost_count: uint32
  rx_buffer_overruns: uint32  % # number of RX buffer overruns
  rx_parse_errors: uint32  % # number of parse errors
  rx_packet_drop_count: uint32  % # number of packet drops
  rx_message_lost_rate: single
  heartbeat_type_antenna_tracker: logical  % # MAV_TYPE_ANTENNA_TRACKER
  heartbeat_type_gcs: logical  % # MAV_TYPE_GCS
  heartbeat_type_onboard_controller: logical  % # MAV_TYPE_ONBOARD_CONTROLLER
  heartbeat_type_gimbal: logical  % # MAV_TYPE_GIMBAL
  heartbeat_type_adsb: logical  % # MAV_TYPE_ADSB
  heartbeat_type_camera: logical  % # MAV_TYPE_CAMERA
  heartbeat_type_parachute: logical  % # MAV_TYPE_PARACHUTE
  heartbeat_type_open_drone_id: logical  % # MAV_TYPE_ODID
  heartbeat_component_telemetry_radio: logical  % # MAV_COMP_ID_TELEMETRY_RADIO
  heartbeat_component_log: logical  % # MAV_COMP_ID_LOG
  heartbeat_component_osd: logical  % # MAV_COMP_ID_OSD
  heartbeat_component_obstacle_avoidance: logical  % # MAV_COMP_ID_OBSTACLE_AVOIDANCE
  heartbeat_component_vio: logical  % # MAV_COMP_ID_VISUAL_INERTIAL_ODOMETRY
  heartbeat_component_pairing_manager: logical  % # MAV_COMP_ID_PAIRING_MANAGER
  heartbeat_component_udp_bridge: logical  % # MAV_COMP_ID_UDP_BRIDGE
  heartbeat_component_uart_bridge: logical  % # MAV_COMP_ID_UART_BRIDGE
  avoidance_system_healthy: logical
  open_drone_id_system_healthy: logical
  parachute_system_healthy: logical

tiltrotor_extra_controls_s = Simulink.Bus()
  timestamp: uint64  % # time since system start (microseconds)
  collective_tilt_normalized_setpoint: single  % # Collective tilt angle of motors of tiltrotor, 0: vertical, 1: horizontal [0, 1]
  collective_thrust_normalized_setpoint: single  % # Collective thrust setpoint [0, 1]

timesync_status_s = Simulink.Bus()
  timestamp: uint64  % # time since system start (microseconds)
  source_protocol: uint8  % # timesync source
  remote_timestamp: uint64  % # remote system timestamp (microseconds)
  observed_offset: int64  % # raw time offset directly observed from this timesync packet (microseconds)
  estimated_offset: int64  % # smoothed time offset between companion system and PX4 (microseconds)
  round_trip_time: uint32  % # round trip time of this timesync packet (microseconds)

trajectory_bezier_s = Simulink.Bus()
  timestamp: uint64  % # time since system start (microseconds)
  position: single[3]  % # local position x,y,z (metres)
  yaw: single  % # yaw angle (rad)
  delta: single  % # time it should take to get to this waypoint, if this is the final waypoint (seconds)

trajectory_setpoint_s = Simulink.Bus()
  timestamp: uint64  % # time since system start (microseconds)
  position: single[3]  % # in meters
  velocity: single[3]  % # in meters/second
  acceleration: single[3]  % # in meters/second^2
  jerk: single[3]  % # in meters/second^3 (for logging only)
  yaw: single  % # euler angle of desired attitude in radians -PI..+PI
  yawspeed: single  % # angular velocity around NED frame z-axis in radians/second

trajectory_waypoint_s = Simulink.Bus()
  timestamp: uint64  % # time since system start (microseconds)
  position: single[3]
  velocity: single[3]
  acceleration: single[3]
  yaw: single
  yaw_speed: single
  point_valid: logical
  type: uint8

transponder_report_s = Simulink.Bus()
  timestamp: uint64  % # time since system start (microseconds)
  icao_address: uint32  % # ICAO address
  lat: double  % # Latitude, expressed as degrees
  lon: double  % # Longitude, expressed as degrees
  altitude_type: uint8  % # Type from ADSB_ALTITUDE_TYPE enum
  altitude: single  % # Altitude(ASL) in meters
  heading: single  % # Course over ground in radians, -pi to +pi, 0 is north
  hor_velocity: single  % # The horizontal velocity in m/s
  ver_velocity: single  % # The vertical velocity in m/s, positive is up
  callsign: int8[9]  % # The callsign, 8+null
  emitter_type: uint8  % # Type from ADSB_EMITTER_TYPE enum
  tslc: uint8  % # Time since last communication in seconds
  flags: uint16  % # Flags to indicate various statuses including valid data fields
  squawk: uint16  % # Squawk code
  uas_id: uint8[18]  % # Unique UAS ID

tune_control_s = Simulink.Bus()
  timestamp: uint64  % # time since system start (microseconds)
  tune_id: uint8  % # tune_id corresponding to TuneID::* from the tune_defaults.h in the tunes library
  tune_override: logical  % # if true the tune which is playing will be stopped and the new started
  frequency: uint16  % # in Hz
  duration: uint32  % # in us
  silence: uint32  % # in us
  volume: uint8  % # value between 0-100 if supported by backend

uavcan_parameter_request_s = Simulink.Bus()
  timestamp: uint64  % # time since system start (microseconds)
  message_type: uint8  % # MAVLink message type: PARAM_REQUEST_READ, PARAM_REQUEST_LIST, PARAM_SET
  node_id: uint8  % # UAVCAN node ID mapped from MAVLink component ID
  param_id: int8[17]  % # MAVLink/UAVCAN parameter name
  param_index: int16  % # -1 if the param_id field should be used as identifier
  param_type: uint8  % # MAVLink parameter type
  int_value: int64  % # current value if param_type is int-like
  real_value: single  % # current value if param_type is float-like

uavcan_parameter_value_s = Simulink.Bus()
  timestamp: uint64  % # time since system start (microseconds)
  node_id: uint8  % # UAVCAN node ID mapped from MAVLink component ID
  param_id: int8[17]  % # MAVLink/UAVCAN parameter name
  param_index: int16  % # parameter index, if known
  param_count: uint16  % # number of parameters exposed by the node
  param_type: uint8  % # MAVLink parameter type
  int_value: int64  % # current value if param_type is int-like
  real_value: single  % # current value if param_type is float-like

ulog_stream_s = Simulink.Bus()
  timestamp: uint64  % # time since system start (microseconds)
  length: uint8  % # length of data
  first_message_offset: uint8  % # offset into data where first message starts. This
  msg_sequence: uint16  % # allows determine drops
  flags: uint8  % # see FLAGS_*
  data: uint8[249]  % # ulog data

ulog_stream_ack_s = Simulink.Bus()
  timestamp: uint64  % # time since system start (microseconds)
  msg_sequence: uint16

vehicle_acceleration_s = Simulink.Bus()
  timestamp: uint64  % # time since system start (microseconds)
  timestamp_sample: uint64  % # the timestamp of the raw data (microseconds)
  xyz: single[3]  % # Bias corrected acceleration (including gravity) in the FRD body frame XYZ-axis in m/s^2

vehicle_air_data_s = Simulink.Bus()
  timestamp: uint64  % # time since system start (microseconds)
  timestamp_sample: uint64  % # the timestamp of the raw data (microseconds)
  baro_device_id: uint32  % # unique device ID for the selected barometer
  baro_alt_meter: single  % # Altitude above MSL calculated from temperature compensated baro sensor data using an ISA corrected for sea level pressure SENS_BARO_QNH.
  baro_temp_celcius: single  % # Temperature in degrees Celsius
  baro_pressure_pa: single  % # Absolute pressure in Pascals
  rho: single  % # air density
  calibration_count: uint8  % # Calibration changed counter. Monotonically increases whenever calibration changes.

vehicle_angular_acceleration_setpoint_s = Simulink.Bus()
  timestamp: uint64  % # time since system start (microseconds)
  timestamp_sample: uint64  % # timestamp of the data sample on which this message is based (microseconds)
  xyz: single[3]  % # angular acceleration about X, Y, Z body axis in rad/s^2

vehicle_angular_velocity_s = Simulink.Bus()
  timestamp: uint64  % # time since system start (microseconds)
  timestamp_sample: uint64  % # timestamp of the data sample on which this message is based (microseconds)
  xyz: single[3]  % # Bias corrected angular velocity about the FRD body frame XYZ-axis in rad/s
  xyz_derivative: single[3]  % # angular acceleration about the FRD body frame XYZ-axis in rad/s^2

vehicle_angular_velocity_groundtruth_s = Simulink.Bus()
  timestamp: uint64  % # time since system start (microseconds)
  timestamp_sample: uint64  % # timestamp of the data sample on which this message is based (microseconds)
  xyz: single[3]  % # Bias corrected angular velocity about the FRD body frame XYZ-axis in rad/s
  xyz_derivative: single[3]  % # angular acceleration about the FRD body frame XYZ-axis in rad/s^2

estimator_attitude_s = Simulink.Bus()
  timestamp: uint64  % # time since system start (microseconds)
  timestamp_sample: uint64  % # the timestamp of the raw data (microseconds)
  q: single[4]  % # Quaternion rotation from the FRD body frame to the NED earth frame
  delta_q_reset: single[4]  % # Amount by which quaternion has changed during last reset
  quat_reset_counter: uint8  % # Quaternion reset counter

vehicle_attitude_setpoint_s = Simulink.Bus()
  timestamp: uint64  % # time since system start (microseconds)
  roll_body: single  % # body angle in NED frame (can be NaN for FW)
  pitch_body: single  % # body angle in NED frame (can be NaN for FW)
  yaw_body: single  % # body angle in NED frame (can be NaN for FW)
  yaw_sp_move_rate: single  % # rad/s (commanded by user)
  q_d: single[4]  % # Desired quaternion for quaternion control
  thrust_body: single[3]  % # Normalized thrust command in body NED frame [-1,1]
  reset_integral: logical  % # Reset roll/pitch/yaw integrals (navigation logic change)
  fw_control_yaw_wheel: logical  % # control heading with steering wheel (used for auto takeoff on runway)

mc_virtual_attitude_setpoint_s = Simulink.Bus()
  timestamp: uint64  % # time since system start (microseconds)
  roll_body: single  % # body angle in NED frame (can be NaN for FW)
  pitch_body: single  % # body angle in NED frame (can be NaN for FW)
  yaw_body: single  % # body angle in NED frame (can be NaN for FW)
  yaw_sp_move_rate: single  % # rad/s (commanded by user)
  q_d: single[4]  % # Desired quaternion for quaternion control
  thrust_body: single[3]  % # Normalized thrust command in body NED frame [-1,1]
  reset_integral: logical  % # Reset roll/pitch/yaw integrals (navigation logic change)
  fw_control_yaw_wheel: logical  % # control heading with steering wheel (used for auto takeoff on runway)

fw_virtual_attitude_setpoint_s = Simulink.Bus()
  timestamp: uint64  % # time since system start (microseconds)
  roll_body: single  % # body angle in NED frame (can be NaN for FW)
  pitch_body: single  % # body angle in NED frame (can be NaN for FW)
  yaw_body: single  % # body angle in NED frame (can be NaN for FW)
  yaw_sp_move_rate: single  % # rad/s (commanded by user)
  q_d: single[4]  % # Desired quaternion for quaternion control
  thrust_body: single[3]  % # Normalized thrust command in body NED frame [-1,1]
  reset_integral: logical  % # Reset roll/pitch/yaw integrals (navigation logic change)
  fw_control_yaw_wheel: logical  % # control heading with steering wheel (used for auto takeoff on runway)

vehicle_command_s = Simulink.Bus()
  timestamp: uint64  % # time since system start (microseconds)
  param1: single  % # Parameter 1, as defined by MAVLink uint16 VEHICLE_CMD enum.
  param2: single  % # Parameter 2, as defined by MAVLink uint16 VEHICLE_CMD enum.
  param3: single  % # Parameter 3, as defined by MAVLink uint16 VEHICLE_CMD enum.
  param4: single  % # Parameter 4, as defined by MAVLink uint16 VEHICLE_CMD enum.
  param5: double  % # Parameter 5, as defined by MAVLink uint16 VEHICLE_CMD enum.
  param6: double  % # Parameter 6, as defined by MAVLink uint16 VEHICLE_CMD enum.
  param7: single  % # Parameter 7, as defined by MAVLink uint16 VEHICLE_CMD enum.
  command: uint32  % # Command ID
  target_system: uint8  % # System which should execute the command
  target_component: uint8  % # Component which should execute the command, 0 for all components
  source_system: uint8  % # System sending the command
  source_component: uint8  % # Component sending the command
  confirmation: uint8  % # 0: First transmission of this command. 1-255: Confirmation transmissions (e.g. for kill command)
  from_external: logical

gimbal_v1_command_s = Simulink.Bus()
  timestamp: uint64  % # time since system start (microseconds)
  param1: single  % # Parameter 1, as defined by MAVLink uint16 VEHICLE_CMD enum.
  param2: single  % # Parameter 2, as defined by MAVLink uint16 VEHICLE_CMD enum.
  param3: single  % # Parameter 3, as defined by MAVLink uint16 VEHICLE_CMD enum.
  param4: single  % # Parameter 4, as defined by MAVLink uint16 VEHICLE_CMD enum.
  param5: double  % # Parameter 5, as defined by MAVLink uint16 VEHICLE_CMD enum.
  param6: double  % # Parameter 6, as defined by MAVLink uint16 VEHICLE_CMD enum.
  param7: single  % # Parameter 7, as defined by MAVLink uint16 VEHICLE_CMD enum.
  command: uint32  % # Command ID
  target_system: uint8  % # System which should execute the command
  target_component: uint8  % # Component which should execute the command, 0 for all components
  source_system: uint8  % # System sending the command
  source_component: uint8  % # Component sending the command
  confirmation: uint8  % # 0: First transmission of this command. 1-255: Confirmation transmissions (e.g. for kill command)
  from_external: logical

vehicle_command_ack_s = Simulink.Bus()
  timestamp: uint64  % # time since system start (microseconds)
  command: uint32  % # Command that is being acknowledged
  result: uint8  % # Command result
  result_param1: uint8  % # Also used as progress[%], it can be set with the reason why the command was denied, or the progress percentage when result is MAV_RESULT_IN_PROGRESS
  result_param2: int32  % # Additional parameter of the result, example: which parameter of MAV_CMD_NAV_WAYPOINT caused it to be denied.
  target_system: uint8
  target_component: uint8
  from_external: logical  % # Indicates if the command came from an external source

vehicle_constraints_s = Simulink.Bus()
  timestamp: uint64  % # time since system start (microseconds)
  speed_up: single  % # in meters/sec
  speed_down: single  % # in meters/sec
  want_takeoff: logical  % # tell the controller to initiate takeoff when idling (ignored during flight)

vehicle_control_mode_s = Simulink.Bus()
  timestamp: uint64  % # time since system start (microseconds)
  flag_armed: logical  % # synonym for actuator_armed.armed
  flag_multicopter_position_control_enabled: logical
  flag_control_manual_enabled: logical  % # true if manual input is mixed in
  flag_control_auto_enabled: logical  % # true if onboard autopilot should act
  flag_control_offboard_enabled: logical  % # true if offboard control should be used
  flag_control_rates_enabled: logical  % # true if rates are stabilized
  flag_control_attitude_enabled: logical  % # true if attitude stabilization is mixed in
  flag_control_acceleration_enabled: logical  % # true if acceleration is controlled
  flag_control_velocity_enabled: logical  % # true if horizontal velocity (implies direction) is controlled
  flag_control_position_enabled: logical  % # true if position is controlled
  flag_control_altitude_enabled: logical  % # true if altitude is controlled
  flag_control_climb_rate_enabled: logical  % # true if climb rate is controlled
  flag_control_termination_enabled: logical  % # true if flighttermination is enabled

estimator_global_position_s = Simulink.Bus()
  timestamp: uint64  % # time since system start (microseconds)
  timestamp_sample: uint64  % # the timestamp of the raw data (microseconds)
  lat: double  % # Latitude, (degrees)
  lon: double  % # Longitude, (degrees)
  alt: single  % # Altitude AMSL, (meters)
  alt_ellipsoid: single  % # Altitude above ellipsoid, (meters)
  delta_alt: single  % # Reset delta for altitude
  lat_lon_reset_counter: uint8  % # Counter for reset events on horizontal position coordinates
  alt_reset_counter: uint8  % # Counter for reset events on altitude
  eph: single  % # Standard deviation of horizontal position error, (metres)
  epv: single  % # Standard deviation of vertical position error, (metres)
  terrain_alt: single  % # Terrain altitude WGS84, (metres)
  terrain_alt_valid: logical  % # Terrain altitude estimate is valid
  dead_reckoning: logical  % # True if this position is estimated through dead-reckoning

vehicle_imu_s = Simulink.Bus()
  timestamp: uint64  % # time since system start (microseconds)
  timestamp_sample: uint64
  accel_device_id: uint32  % # Accelerometer unique device ID for the sensor that does not change between power cycles
  gyro_device_id: uint32  % # Gyroscope unique device ID for the sensor that does not change between power cycles
  delta_angle: single[3]  % # delta angle about the FRD body frame XYZ-axis in rad over the integration time frame (delta_angle_dt)
  delta_velocity: single[3]  % # delta velocity in the FRD body frame XYZ-axis in m/s over the integration time frame (delta_velocity_dt)
  delta_angle_dt: uint16  % # integration period in microseconds
  delta_velocity_dt: uint16  % # integration period in microseconds
  delta_angle_clipping: uint8  % # bitfield indicating if there was any gyro clipping (per axis) during the integration time frame
  delta_velocity_clipping: uint8  % # bitfield indicating if there was any accelerometer clipping (per axis) during the integration time frame
  accel_calibration_count: uint8  % # Calibration changed counter. Monotonically increases whenever accelermeter calibration changes.
  gyro_calibration_count: uint8  % # Calibration changed counter. Monotonically increases whenever rate gyro calibration changes.

vehicle_imu_status_s = Simulink.Bus()
  timestamp: uint64  % # time since system start (microseconds)
  accel_device_id: uint32  % # unique device ID for the sensor that does not change between power cycles
  gyro_device_id: uint32  % # unique device ID for the sensor that does not change between power cycles
  accel_clipping: uint32[3]  % # total clipping per axis
  gyro_clipping: uint32[3]  % # total clipping per axis
  accel_error_count: uint32
  gyro_error_count: uint32
  accel_rate_hz: single
  gyro_rate_hz: single
  accel_raw_rate_hz: single  % # full raw sensor sample rate (Hz)
  gyro_raw_rate_hz: single  % # full raw sensor sample rate (Hz)
  accel_vibration_metric: single  % # high frequency vibration level in the accelerometer data (m/s/s)
  gyro_vibration_metric: single  % # high frequency vibration level in the gyro data (rad/s)
  delta_angle_coning_metric: single  % # average IMU delta angle coning correction (rad^2)
  mean_accel: single[3]  % # average accelerometer readings since last publication
  mean_gyro: single[3]  % # average gyroscope readings since last publication
  var_accel: single[3]  % # accelerometer variance since last publication
  var_gyro: single[3]  % # gyroscope variance since last publication
  temperature_accel: single
  temperature_gyro: single

vehicle_land_detected_s = Simulink.Bus()
  timestamp: uint64  % # time since system start (microseconds)
  freefall: logical  % # true if vehicle is currently in free-fall
  ground_contact: logical  % # true if vehicle has ground contact but is not landed (1. stage)
  maybe_landed: logical  % # true if the vehicle might have landed (2. stage)
  landed: logical  % # true if vehicle is currently landed on the ground (3. stage)
  in_ground_effect: logical  % # indicates if from the perspective of the landing detector the vehicle might be in ground effect (baro). This flag will become true if the vehicle is not moving horizontally and is descending (crude assumption that user is landing).
  in_descend: logical
  has_low_throttle: logical
  vertical_movement: logical
  horizontal_movement: logical
  rotational_movement: logical
  close_to_ground_or_skipped_check: logical
  at_rest: logical

estimator_local_position_s = Simulink.Bus()
  timestamp: uint64  % # time since system start (microseconds)
  timestamp_sample: uint64  % # the timestamp of the raw data (microseconds)
  xy_valid: logical  % # true if x and y are valid
  z_valid: logical  % # true if z is valid
  v_xy_valid: logical  % # true if vx and vy are valid
  v_z_valid: logical  % # true if vz is valid
  x: single  % # North position in NED earth-fixed frame, (metres)
  y: single  % # East position in NED earth-fixed frame, (metres)
  z: single  % # Down position (negative altitude) in NED earth-fixed frame, (metres)
  delta_xy: single[2]
  xy_reset_counter: uint8
  delta_z: single
  z_reset_counter: uint8
  vx: single  % # North velocity in NED earth-fixed frame, (metres/sec)
  vy: single  % # East velocity in NED earth-fixed frame, (metres/sec)
  vz: single  % # Down velocity in NED earth-fixed frame, (metres/sec)
  z_deriv: single  % # Down position time derivative in NED earth-fixed frame, (metres/sec)
  delta_vxy: single[2]
  vxy_reset_counter: uint8
  delta_vz: single
  vz_reset_counter: uint8
  ax: single  % # North velocity derivative in NED earth-fixed frame, (metres/sec^2)
  ay: single  % # East velocity derivative in NED earth-fixed frame, (metres/sec^2)
  az: single  % # Down velocity derivative in NED earth-fixed frame, (metres/sec^2)
  heading: single  % # Euler yaw angle transforming the tangent plane relative to NED earth-fixed frame, -PI..+PI,  (radians)
  delta_heading: single
  heading_reset_counter: uint8
  heading_good_for_control: logical
  xy_global: logical  % # true if position (x, y) has a valid global reference (ref_lat, ref_lon)
  z_global: logical  % # true if z has a valid global reference (ref_alt)
  ref_timestamp: uint64  % # Time when reference position was set since system start, (microseconds)
  ref_lat: double  % # Reference point latitude, (degrees)
  ref_lon: double  % # Reference point longitude, (degrees)
  ref_alt: single  % # Reference altitude AMSL, (metres)
  dist_bottom: single  % # Distance from from bottom surface to ground, (metres)
  dist_bottom_valid: logical  % # true if distance to bottom surface is valid
  dist_bottom_sensor_bitfield: uint8  % # bitfield indicating what type of sensor is used to estimate dist_bottom
  eph: single  % # Standard deviation of horizontal position error, (metres)
  epv: single  % # Standard deviation of vertical position error, (metres)
  evh: single  % # Standard deviation of horizontal velocity error, (metres/sec)
  evv: single  % # Standard deviation of vertical velocity error, (metres/sec)
  dead_reckoning: logical  % # True if this position is estimated through dead-reckoning
  vxy_max: single  % # maximum horizontal speed - set to 0 when limiting not required (meters/sec)
  vz_max: single  % # maximum vertical speed - set to 0 when limiting not required (meters/sec)
  hagl_min: single  % # minimum height above ground level - set to 0 when limiting not required (meters)
  hagl_max: single  % # maximum height above ground level - set to 0 when limiting not required (meters)

vehicle_local_position_setpoint_s = Simulink.Bus()
  timestamp: uint64  % # time since system start (microseconds)
  x: single  % # in meters NED
  y: single  % # in meters NED
  z: single  % # in meters NED
  vx: single  % # in meters/sec
  vy: single  % # in meters/sec
  vz: single  % # in meters/sec
  acceleration: single[3]  % # in meters/sec^2
  thrust: single[3]  % # normalized thrust vector in NED
  yaw: single  % # in radians NED -PI..+PI
  yawspeed: single  % # in radians/sec

vehicle_magnetometer_s = Simulink.Bus()
  timestamp: uint64  % # time since system start (microseconds)
  timestamp_sample: uint64  % # the timestamp of the raw data (microseconds)
  device_id: uint32  % # unique device ID for the selected magnetometer
  magnetometer_ga: single[3]  % # Magnetic field in the FRD body frame XYZ-axis in Gauss
  calibration_count: uint8  % # Calibration changed counter. Monotonically increases whenever calibration changes.

estimator_odometry_s = Simulink.Bus()
  timestamp: uint64  % # time since system start (microseconds)
  timestamp_sample: uint64
  pose_frame: uint8  % # Position and orientation frame of reference
  position: single[3]  % # Position in meters. Frame of reference defined by local_frame. NaN if invalid/unknown
  q: single[4]  % # Quaternion rotation from FRD body frame to reference frame. First value NaN if invalid/unknown
  velocity_frame: uint8  % # Reference frame of the velocity data
  velocity: single[3]  % # Velocity in meters/sec. Frame of reference defined by velocity_frame variable. NaN if invalid/unknown
  angular_velocity: single[3]  % # Angular velocity in body-fixed frame (rad/s). NaN if invalid/unknown
  position_variance: single[3]
  orientation_variance: single[3]
  velocity_variance: single[3]
  reset_counter: uint8
  quality: int8

vehicle_optical_flow_s = Simulink.Bus()
  timestamp: uint64  % # time since system start (microseconds)
  timestamp_sample: uint64
  device_id: uint32  % # unique device ID for the sensor that does not change between power cycles
  pixel_flow: single[2]  % # (radians) accumulated optical flow in radians where a positive value is produced by a RH rotation about the body axis
  delta_angle: single[3]  % # (radians) accumulated gyro radians where a positive value is produced by a RH rotation about the body axis. (NAN if unavailable)
  distance_m: single  % # (meters) Distance to the center of the flow field (NAN if unavailable)
  integration_timespan_us: uint32  % # (microseconds) accumulation timespan in microseconds
  quality: uint8  % # Average of quality of accumulated frames, 0: bad quality, 255: maximum quality
  max_flow_rate: single  % # (radians/s) Magnitude of maximum angular which the optical flow sensor can measure reliably
  min_ground_distance: single  % # (meters) Minimum distance from ground at which the optical flow sensor operates reliably
  max_ground_distance: single  % # (meters) Maximum distance from ground at which the optical flow sensor operates reliably

estimator_optical_flow_vel_s = Simulink.Bus()
  timestamp: uint64  % # time since system start (microseconds)
  timestamp_sample: uint64  % # the timestamp of the raw data (microseconds)
  vel_body: single[2]  % # velocity obtained from gyro-compensated and distance-scaled optical flow raw measurements in body frame(m/s)
  vel_ne: single[2]  % # same as vel_body but in local frame (m/s)
  flow_uncompensated_integral: single[2]  % # integrated optical flow measurement (rad)
  flow_compensated_integral: single[2]  % # integrated optical flow measurement compensated for angular motion (rad)
  gyro_rate: single[3]  % # gyro measurement synchronized with flow measurements (rad/s)
  gyro_rate_integral: single[3]  % # gyro measurement integrated to flow rate and synchronized with flow measurements (rad)

vehicle_optical_flow_vel_s = Simulink.Bus()
  timestamp: uint64  % # time since system start (microseconds)
  timestamp_sample: uint64  % # the timestamp of the raw data (microseconds)
  vel_body: single[2]  % # velocity obtained from gyro-compensated and distance-scaled optical flow raw measurements in body frame(m/s)
  vel_ne: single[2]  % # same as vel_body but in local frame (m/s)
  flow_uncompensated_integral: single[2]  % # integrated optical flow measurement (rad)
  flow_compensated_integral: single[2]  % # integrated optical flow measurement compensated for angular motion (rad)
  gyro_rate: single[3]  % # gyro measurement synchronized with flow measurements (rad/s)
  gyro_rate_integral: single[3]  % # gyro measurement integrated to flow rate and synchronized with flow measurements (rad)

vehicle_rates_setpoint_s = Simulink.Bus()
  timestamp: uint64  % # time since system start (microseconds)
  roll: single  % # [rad/s] roll rate setpoint
  pitch: single  % # [rad/s] pitch rate setpoint
  yaw: single  % # [rad/s] yaw rate setpoint
  thrust_body: single[3]  % # Normalized thrust command in body NED frame [-1,1]
  reset_integral: logical  % # Reset roll/pitch/yaw integrals (navigation logic change)

vehicle_roi_s = Simulink.Bus()
  timestamp: uint64  % # time since system start (microseconds)
  mode: uint8  % # ROI mode (see above)
  lat: double  % # Latitude to point to
  lon: double  % # Longitude to point to
  alt: single  % # Altitude to point to
  roll_offset: single  % # angle offset in rad
  pitch_offset: single  % # angle offset in rad
  yaw_offset: single  % # angle offset in rad

vehicle_status_s = Simulink.Bus()
  timestamp: uint64  % # time since system start (microseconds)
  armed_time: uint64  % # Arming timestamp (microseconds)
  takeoff_time: uint64  % # Takeoff timestamp (microseconds)
  arming_state: uint8
  latest_arming_reason: uint8
  latest_disarming_reason: uint8
  nav_state_timestamp: uint64  % # time when current nav_state activated
  nav_state_user_intention: uint8  % # Mode that the user selected (might be different from nav_state in a failsafe situation)
  nav_state: uint8  % # Currently active mode
  failure_detector_status: uint16
  hil_state: uint8
  vehicle_type: uint8
  failsafe: logical  % # true if system is in failsafe state (e.g.:RTL, Hover, Terminate, ...)
  failsafe_and_user_took_over: logical  % # true if system is in failsafe state but the user took over control
  gcs_connection_lost: logical  % # datalink to GCS lost
  gcs_connection_lost_counter: uint8  % # counts unique GCS connection lost events
  high_latency_data_link_lost: logical  % # Set to true if the high latency data link (eg. RockBlock Iridium 9603 telemetry module) is lost
  is_vtol: logical  % # True if the system is VTOL capable
  is_vtol_tailsitter: logical  % # True if the system performs a 90° pitch down rotation during transition from MC to FW
  in_transition_mode: logical  % # True if VTOL is doing a transition
  in_transition_to_fw: logical  % # True if VTOL is doing a transition from MC to FW
  system_type: uint8  % # system type, contains mavlink MAV_TYPE
  system_id: uint8  % # system id, contains MAVLink's system ID field
  component_id: uint8  % # subsystem / component id, contains MAVLink's component ID field
  safety_button_available: logical  % # Set to true if a safety button is connected
  safety_off: logical  % # Set to true if safety is off
  power_input_valid: logical  % # set if input power is valid
  usb_connected: logical  % # set to true (never cleared) once telemetry received from usb link
  open_drone_id_system_present: logical
  open_drone_id_system_healthy: logical
  parachute_system_present: logical
  parachute_system_healthy: logical
  avoidance_system_required: logical  % # Set to true if avoidance system is enabled via COM_OBS_AVOID parameter
  avoidance_system_valid: logical  % # Status of the obstacle avoidance system
  rc_calibration_in_progress: logical
  calibration_enabled: logical
  pre_flight_checks_pass: logical  % # true if all checks necessary to arm pass

vehicle_thrust_setpoint_virtual_fw_s = Simulink.Bus()
  timestamp: uint64  % # time since system start (microseconds)
  timestamp_sample: uint64  % # timestamp of the data sample on which this message is based (microseconds)
  xyz: single[3]  % # thrust setpoint along X, Y, Z body axis [-1, 1]

vehicle_thrust_setpoint_virtual_mc_s = Simulink.Bus()
  timestamp: uint64  % # time since system start (microseconds)
  timestamp_sample: uint64  % # timestamp of the data sample on which this message is based (microseconds)
  xyz: single[3]  % # thrust setpoint along X, Y, Z body axis [-1, 1]

vehicle_torque_setpoint_virtual_fw_s = Simulink.Bus()
  timestamp: uint64  % # time since system start (microseconds)
  timestamp_sample: uint64  % # timestamp of the data sample on which this message is based (microseconds)
  xyz: single[3]  % # torque setpoint about X, Y, Z body axis (normalized)

vehicle_torque_setpoint_virtual_mc_s = Simulink.Bus()
  timestamp: uint64  % # time since system start (microseconds)
  timestamp_sample: uint64  % # timestamp of the data sample on which this message is based (microseconds)
  xyz: single[3]  % # torque setpoint about X, Y, Z body axis (normalized)

vehicle_trajectory_bezier_s = Simulink.Bus()
  timestamp: uint64  % # time since system start (microseconds)
  control_points: trajectorybezier[5]
  bezier_order: uint8

vehicle_trajectory_waypoint_s = Simulink.Bus()
  timestamp: uint64  % # time since system start (microseconds)
  type: uint8  % # Type from MAV_TRAJECTORY_REPRESENTATION enum.
  waypoints: trajectorywaypoint[5]

vehicle_trajectory_waypoint_desired_s = Simulink.Bus()
  timestamp: uint64  % # time since system start (microseconds)
  type: uint8  % # Type from MAV_TRAJECTORY_REPRESENTATION enum.
  waypoints: trajectorywaypoint[5]

vtol_vehicle_status_s = Simulink.Bus()
  timestamp: uint64  % # time since system start (microseconds)
  vehicle_vtol_state: uint8  % # current state of the vtol, see VEHICLE_VTOL_STATE
  fixed_wing_system_failure: logical  % # vehicle in fixed-wing system failure failsafe mode (after quad-chute)

wind_s = Simulink.Bus()
  timestamp: uint64  % # time since system start (microseconds)
  timestamp_sample: uint64  % # the timestamp of the raw data (microseconds)
  windspeed_north: single  % # Wind component in north / X direction (m/sec)
  windspeed_east: single  % # Wind component in east / Y direction (m/sec)
  variance_north: single  % # Wind estimate error variance in north / X direction (m/sec)**2 - set to zero (no uncertainty) if not estimated
  variance_east: single  % # Wind estimate error variance in east / Y direction (m/sec)**2 - set to zero (no uncertainty) if not estimated
  tas_innov: single  % # True airspeed innovation
  tas_innov_var: single  % # True airspeed innovation variance
  beta_innov: single  % # Sideslip measurement innovation
  beta_innov_var: single  % # Sideslip measurement innovation variance

estimator_wind_s = Simulink.Bus()
  timestamp: uint64  % # time since system start (microseconds)
  timestamp_sample: uint64  % # the timestamp of the raw data (microseconds)
  windspeed_north: single  % # Wind component in north / X direction (m/sec)
  windspeed_east: single  % # Wind component in east / Y direction (m/sec)
  variance_north: single  % # Wind estimate error variance in north / X direction (m/sec)**2 - set to zero (no uncertainty) if not estimated
  variance_east: single  % # Wind estimate error variance in east / Y direction (m/sec)**2 - set to zero (no uncertainty) if not estimated
  tas_innov: single  % # True airspeed innovation
  tas_innov_var: single  % # True airspeed innovation variance
  beta_innov: single  % # Sideslip measurement innovation
  beta_innov_var: single  % # Sideslip measurement innovation variance

yaw_estimator_status_s = Simulink.Bus()
  timestamp: uint64  % # time since system start (microseconds)
  timestamp_sample: uint64  % # the timestamp of the raw data (microseconds)
  yaw_composite: single  % # composite yaw from GSF (rad)
  yaw_variance: single  % # composite yaw variance from GSF (rad^2)
  yaw_composite_valid: logical
  yaw: single[5]  % # yaw estimate for each model in the filter bank (rad)
  innov_vn: single[5]  % # North velocity innovation for each model in the filter bank (m/s)
  innov_ve: single[5]  % # East velocity innovation for each model in the filter bank (m/s)
  weight: single[5]  % # weighting for each model in the filter bank

ACTION_DISARM = Simulink.Parameter(0, StorageClass="Const", DataType="uint8")
ACTION_ARM = Simulink.Parameter(1, StorageClass="Const", DataType="uint8")
ACTION_TOGGLE_ARMING = Simulink.Parameter(2, StorageClass="Const", DataType="uint8")
ACTION_UNKILL = Simulink.Parameter(3, StorageClass="Const", DataType="uint8")
ACTION_KILL = Simulink.Parameter(4, StorageClass="Const", DataType="uint8")
ACTION_SWITCH_MODE = Simulink.Parameter(5, StorageClass="Const", DataType="uint8")
ACTION_VTOL_TRANSITION_TO_MULTICOPTER = Simulink.Parameter(6, StorageClass="Const", DataType="uint8")
ACTION_VTOL_TRANSITION_TO_FIXEDWING = Simulink.Parameter(7, StorageClass="Const", DataType="uint8")
SOURCE_RC_STICK_GESTURE = Simulink.Parameter(0, StorageClass="Const", DataType="uint8")
SOURCE_RC_SWITCH = Simulink.Parameter(1, StorageClass="Const", DataType="uint8")
SOURCE_RC_BUTTON = Simulink.Parameter(2, StorageClass="Const", DataType="uint8")
SOURCE_RC_MODE_SLOT = Simulink.Parameter(3, StorageClass="Const", DataType="uint8")

ACTION_REQUEST = enum(AddClassNameToEnumNames=true)
  ACTION_DISARM = 0
  ACTION_ARM = 1
  ACTION_TOGGLE_ARMING = 2
  ACTION_UNKILL = 3
  ACTION_KILL = 4
  ACTION_SWITCH_MODE = 5
  ACTION_VTOL_TRANSITION_TO_MULTICOPTER = 6
  ACTION_VTOL_TRANSITION_TO_FIXEDWING = 7
  SOURCE_RC_STICK_GESTURE = 0
  SOURCE_RC_SWITCH = 1
  SOURCE_RC_BUTTON = 2
  SOURCE_RC_MODE_SLOT = 3

ACTUATOR_FUNCTION_MOTOR1 = Simulink.Parameter(101, StorageClass="Const", DataType="uint8")
NUM_CONTROLS = Simulink.Parameter(8, StorageClass="Const", DataType="uint8")

ACTUATOR_MOTORS = enum(AddClassNameToEnumNames=true)
  ACTUATOR_FUNCTION_MOTOR1 = 101
  NUM_CONTROLS = 12

NUM_ACTUATOR_OUTPUTS = Simulink.Parameter(16, StorageClass="Const", DataType="uint8")
NUM_ACTUATOR_OUTPUT_GROUPS = Simulink.Parameter(4, StorageClass="Const", DataType="uint8")  % # for sanity checking

ACTUATOR_OUTPUTS = enum(AddClassNameToEnumNames=true)
  NUM_ACTUATOR_OUTPUTS = 16
  NUM_ACTUATOR_OUTPUT_GROUPS = 4  % # for sanity checking

ACTUATOR_SERVOS = enum(AddClassNameToEnumNames=true)
  NUM_CONTROLS = 8

ACTUATOR_SERVOS_TRIM = enum(AddClassNameToEnumNames=true)
  NUM_CONTROLS = 8

ACTION_RELEASE_CONTROL = Simulink.Parameter(0, StorageClass="Const", DataType="uint8")  % # exit test mode for the given function
ACTION_DO_CONTROL = Simulink.Parameter(1, StorageClass="Const", DataType="uint8")  % # enable actuator test mode
FUNCTION_MOTOR1 = Simulink.Parameter(101, StorageClass="Const", DataType="uint8")
MAX_NUM_MOTORS = Simulink.Parameter(12, StorageClass="Const", DataType="uint8")
FUNCTION_SERVO1 = Simulink.Parameter(201, StorageClass="Const", DataType="uint8")
MAX_NUM_SERVOS = Simulink.Parameter(8, StorageClass="Const", DataType="uint8")
ORB_QUEUE_LENGTH = Simulink.Parameter(4, StorageClass="Const", DataType="uint8")

ACTUATOR_TEST = enum(AddClassNameToEnumNames=true)
  ACTION_RELEASE_CONTROL = 0  % # exit test mode for the given function
  ACTION_DO_CONTROL = 1  % # enable actuator test mode
  FUNCTION_MOTOR1 = 101
  MAX_NUM_MOTORS = 12
  FUNCTION_SERVO1 = 201
  MAX_NUM_SERVOS = 8
  ORB_QUEUE_LENGTH = 12  % # same as MAX_NUM_MOTORS to support code in esc_calibration

SOURCE_AS_BETA_ONLY = Simulink.Parameter(0, StorageClass="Const", DataType="uint8")  % # wind estimate only based on synthetic sideslip fusion
SOURCE_AS_SENSOR_1 = Simulink.Parameter(1, StorageClass="Const", DataType="uint8")  % # combined synthetic sideslip and airspeed fusion (data from first airspeed sensor)
SOURCE_AS_SENSOR_2 = Simulink.Parameter(2, StorageClass="Const", DataType="uint8")  % # combined synthetic sideslip and airspeed fusion (data from second airspeed sensor)
SOURCE_AS_SENSOR_3 = Simulink.Parameter(3, StorageClass="Const", DataType="uint8")  % # combined synthetic sideslip and airspeed fusion (data from third airspeed sensor)

AIRSPEED_WIND = enum(AddClassNameToEnumNames=true)
  SOURCE_AS_BETA_ONLY = 0  % # wind estimate only based on synthetic sideslip fusion
  SOURCE_AS_SENSOR_1 = 1  % # combined synthetic sideslip and airspeed fusion (data from first airspeed sensor)
  SOURCE_AS_SENSOR_2 = 2  % # combined synthetic sideslip and airspeed fusion (data from second airspeed sensor)
  SOURCE_AS_SENSOR_3 = 3  % # combined synthetic sideslip and airspeed fusion (data from third airspeed sensor)

STATE_IDLE = Simulink.Parameter(0, StorageClass="Const", DataType="uint8")
STATE_INIT = Simulink.Parameter(1, StorageClass="Const", DataType="uint8")
STATE_ROLL = Simulink.Parameter(2, StorageClass="Const", DataType="uint8")
STATE_ROLL_PAUSE = Simulink.Parameter(3, StorageClass="Const", DataType="uint8")
STATE_PITCH = Simulink.Parameter(4, StorageClass="Const", DataType="uint8")
STATE_PITCH_PAUSE = Simulink.Parameter(5, StorageClass="Const", DataType="uint8")
STATE_YAW = Simulink.Parameter(6, StorageClass="Const", DataType="uint8")
STATE_YAW_PAUSE = Simulink.Parameter(7, StorageClass="Const", DataType="uint8")
STATE_VERIFICATION = Simulink.Parameter(8, StorageClass="Const", DataType="uint8")
STATE_APPLY = Simulink.Parameter(9, StorageClass="Const", DataType="uint8")
STATE_TEST = Simulink.Parameter(10, StorageClass="Const", DataType="uint8")
STATE_COMPLETE = Simulink.Parameter(11, StorageClass="Const", DataType="uint8")
STATE_FAIL = Simulink.Parameter(12, StorageClass="Const", DataType="uint8")
STATE_WAIT_FOR_DISARM = Simulink.Parameter(13, StorageClass="Const", DataType="uint8")

AUTOTUNE_ATTITUDE_CONTROL_STATUS = enum(AddClassNameToEnumNames=true)
  STATE_IDLE = 0
  STATE_INIT = 1
  STATE_ROLL = 2
  STATE_ROLL_PAUSE = 3
  STATE_PITCH = 4
  STATE_PITCH_PAUSE = 5
  STATE_YAW = 6
  STATE_YAW_PAUSE = 7
  STATE_VERIFICATION = 8
  STATE_APPLY = 9
  STATE_TEST = 10
  STATE_COMPLETE = 11
  STATE_FAIL = 12
  STATE_WAIT_FOR_DISARM = 13

BATTERY_SOURCE_POWER_MODULE = Simulink.Parameter(0, StorageClass="Const", DataType="uint8")
BATTERY_SOURCE_EXTERNAL = Simulink.Parameter(1, StorageClass="Const", DataType="uint8")
BATTERY_SOURCE_ESCS = Simulink.Parameter(2, StorageClass="Const", DataType="uint8")
BATTERY_WARNING_NONE = Simulink.Parameter(0, StorageClass="Const", DataType="uint8")  % # no battery low voltage warning active
BATTERY_WARNING_LOW = Simulink.Parameter(1, StorageClass="Const", DataType="uint8")  % # warning of low voltage
BATTERY_WARNING_CRITICAL = Simulink.Parameter(2, StorageClass="Const", DataType="uint8")  % # critical voltage, return / abort immediately
BATTERY_WARNING_EMERGENCY = Simulink.Parameter(3, StorageClass="Const", DataType="uint8")  % # immediate landing required
BATTERY_WARNING_FAILED = Simulink.Parameter(4, StorageClass="Const", DataType="uint8")  % # the battery has failed completely
BATTERY_STATE_UNHEALTHY = Simulink.Parameter(6, StorageClass="Const", DataType="uint8")  % # Battery is diagnosed to be defective or an error occurred, usage is discouraged / prohibited. Possible causes (faults) are listed in faults field.
BATTERY_STATE_CHARGING = Simulink.Parameter(7, StorageClass="Const", DataType="uint8")  % # Battery is charging
BATTERY_FAULT_DEEP_DISCHARGE = Simulink.Parameter(0, StorageClass="Const", DataType="uint8")  % # Battery has deep discharged
BATTERY_FAULT_SPIKES = Simulink.Parameter(1, StorageClass="Const", DataType="uint8")  % # Voltage spikes
BATTERY_FAULT_CELL_FAIL = Simulink.Parameter(2, StorageClass="Const", DataType="uint8")  % # One or more cells have failed
BATTERY_FAULT_OVER_CURRENT = Simulink.Parameter(3, StorageClass="Const", DataType="uint8")  % # Over-current
BATTERY_FAULT_OVER_TEMPERATURE = Simulink.Parameter(4, StorageClass="Const", DataType="uint8")  % # Over-temperature
BATTERY_FAULT_UNDER_TEMPERATURE = Simulink.Parameter(5, StorageClass="Const", DataType="uint8")  % # Under-temperature fault
BATTERY_FAULT_INCOMPATIBLE_VOLTAGE = Simulink.Parameter(6, StorageClass="Const", DataType="uint8")  % # Vehicle voltage is not compatible with battery one
BATTERY_FAULT_INCOMPATIBLE_FIRMWARE = Simulink.Parameter(7, StorageClass="Const", DataType="uint8")  % # Battery firmware is not compatible with current autopilot firmware
BATTERY_FAULT_INCOMPATIBLE_MODEL = Simulink.Parameter(8, StorageClass="Const", DataType="uint8")  % # Battery model is not supported by the system
BATTERY_FAULT_HARDWARE_FAILURE = Simulink.Parameter(9, StorageClass="Const", DataType="uint8")  % # hardware problem
BATTERY_WARNING_OVER_TEMPERATURE = Simulink.Parameter(10, StorageClass="Const", DataType="uint8")  % # Over-temperature
BATTERY_FAULT_COUNT = Simulink.Parameter(11, StorageClass="Const", DataType="uint8")  % # Counter - keep it as last element!
BATTERY_MODE_UNKNOWN = Simulink.Parameter(0, StorageClass="Const", DataType="uint8")  % # Battery does not support a mode, or if it does, is operational
BATTERY_MODE_AUTO_DISCHARGING = Simulink.Parameter(1, StorageClass="Const", DataType="uint8")  % # Battery is auto discharging (towards storage level)
BATTERY_MODE_HOT_SWAP = Simulink.Parameter(2, StorageClass="Const", DataType="uint8")  % # Battery in hot-swap mode
BATTERY_MODE_COUNT = Simulink.Parameter(3, StorageClass="Const", DataType="uint8")  % # Counter - keep it as last element (once we're fully migrated to events interface we can just comment this)!
MAX_INSTANCES = Simulink.Parameter(2, StorageClass="Const", DataType="uint8")

BATTERY_STATUS = enum(AddClassNameToEnumNames=true)
  BATTERY_SOURCE_POWER_MODULE = 0
  BATTERY_SOURCE_EXTERNAL = 1
  BATTERY_SOURCE_ESCS = 2
  BATTERY_WARNING_NONE = 0  % # no battery low voltage warning active
  BATTERY_WARNING_LOW = 1  % # warning of low voltage
  BATTERY_WARNING_CRITICAL = 2  % # critical voltage, return / abort immediately
  BATTERY_WARNING_EMERGENCY = 3  % # immediate landing required
  BATTERY_WARNING_FAILED = 4  % # the battery has failed completely
  BATTERY_STATE_UNHEALTHY = 6  % # Battery is diagnosed to be defective or an error occurred, usage is discouraged / prohibited. Possible causes (faults) are listed in faults field.
  BATTERY_STATE_CHARGING = 7  % # Battery is charging
  BATTERY_FAULT_DEEP_DISCHARGE = 0  % # Battery has deep discharged
  BATTERY_FAULT_SPIKES = 1  % # Voltage spikes
  BATTERY_FAULT_CELL_FAIL = 2  % # One or more cells have failed
  BATTERY_FAULT_OVER_CURRENT = 3  % # Over-current
  BATTERY_FAULT_OVER_TEMPERATURE = 4  % # Over-temperature
  BATTERY_FAULT_UNDER_TEMPERATURE = 5  % # Under-temperature fault
  BATTERY_FAULT_INCOMPATIBLE_VOLTAGE = 6  % # Vehicle voltage is not compatible with battery one
  BATTERY_FAULT_INCOMPATIBLE_FIRMWARE = 7  % # Battery firmware is not compatible with current autopilot firmware
  BATTERY_FAULT_INCOMPATIBLE_MODEL = 8  % # Battery model is not supported by the system
  BATTERY_FAULT_HARDWARE_FAILURE = 9  % # hardware problem
  BATTERY_WARNING_OVER_TEMPERATURE = 10  % # Over-temperature
  BATTERY_FAULT_COUNT = 11  % # Counter - keep it as last element!
  BATTERY_MODE_UNKNOWN = 0  % # Battery does not support a mode, or if it does, is operational
  BATTERY_MODE_AUTO_DISCHARGING = 1  % # Battery is auto discharging (towards storage level)
  BATTERY_MODE_HOT_SWAP = 2  % # Battery in hot-swap mode
  BATTERY_MODE_COUNT = 3  % # Counter - keep it as last element (once we're fully migrated to events interface we can just comment this)!
  MAX_INSTANCES = 4

BUTTON_EVENT = enum(AddClassNameToEnumNames=true)
  ORB_QUEUE_LENGTH = 2

CAMERA_TRIGGER = enum(AddClassNameToEnumNames=true)
  ORB_QUEUE_LENGTH = 2

CELLULAR_STATUS_FLAG_UNKNOWN = Simulink.Parameter(0, StorageClass="Const", DataType="uint8")  % # State unknown or not reportable
CELLULAR_STATUS_FLAG_FAILED = Simulink.Parameter(1, StorageClass="Const", DataType="uint8")  % # velocity setpoint
CELLULAR_STATUS_FLAG_INITIALIZING = Simulink.Parameter(2, StorageClass="Const", DataType="uint8")  % # Modem is being initialized
CELLULAR_STATUS_FLAG_LOCKED = Simulink.Parameter(3, StorageClass="Const", DataType="uint8")  % # Modem is locked
CELLULAR_STATUS_FLAG_DISABLED = Simulink.Parameter(4, StorageClass="Const", DataType="uint8")  % # Modem is not enabled and is powered down
CELLULAR_STATUS_FLAG_DISABLING = Simulink.Parameter(5, StorageClass="Const", DataType="uint8")  % # Modem is currently transitioning to the CELLULAR_STATUS_FLAG_DISABLED state
CELLULAR_STATUS_FLAG_ENABLING = Simulink.Parameter(6, StorageClass="Const", DataType="uint8")  % # Modem is currently transitioning to the CELLULAR_STATUS_FLAG_ENABLED state
CELLULAR_STATUS_FLAG_ENABLED = Simulink.Parameter(7, StorageClass="Const", DataType="uint8")  % # Modem is enabled and powered on but not registered with a network provider and not available for data connections
CELLULAR_STATUS_FLAG_SEARCHING = Simulink.Parameter(8, StorageClass="Const", DataType="uint8")  % # Modem is searching for a network provider to register
CELLULAR_STATUS_FLAG_REGISTERED = Simulink.Parameter(9, StorageClass="Const", DataType="uint8")  % # Modem is registered with a network provider, and data connections and messaging may be available for use
CELLULAR_STATUS_FLAG_DISCONNECTING = Simulink.Parameter(10, StorageClass="Const", DataType="uint8")  % # Modem is disconnecting and deactivating the last active packet data bearer. This state will not be entered if more than one packet data bearer is active and one of the active bearers is deactivated
CELLULAR_STATUS_FLAG_CONNECTING = Simulink.Parameter(11, StorageClass="Const", DataType="uint8")  % # Modem is activating and connecting the first packet data bearer. Subsequent bearer activations when another bearer is already active do not cause this state to be entered
CELLULAR_STATUS_FLAG_CONNECTED = Simulink.Parameter(12, StorageClass="Const", DataType="uint8")  % # One or more packet data bearers is active and connected
CELLULAR_NETWORK_FAILED_REASON_NONE = Simulink.Parameter(0, StorageClass="Const", DataType="uint8")  % # No error
CELLULAR_NETWORK_FAILED_REASON_UNKNOWN = Simulink.Parameter(1, StorageClass="Const", DataType="uint8")  % # Error state is unknown
CELLULAR_NETWORK_FAILED_REASON_SIM_MISSING = Simulink.Parameter(2, StorageClass="Const", DataType="uint8")  % # SIM is required for the modem but missing
CELLULAR_NETWORK_FAILED_REASON_SIM_ERROR = Simulink.Parameter(3, StorageClass="Const", DataType="uint8")  % # SIM is available, but not usable for connection

CELLULAR_STATUS = enum(AddClassNameToEnumNames=true)
  CELLULAR_STATUS_FLAG_UNKNOWN = 0  % # State unknown or not reportable
  CELLULAR_STATUS_FLAG_FAILED = 1  % # velocity setpoint
  CELLULAR_STATUS_FLAG_INITIALIZING = 2  % # Modem is being initialized
  CELLULAR_STATUS_FLAG_LOCKED = 3  % # Modem is locked
  CELLULAR_STATUS_FLAG_DISABLED = 4  % # Modem is not enabled and is powered down
  CELLULAR_STATUS_FLAG_DISABLING = 5  % # Modem is currently transitioning to the CELLULAR_STATUS_FLAG_DISABLED state
  CELLULAR_STATUS_FLAG_ENABLING = 6  % # Modem is currently transitioning to the CELLULAR_STATUS_FLAG_ENABLED state
  CELLULAR_STATUS_FLAG_ENABLED = 7  % # Modem is enabled and powered on but not registered with a network provider and not available for data connections
  CELLULAR_STATUS_FLAG_SEARCHING = 8  % # Modem is searching for a network provider to register
  CELLULAR_STATUS_FLAG_REGISTERED = 9  % # Modem is registered with a network provider, and data connections and messaging may be available for use
  CELLULAR_STATUS_FLAG_DISCONNECTING = 10  % # Modem is disconnecting and deactivating the last active packet data bearer. This state will not be entered if more than one packet data bearer is active and one of the active bearers is deactivated
  CELLULAR_STATUS_FLAG_CONNECTING = 11  % # Modem is activating and connecting the first packet data bearer. Subsequent bearer activations when another bearer is already active do not cause this state to be entered
  CELLULAR_STATUS_FLAG_CONNECTED = 12  % # One or more packet data bearers is active and connected
  CELLULAR_NETWORK_FAILED_REASON_NONE = 0  % # No error
  CELLULAR_NETWORK_FAILED_REASON_UNKNOWN = 1  % # Error state is unknown
  CELLULAR_NETWORK_FAILED_REASON_SIM_MISSING = 2  % # SIM is required for the modem but missing
  CELLULAR_NETWORK_FAILED_REASON_SIM_ERROR = 3  % # SIM is available, but not usable for connection

ACTUATOR_SATURATION_OK = Simulink.Parameter(0, StorageClass="Const", DataType="int8")  % # The actuator is not saturated
ACTUATOR_SATURATION_UPPER_DYN = Simulink.Parameter(1, StorageClass="Const", DataType="int8")  % # The actuator is saturated (with a value <= the desired value) because it cannot increase its value faster
ACTUATOR_SATURATION_UPPER = Simulink.Parameter(2, StorageClass="Const", DataType="int8")  % # The actuator is saturated (with a value <= the desired value) because it has reached its maximum value
ACTUATOR_SATURATION_LOWER_DYN = Simulink.Parameter(-1, StorageClass="Const", DataType="int8")  % # The actuator is saturated (with a value >= the desired value) because it cannot decrease its value faster
ACTUATOR_SATURATION_LOWER = Simulink.Parameter(-2, StorageClass="Const", DataType="int8")  % # The actuator is saturated (with a value >= the desired value) because it has reached its minimum value

CONTROL_ALLOCATOR_STATUS = enum(AddClassNameToEnumNames=true)
  ACTUATOR_SATURATION_OK = 0  % # The actuator is not saturated
  ACTUATOR_SATURATION_UPPER_DYN = 1  % # The actuator is saturated (with a value <= the desired value) because it cannot increase its value faster
  ACTUATOR_SATURATION_UPPER = 2  % # The actuator is saturated (with a value <= the desired value) because it has reached its maximum value
  ACTUATOR_SATURATION_LOWER_DYN = -1  % # The actuator is saturated (with a value >= the desired value) because it cannot decrease its value faster
  ACTUATOR_SATURATION_LOWER = -2  % # The actuator is saturated (with a value >= the desired value) because it has reached its minimum value

ARRAY_SIZE = Simulink.Parameter(58, StorageClass="Const", DataType="uint8")

DEBUG_ARRAY = enum(AddClassNameToEnumNames=true)
  ARRAY_SIZE = 58

MAV_DISTANCE_SENSOR_LASER = Simulink.Parameter(0, StorageClass="Const", DataType="uint8")
MAV_DISTANCE_SENSOR_ULTRASOUND = Simulink.Parameter(1, StorageClass="Const", DataType="uint8")
MAV_DISTANCE_SENSOR_INFRARED = Simulink.Parameter(2, StorageClass="Const", DataType="uint8")
MAV_DISTANCE_SENSOR_RADAR = Simulink.Parameter(3, StorageClass="Const", DataType="uint8")
ROTATION_YAW_0 = Simulink.Parameter(0, StorageClass="Const", DataType="uint8")  % # MAV_SENSOR_ROTATION_NONE
ROTATION_YAW_45 = Simulink.Parameter(1, StorageClass="Const", DataType="uint8")  % # MAV_SENSOR_ROTATION_YAW_45
ROTATION_YAW_90 = Simulink.Parameter(2, StorageClass="Const", DataType="uint8")  % # MAV_SENSOR_ROTATION_YAW_90
ROTATION_YAW_135 = Simulink.Parameter(3, StorageClass="Const", DataType="uint8")  % # MAV_SENSOR_ROTATION_YAW_135
ROTATION_YAW_180 = Simulink.Parameter(4, StorageClass="Const", DataType="uint8")  % # MAV_SENSOR_ROTATION_YAW_180
ROTATION_YAW_225 = Simulink.Parameter(5, StorageClass="Const", DataType="uint8")  % # MAV_SENSOR_ROTATION_YAW_225
ROTATION_YAW_270 = Simulink.Parameter(6, StorageClass="Const", DataType="uint8")  % # MAV_SENSOR_ROTATION_YAW_270
ROTATION_YAW_315 = Simulink.Parameter(7, StorageClass="Const", DataType="uint8")  % # MAV_SENSOR_ROTATION_YAW_315
ROTATION_FORWARD_FACING = Simulink.Parameter(0, StorageClass="Const", DataType="uint8")  % # MAV_SENSOR_ROTATION_NONE
ROTATION_RIGHT_FACING = Simulink.Parameter(2, StorageClass="Const", DataType="uint8")  % # MAV_SENSOR_ROTATION_YAW_90
ROTATION_BACKWARD_FACING = Simulink.Parameter(4, StorageClass="Const", DataType="uint8")  % # MAV_SENSOR_ROTATION_YAW_180
ROTATION_LEFT_FACING = Simulink.Parameter(6, StorageClass="Const", DataType="uint8")  % # MAV_SENSOR_ROTATION_YAW_270
ROTATION_UPWARD_FACING = Simulink.Parameter(24, StorageClass="Const", DataType="uint8")  % # MAV_SENSOR_ROTATION_PITCH_90
ROTATION_DOWNWARD_FACING = Simulink.Parameter(25, StorageClass="Const", DataType="uint8")  % # MAV_SENSOR_ROTATION_PITCH_270
ROTATION_CUSTOM = Simulink.Parameter(100, StorageClass="Const", DataType="uint8")  % # MAV_SENSOR_ROTATION_CUSTOM

DISTANCE_SENSOR = enum(AddClassNameToEnumNames=true)
  MAV_DISTANCE_SENSOR_LASER = 0
  MAV_DISTANCE_SENSOR_ULTRASOUND = 1
  MAV_DISTANCE_SENSOR_INFRARED = 2
  MAV_DISTANCE_SENSOR_RADAR = 3
  ROTATION_YAW_0 = 0  % # MAV_SENSOR_ROTATION_NONE
  ROTATION_YAW_45 = 1  % # MAV_SENSOR_ROTATION_YAW_45
  ROTATION_YAW_90 = 2  % # MAV_SENSOR_ROTATION_YAW_90
  ROTATION_YAW_135 = 3  % # MAV_SENSOR_ROTATION_YAW_135
  ROTATION_YAW_180 = 4  % # MAV_SENSOR_ROTATION_YAW_180
  ROTATION_YAW_225 = 5  % # MAV_SENSOR_ROTATION_YAW_225
  ROTATION_YAW_270 = 6  % # MAV_SENSOR_ROTATION_YAW_270
  ROTATION_YAW_315 = 7  % # MAV_SENSOR_ROTATION_YAW_315
  ROTATION_FORWARD_FACING = 0  % # MAV_SENSOR_ROTATION_NONE
  ROTATION_RIGHT_FACING = 2  % # MAV_SENSOR_ROTATION_YAW_90
  ROTATION_BACKWARD_FACING = 4  % # MAV_SENSOR_ROTATION_YAW_180
  ROTATION_LEFT_FACING = 6  % # MAV_SENSOR_ROTATION_YAW_270
  ROTATION_UPWARD_FACING = 24  % # MAV_SENSOR_ROTATION_PITCH_90
  ROTATION_DOWNWARD_FACING = 25  % # MAV_SENSOR_ROTATION_PITCH_270
  ROTATION_CUSTOM = 100  % # MAV_SENSOR_ROTATION_CUSTOM

RELATIVE_TIMESTAMP_INVALID = Simulink.Parameter(2147483647, StorageClass="Const", DataType="int32")  % # (0x7fffffff) If one of the relative timestamps is set to this value, it means the associated sensor values are invalid

EKF2_TIMESTAMPS = enum(AddClassNameToEnumNames=true)
  RELATIVE_TIMESTAMP_INVALID = 32767  % # (0x7fff) If one of the relative timestamps

FAILURE_OVER_CURRENT = Simulink.Parameter(0, StorageClass="Const", DataType="uint8")  % # (1 << 0)
FAILURE_OVER_VOLTAGE = Simulink.Parameter(1, StorageClass="Const", DataType="uint8")  % # (1 << 1)
FAILURE_MOTOR_OVER_TEMPERATURE = Simulink.Parameter(2, StorageClass="Const", DataType="uint8")  % # (1 << 2)
FAILURE_OVER_RPM = Simulink.Parameter(3, StorageClass="Const", DataType="uint8")  % # (1 << 3)
FAILURE_INCONSISTENT_CMD = Simulink.Parameter(4, StorageClass="Const", DataType="uint8")  % # (1 << 4)  Set if ESC received an inconsistent command (i.e out of boundaries)
FAILURE_MOTOR_STUCK = Simulink.Parameter(5, StorageClass="Const", DataType="uint8")  % # (1 << 5)
FAILURE_GENERIC = Simulink.Parameter(6, StorageClass="Const", DataType="uint8")  % # (1 << 6)
FAILURE_MOTOR_WARN_TEMPERATURE = Simulink.Parameter(7, StorageClass="Const", DataType="uint8")  % # (1 << 7)
FAILURE_WARN_ESC_TEMPERATURE = Simulink.Parameter(8, StorageClass="Const", DataType="uint8")  % # (1 << 8)
FAILURE_OVER_ESC_TEMPERATURE = Simulink.Parameter(9, StorageClass="Const", DataType="uint8")  % # (1 << 9)
ESC_FAILURE_COUNT = Simulink.Parameter(10, StorageClass="Const", DataType="uint8")  % # Counter - keep it as last element!

ESC_REPORT = enum(AddClassNameToEnumNames=true)
  FAILURE_OVER_CURRENT = 0  % # (1 << 0)
  FAILURE_OVER_VOLTAGE = 1  % # (1 << 1)
  FAILURE_MOTOR_OVER_TEMPERATURE = 2  % # (1 << 2)
  FAILURE_OVER_RPM = 3  % # (1 << 3)
  FAILURE_INCONSISTENT_CMD = 4  % # (1 << 4)  Set if ESC received an inconsistent command (i.e out of boundaries)
  FAILURE_MOTOR_STUCK = 5  % # (1 << 5)
  FAILURE_GENERIC = 6  % # (1 << 6)
  FAILURE_MOTOR_WARN_TEMPERATURE = 7  % # (1 << 7)
  FAILURE_WARN_ESC_TEMPERATURE = 8  % # (1 << 8)
  FAILURE_OVER_ESC_TEMPERATURE = 9  % # (1 << 9)
  ESC_FAILURE_COUNT = 10  % # Counter - keep it as last element!

CONNECTED_ESC_MAX = Simulink.Parameter(8, StorageClass="Const", DataType="uint8")  % # The number of ESCs supported. Current (Q2/2013) we support 8 ESCs
ESC_CONNECTION_TYPE_PPM = Simulink.Parameter(0, StorageClass="Const", DataType="uint8")  % # Traditional PPM ESC
ESC_CONNECTION_TYPE_SERIAL = Simulink.Parameter(1, StorageClass="Const", DataType="uint8")  % # Serial Bus connected ESC
ESC_CONNECTION_TYPE_ONESHOT = Simulink.Parameter(2, StorageClass="Const", DataType="uint8")  % # One Shot PPM
ESC_CONNECTION_TYPE_I2C = Simulink.Parameter(3, StorageClass="Const", DataType="uint8")  % # I2C
ESC_CONNECTION_TYPE_CAN = Simulink.Parameter(4, StorageClass="Const", DataType="uint8")  % # CAN-Bus
ESC_CONNECTION_TYPE_DSHOT = Simulink.Parameter(5, StorageClass="Const", DataType="uint8")  % # DShot

ESC_STATUS = enum(AddClassNameToEnumNames=true)
  CONNECTED_ESC_MAX = 8  % # The number of ESCs supported. Current (Q2/2013) we support 8 ESCs
  ESC_CONNECTION_TYPE_PPM = 0  % # Traditional PPM ESC
  ESC_CONNECTION_TYPE_SERIAL = 1  % # Serial Bus connected ESC
  ESC_CONNECTION_TYPE_ONESHOT = 2  % # One Shot PPM
  ESC_CONNECTION_TYPE_I2C = 3  % # I2C
  ESC_CONNECTION_TYPE_CAN = 4  % # CAN-Bus
  ESC_CONNECTION_TYPE_DSHOT = 5  % # DShot

GPS_CHECK_FAIL_GPS_FIX = Simulink.Parameter(0, StorageClass="Const", DataType="uint8")  % # 0 : insufficient fix type (no 3D solution)
GPS_CHECK_FAIL_MIN_SAT_COUNT = Simulink.Parameter(1, StorageClass="Const", DataType="uint8")  % # 1 : minimum required sat count fail
GPS_CHECK_FAIL_MAX_PDOP = Simulink.Parameter(2, StorageClass="Const", DataType="uint8")  % # 2 : maximum allowed PDOP fail
GPS_CHECK_FAIL_MAX_HORZ_ERR = Simulink.Parameter(3, StorageClass="Const", DataType="uint8")  % # 3 : maximum allowed horizontal position error fail
GPS_CHECK_FAIL_MAX_VERT_ERR = Simulink.Parameter(4, StorageClass="Const", DataType="uint8")  % # 4 : maximum allowed vertical position error fail
GPS_CHECK_FAIL_MAX_SPD_ERR = Simulink.Parameter(5, StorageClass="Const", DataType="uint8")  % # 5 : maximum allowed speed error fail
GPS_CHECK_FAIL_MAX_HORZ_DRIFT = Simulink.Parameter(6, StorageClass="Const", DataType="uint8")  % # 6 : maximum allowed horizontal position drift fail - requires stationary vehicle
GPS_CHECK_FAIL_MAX_VERT_DRIFT = Simulink.Parameter(7, StorageClass="Const", DataType="uint8")  % # 7 : maximum allowed vertical position drift fail - requires stationary vehicle
GPS_CHECK_FAIL_MAX_HORZ_SPD_ERR = Simulink.Parameter(8, StorageClass="Const", DataType="uint8")  % # 8 : maximum allowed horizontal speed fail - requires stationary vehicle
GPS_CHECK_FAIL_MAX_VERT_SPD_ERR = Simulink.Parameter(9, StorageClass="Const", DataType="uint8")  % # 9 : maximum allowed vertical velocity discrepancy fail
CS_TILT_ALIGN = Simulink.Parameter(0, StorageClass="Const", DataType="uint8")  % # 0 - true if the filter tilt alignment is complete
CS_YAW_ALIGN = Simulink.Parameter(1, StorageClass="Const", DataType="uint8")  % # 1 - true if the filter yaw alignment is complete
CS_GPS = Simulink.Parameter(2, StorageClass="Const", DataType="uint8")  % # 2 - true if GPS measurements are being fused
CS_OPT_FLOW = Simulink.Parameter(3, StorageClass="Const", DataType="uint8")  % # 3 - true if optical flow measurements are being fused
CS_MAG_HDG = Simulink.Parameter(4, StorageClass="Const", DataType="uint8")  % # 4 - true if a simple magnetic yaw heading is being fused
CS_MAG_3D = Simulink.Parameter(5, StorageClass="Const", DataType="uint8")  % # 5 - true if 3-axis magnetometer measurement are being fused
CS_MAG_DEC = Simulink.Parameter(6, StorageClass="Const", DataType="uint8")  % # 6 - true if synthetic magnetic declination measurements are being fused
CS_IN_AIR = Simulink.Parameter(7, StorageClass="Const", DataType="uint8")  % # 7 - true when thought to be airborne
CS_WIND = Simulink.Parameter(8, StorageClass="Const", DataType="uint8")  % # 8 - true when wind velocity is being estimated
CS_BARO_HGT = Simulink.Parameter(9, StorageClass="Const", DataType="uint8")  % # 9 - true when baro height is being fused as a primary height reference
CS_RNG_HGT = Simulink.Parameter(10, StorageClass="Const", DataType="uint8")  % # 10 - true when range finder height is being fused as a primary height reference
CS_GPS_HGT = Simulink.Parameter(11, StorageClass="Const", DataType="uint8")  % # 11 - true when GPS height is being fused as a primary height reference
CS_EV_POS = Simulink.Parameter(12, StorageClass="Const", DataType="uint8")  % # 12 - true when local position data from external vision is being fused
CS_EV_YAW = Simulink.Parameter(13, StorageClass="Const", DataType="uint8")  % # 13 - true when yaw data from external vision measurements is being fused
CS_EV_HGT = Simulink.Parameter(14, StorageClass="Const", DataType="uint8")  % # 14 - true when height data from external vision measurements is being fused
CS_BETA = Simulink.Parameter(15, StorageClass="Const", DataType="uint8")  % # 15 - true when synthetic sideslip measurements are being fused
CS_MAG_FIELD = Simulink.Parameter(16, StorageClass="Const", DataType="uint8")  % # 16 - true when only the magnetic field states are updated by the magnetometer
CS_FIXED_WING = Simulink.Parameter(17, StorageClass="Const", DataType="uint8")  % # 17 - true when thought to be operating as a fixed wing vehicle with constrained sideslip
CS_MAG_FAULT = Simulink.Parameter(18, StorageClass="Const", DataType="uint8")  % # 18 - true when the magnetometer has been declared faulty and is no longer being used
CS_ASPD = Simulink.Parameter(19, StorageClass="Const", DataType="uint8")  % # 19 - true when airspeed measurements are being fused
CS_GND_EFFECT = Simulink.Parameter(20, StorageClass="Const", DataType="uint8")  % # 20 - true when when protection from ground effect induced static pressure rise is active
CS_RNG_STUCK = Simulink.Parameter(21, StorageClass="Const", DataType="uint8")  % # 21 - true when a stuck range finder sensor has been detected
CS_GPS_YAW = Simulink.Parameter(22, StorageClass="Const", DataType="uint8")  % # 22 - true when yaw (not ground course) data from a GPS receiver is being fused
CS_MAG_ALIGNED = Simulink.Parameter(23, StorageClass="Const", DataType="uint8")  % # 23 - true when the in-flight mag field alignment has been completed
CS_EV_VEL = Simulink.Parameter(24, StorageClass="Const", DataType="uint8")  % # 24 - true when local frame velocity data fusion from external vision measurements is intended
CS_SYNTHETIC_MAG_Z = Simulink.Parameter(25, StorageClass="Const", DataType="uint8")  % # 25 - true when we are using a synthesized measurement for the magnetometer Z component
CS_VEHICLE_AT_REST = Simulink.Parameter(26, StorageClass="Const", DataType="uint8")  % # 26 - true when the vehicle is at rest
CS_GPS_YAW_FAULT = Simulink.Parameter(27, StorageClass="Const", DataType="uint8")  % # 27 - true when the GNSS heading has been declared faulty and is no longer being used
CS_RNG_FAULT = Simulink.Parameter(28, StorageClass="Const", DataType="uint8")  % # 28 - true when the range finder has been declared faulty and is no longer being used

ESTIMATOR_STATUS = enum(AddClassNameToEnumNames=true)
  GPS_CHECK_FAIL_GPS_FIX = 0  % # 0 : insufficient fix type (no 3D solution)
  GPS_CHECK_FAIL_MIN_SAT_COUNT = 1  % # 1 : minimum required sat count fail
  GPS_CHECK_FAIL_MAX_PDOP = 2  % # 2 : maximum allowed PDOP fail
  GPS_CHECK_FAIL_MAX_HORZ_ERR = 3  % # 3 : maximum allowed horizontal position error fail
  GPS_CHECK_FAIL_MAX_VERT_ERR = 4  % # 4 : maximum allowed vertical position error fail
  GPS_CHECK_FAIL_MAX_SPD_ERR = 5  % # 5 : maximum allowed speed error fail
  GPS_CHECK_FAIL_MAX_HORZ_DRIFT = 6  % # 6 : maximum allowed horizontal position drift fail - requires stationary vehicle
  GPS_CHECK_FAIL_MAX_VERT_DRIFT = 7  % # 7 : maximum allowed vertical position drift fail - requires stationary vehicle
  GPS_CHECK_FAIL_MAX_HORZ_SPD_ERR = 8  % # 8 : maximum allowed horizontal speed fail - requires stationary vehicle
  GPS_CHECK_FAIL_MAX_VERT_SPD_ERR = 9  % # 9 : maximum allowed vertical velocity discrepancy fail
  CS_TILT_ALIGN = 0  % # 0 - true if the filter tilt alignment is complete
  CS_YAW_ALIGN = 1  % # 1 - true if the filter yaw alignment is complete
  CS_GPS = 2  % # 2 - true if GPS measurements are being fused
  CS_OPT_FLOW = 3  % # 3 - true if optical flow measurements are being fused
  CS_MAG_HDG = 4  % # 4 - true if a simple magnetic yaw heading is being fused
  CS_MAG_3D = 5  % # 5 - true if 3-axis magnetometer measurement are being fused
  CS_MAG_DEC = 6  % # 6 - true if synthetic magnetic declination measurements are being fused
  CS_IN_AIR = 7  % # 7 - true when thought to be airborne
  CS_WIND = 8  % # 8 - true when wind velocity is being estimated
  CS_BARO_HGT = 9  % # 9 - true when baro height is being fused as a primary height reference
  CS_RNG_HGT = 10  % # 10 - true when range finder height is being fused as a primary height reference
  CS_GPS_HGT = 11  % # 11 - true when GPS height is being fused as a primary height reference
  CS_EV_POS = 12  % # 12 - true when local position data from external vision is being fused
  CS_EV_YAW = 13  % # 13 - true when yaw data from external vision measurements is being fused
  CS_EV_HGT = 14  % # 14 - true when height data from external vision measurements is being fused
  CS_BETA = 15  % # 15 - true when synthetic sideslip measurements are being fused
  CS_MAG_FIELD = 16  % # 16 - true when only the magnetic field states are updated by the magnetometer
  CS_FIXED_WING = 17  % # 17 - true when thought to be operating as a fixed wing vehicle with constrained sideslip
  CS_MAG_FAULT = 18  % # 18 - true when the magnetometer has been declared faulty and is no longer being used
  CS_ASPD = 19  % # 19 - true when airspeed measurements are being fused
  CS_GND_EFFECT = 20  % # 20 - true when when protection from ground effect induced static pressure rise is active
  CS_RNG_STUCK = 21  % # 21 - true when a stuck range finder sensor has been detected
  CS_GPS_YAW = 22  % # 22 - true when yaw (not ground course) data from a GPS receiver is being fused
  CS_MAG_ALIGNED = 23  % # 23 - true when the in-flight mag field alignment has been completed
  CS_EV_VEL = 24  % # 24 - true when local frame velocity data fusion from external vision measurements is intended
  CS_SYNTHETIC_MAG_Z = 25  % # 25 - true when we are using a synthesized measurement for the magnetometer Z component
  CS_VEHICLE_AT_REST = 26  % # 26 - true when the vehicle is at rest
  CS_GPS_YAW_FAULT = 27  % # 27 - true when the GNSS heading has been declared faulty and is no longer being used
  CS_RNG_FAULT = 28  % # 28 - true when the range finder has been declared faulty and is no longer being used

EVENT = enum(AddClassNameToEnumNames=true)
  ORB_QUEUE_LENGTH = 16

STATUS_FLAG_OFF = Simulink.Parameter(1, StorageClass="Const", DataType="uint64")  % # Generator is off.
STATUS_FLAG_READY = Simulink.Parameter(2, StorageClass="Const", DataType="uint64")  % # Generator is ready to start generating power.
STATUS_FLAG_GENERATING = Simulink.Parameter(4, StorageClass="Const", DataType="uint64")  % # Generator is generating power.
STATUS_FLAG_CHARGING = Simulink.Parameter(8, StorageClass="Const", DataType="uint64")  % # Generator is charging the batteries (generating enough power to charge and provide the load).
STATUS_FLAG_REDUCED_POWER = Simulink.Parameter(16, StorageClass="Const", DataType="uint64")  % # Generator is operating at a reduced maximum power.
STATUS_FLAG_MAXPOWER = Simulink.Parameter(32, StorageClass="Const", DataType="uint64")  % # Generator is providing the maximum output.
STATUS_FLAG_OVERTEMP_WARNING = Simulink.Parameter(64, StorageClass="Const", DataType="uint64")  % # Generator is near the maximum operating temperature, cooling is insufficient.
STATUS_FLAG_OVERTEMP_FAULT = Simulink.Parameter(128, StorageClass="Const", DataType="uint64")  % # Generator hit the maximum operating temperature and shutdown.
STATUS_FLAG_ELECTRONICS_OVERTEMP_WARNING = Simulink.Parameter(256, StorageClass="Const", DataType="uint64")  % # Power electronics are near the maximum operating temperature, cooling is insufficient.
STATUS_FLAG_ELECTRONICS_OVERTEMP_FAULT = Simulink.Parameter(512, StorageClass="Const", DataType="uint64")  % # Power electronics hit the maximum operating temperature and shutdown.
STATUS_FLAG_ELECTRONICS_FAULT = Simulink.Parameter(1024, StorageClass="Const", DataType="uint64")  % # Power electronics experienced a fault and shutdown.
STATUS_FLAG_POWERSOURCE_FAULT = Simulink.Parameter(2048, StorageClass="Const", DataType="uint64")  % # The power source supplying the generator failed e.g. mechanical generator stopped, tether is no longer providing power, solar cell is in shade, hydrogen reaction no longer happening.
STATUS_FLAG_COMMUNICATION_WARNING = Simulink.Parameter(4096, StorageClass="Const", DataType="uint64")  % # Generator controller having communication problems.
STATUS_FLAG_COOLING_WARNING = Simulink.Parameter(8192, StorageClass="Const", DataType="uint64")  % # Power electronic or generator cooling system error.
STATUS_FLAG_POWER_RAIL_FAULT = Simulink.Parameter(16384, StorageClass="Const", DataType="uint64")  % # Generator controller power rail experienced a fault.
STATUS_FLAG_OVERCURRENT_FAULT = Simulink.Parameter(32768, StorageClass="Const", DataType="uint64")  % # Generator controller exceeded the overcurrent threshold and shutdown to prevent damage.
STATUS_FLAG_BATTERY_OVERCHARGE_CURRENT_FAULT = Simulink.Parameter(65536, StorageClass="Const", DataType="uint64")  % # Generator controller detected a high current going into the batteries and shutdown to prevent battery damage. |
STATUS_FLAG_OVERVOLTAGE_FAULT = Simulink.Parameter(131072, StorageClass="Const", DataType="uint64")  % # Generator controller exceeded it's overvoltage threshold and shutdown to prevent it exceeding the voltage rating.
STATUS_FLAG_BATTERY_UNDERVOLT_FAULT = Simulink.Parameter(262144, StorageClass="Const", DataType="uint64")  % # Batteries are under voltage (generator will not start).
STATUS_FLAG_START_INHIBITED = Simulink.Parameter(524288, StorageClass="Const", DataType="uint64")  % # Generator start is inhibited by e.g. a safety switch.
STATUS_FLAG_MAINTENANCE_REQUIRED = Simulink.Parameter(1048576, StorageClass="Const", DataType="uint64")  % # Generator requires maintenance.
STATUS_FLAG_WARMING_UP = Simulink.Parameter(2097152, StorageClass="Const", DataType="uint64")  % # Generator is not ready to generate yet.
STATUS_FLAG_IDLE = Simulink.Parameter(4194304, StorageClass="Const", DataType="uint64")  % # Generator is idle.

GENERATOR_STATUS = enum(AddClassNameToEnumNames=true)
  STATUS_FLAG_OFF = 1  % # Generator is off.
  STATUS_FLAG_READY = 2  % # Generator is ready to start generating power.
  STATUS_FLAG_GENERATING = 4  % # Generator is generating power.
  STATUS_FLAG_CHARGING = 8  % # Generator is charging the batteries (generating enough power to charge and provide the load).
  STATUS_FLAG_REDUCED_POWER = 16  % # Generator is operating at a reduced maximum power.
  STATUS_FLAG_MAXPOWER = 32  % # Generator is providing the maximum output.
  STATUS_FLAG_OVERTEMP_WARNING = 64  % # Generator is near the maximum operating temperature, cooling is insufficient.
  STATUS_FLAG_OVERTEMP_FAULT = 128  % # Generator hit the maximum operating temperature and shutdown.
  STATUS_FLAG_ELECTRONICS_OVERTEMP_WARNING = 256  % # Power electronics are near the maximum operating temperature, cooling is insufficient.
  STATUS_FLAG_ELECTRONICS_OVERTEMP_FAULT = 512  % # Power electronics hit the maximum operating temperature and shutdown.
  STATUS_FLAG_ELECTRONICS_FAULT = 1024  % # Power electronics experienced a fault and shutdown.
  STATUS_FLAG_POWERSOURCE_FAULT = 2048  % # The power source supplying the generator failed e.g. mechanical generator stopped, tether is no longer providing power, solar cell is in shade, hydrogen reaction no longer happening.
  STATUS_FLAG_COMMUNICATION_WARNING = 4096  % # Generator controller having communication problems.
  STATUS_FLAG_COOLING_WARNING = 8192  % # Power electronic or generator cooling system error.
  STATUS_FLAG_POWER_RAIL_FAULT = 16384  % # Generator controller power rail experienced a fault.
  STATUS_FLAG_OVERCURRENT_FAULT = 32768  % # Generator controller exceeded the overcurrent threshold and shutdown to prevent damage.
  STATUS_FLAG_BATTERY_OVERCHARGE_CURRENT_FAULT = 65536  % # Generator controller detected a high current going into the batteries and shutdown to prevent battery damage. |
  STATUS_FLAG_OVERVOLTAGE_FAULT = 131072  % # Generator controller exceeded it's overvoltage threshold and shutdown to prevent it exceeding the voltage rating.
  STATUS_FLAG_BATTERY_UNDERVOLT_FAULT = 262144  % # Batteries are under voltage (generator will not start).
  STATUS_FLAG_START_INHIBITED = 524288  % # Generator start is inhibited by e.g. a safety switch.
  STATUS_FLAG_MAINTENANCE_REQUIRED = 1048576  % # Generator requires maintenance.
  STATUS_FLAG_WARMING_UP = 2097152  % # Generator is not ready to generate yet.
  STATUS_FLAG_IDLE = 4194304  % # Generator is idle.

GF_ACTION_NONE = Simulink.Parameter(0, StorageClass="Const", DataType="uint8")  % # no action on geofence violation
GF_ACTION_WARN = Simulink.Parameter(1, StorageClass="Const", DataType="uint8")  % # critical mavlink message
GF_ACTION_LOITER = Simulink.Parameter(2, StorageClass="Const", DataType="uint8")  % # switch to AUTO|LOITER
GF_ACTION_RTL = Simulink.Parameter(3, StorageClass="Const", DataType="uint8")  % # switch to AUTO|RTL
GF_ACTION_TERMINATE = Simulink.Parameter(4, StorageClass="Const", DataType="uint8")  % # flight termination
GF_ACTION_LAND = Simulink.Parameter(5, StorageClass="Const", DataType="uint8")  % # switch to AUTO|LAND

GEOFENCE_RESULT = enum(AddClassNameToEnumNames=true)
  GF_ACTION_NONE = 0  % # no action on geofence violation
  GF_ACTION_WARN = 1  % # critical mavlink message
  GF_ACTION_LOITER = 2  % # switch to AUTO|LOITER
  GF_ACTION_RTL = 3  % # switch to AUTO|RTL
  GF_ACTION_TERMINATE = 4  % # flight termination
  GF_ACTION_LAND = 5  % # switch to AUTO|LAND

INDEX_ROLL = Simulink.Parameter(0, StorageClass="Const", DataType="uint8")
INDEX_PITCH = Simulink.Parameter(1, StorageClass="Const", DataType="uint8")
INDEX_YAW = Simulink.Parameter(2, StorageClass="Const", DataType="uint8")

GIMBAL_CONTROLS = enum(AddClassNameToEnumNames=true)
  INDEX_ROLL = 0
  INDEX_PITCH = 1
  INDEX_YAW = 2

DEVICE_FLAGS_RETRACT = Simulink.Parameter(1, StorageClass="Const", DataType="uint16")
DEVICE_FLAGS_NEUTRAL = Simulink.Parameter(2, StorageClass="Const", DataType="uint16")
DEVICE_FLAGS_ROLL_LOCK = Simulink.Parameter(4, StorageClass="Const", DataType="uint16")
DEVICE_FLAGS_PITCH_LOCK = Simulink.Parameter(8, StorageClass="Const", DataType="uint16")
DEVICE_FLAGS_YAW_LOCK = Simulink.Parameter(16, StorageClass="Const", DataType="uint16")

GIMBAL_DEVICE_ATTITUDE_STATUS = enum(AddClassNameToEnumNames=true)
  DEVICE_FLAGS_RETRACT = 1
  DEVICE_FLAGS_NEUTRAL = 2
  DEVICE_FLAGS_ROLL_LOCK = 4
  DEVICE_FLAGS_PITCH_LOCK = 8
  DEVICE_FLAGS_YAW_LOCK = 16

GIMBAL_DEVICE_CAP_FLAGS_HAS_RETRACT = Simulink.Parameter(1, StorageClass="Const", DataType="uint32")
GIMBAL_DEVICE_CAP_FLAGS_HAS_NEUTRAL = Simulink.Parameter(2, StorageClass="Const", DataType="uint32")
GIMBAL_DEVICE_CAP_FLAGS_HAS_ROLL_AXIS = Simulink.Parameter(4, StorageClass="Const", DataType="uint32")
GIMBAL_DEVICE_CAP_FLAGS_HAS_ROLL_FOLLOW = Simulink.Parameter(8, StorageClass="Const", DataType="uint32")
GIMBAL_DEVICE_CAP_FLAGS_HAS_ROLL_LOCK = Simulink.Parameter(16, StorageClass="Const", DataType="uint32")
GIMBAL_DEVICE_CAP_FLAGS_HAS_PITCH_AXIS = Simulink.Parameter(32, StorageClass="Const", DataType="uint32")
GIMBAL_DEVICE_CAP_FLAGS_HAS_PITCH_FOLLOW = Simulink.Parameter(64, StorageClass="Const", DataType="uint32")
GIMBAL_DEVICE_CAP_FLAGS_HAS_PITCH_LOCK = Simulink.Parameter(128, StorageClass="Const", DataType="uint32")
GIMBAL_DEVICE_CAP_FLAGS_HAS_YAW_AXIS = Simulink.Parameter(256, StorageClass="Const", DataType="uint32")
GIMBAL_DEVICE_CAP_FLAGS_HAS_YAW_FOLLOW = Simulink.Parameter(512, StorageClass="Const", DataType="uint32")
GIMBAL_DEVICE_CAP_FLAGS_HAS_YAW_LOCK = Simulink.Parameter(1024, StorageClass="Const", DataType="uint32")
GIMBAL_DEVICE_CAP_FLAGS_SUPPORTS_INFINITE_YAW = Simulink.Parameter(2048, StorageClass="Const", DataType="uint32")

GIMBAL_DEVICE_INFORMATION = enum(AddClassNameToEnumNames=true)
  GIMBAL_DEVICE_CAP_FLAGS_HAS_RETRACT = 1
  GIMBAL_DEVICE_CAP_FLAGS_HAS_NEUTRAL = 2
  GIMBAL_DEVICE_CAP_FLAGS_HAS_ROLL_AXIS = 4
  GIMBAL_DEVICE_CAP_FLAGS_HAS_ROLL_FOLLOW = 8
  GIMBAL_DEVICE_CAP_FLAGS_HAS_ROLL_LOCK = 16
  GIMBAL_DEVICE_CAP_FLAGS_HAS_PITCH_AXIS = 32
  GIMBAL_DEVICE_CAP_FLAGS_HAS_PITCH_FOLLOW = 64
  GIMBAL_DEVICE_CAP_FLAGS_HAS_PITCH_LOCK = 128
  GIMBAL_DEVICE_CAP_FLAGS_HAS_YAW_AXIS = 256
  GIMBAL_DEVICE_CAP_FLAGS_HAS_YAW_FOLLOW = 512
  GIMBAL_DEVICE_CAP_FLAGS_HAS_YAW_LOCK = 1024
  GIMBAL_DEVICE_CAP_FLAGS_SUPPORTS_INFINITE_YAW = 2048

GIMBAL_DEVICE_FLAGS_RETRACT = Simulink.Parameter(1, StorageClass="Const", DataType="uint32")
GIMBAL_DEVICE_FLAGS_NEUTRAL = Simulink.Parameter(2, StorageClass="Const", DataType="uint32")
GIMBAL_DEVICE_FLAGS_ROLL_LOCK = Simulink.Parameter(4, StorageClass="Const", DataType="uint32")
GIMBAL_DEVICE_FLAGS_PITCH_LOCK = Simulink.Parameter(8, StorageClass="Const", DataType="uint32")
GIMBAL_DEVICE_FLAGS_YAW_LOCK = Simulink.Parameter(16, StorageClass="Const", DataType="uint32")

GIMBAL_DEVICE_SET_ATTITUDE = enum(AddClassNameToEnumNames=true)
  GIMBAL_DEVICE_FLAGS_RETRACT = 1
  GIMBAL_DEVICE_FLAGS_NEUTRAL = 2
  GIMBAL_DEVICE_FLAGS_ROLL_LOCK = 4
  GIMBAL_DEVICE_FLAGS_PITCH_LOCK = 8
  GIMBAL_DEVICE_FLAGS_YAW_LOCK = 16

GIMBAL_MANAGER_CAP_FLAGS_HAS_RETRACT = Simulink.Parameter(1, StorageClass="Const", DataType="uint32")
GIMBAL_MANAGER_CAP_FLAGS_HAS_NEUTRAL = Simulink.Parameter(2, StorageClass="Const", DataType="uint32")
GIMBAL_MANAGER_CAP_FLAGS_HAS_ROLL_AXIS = Simulink.Parameter(4, StorageClass="Const", DataType="uint32")
GIMBAL_MANAGER_CAP_FLAGS_HAS_ROLL_FOLLOW = Simulink.Parameter(8, StorageClass="Const", DataType="uint32")
GIMBAL_MANAGER_CAP_FLAGS_HAS_ROLL_LOCK = Simulink.Parameter(16, StorageClass="Const", DataType="uint32")
GIMBAL_MANAGER_CAP_FLAGS_HAS_PITCH_AXIS = Simulink.Parameter(32, StorageClass="Const", DataType="uint32")
GIMBAL_MANAGER_CAP_FLAGS_HAS_PITCH_FOLLOW = Simulink.Parameter(64, StorageClass="Const", DataType="uint32")
GIMBAL_MANAGER_CAP_FLAGS_HAS_PITCH_LOCK = Simulink.Parameter(128, StorageClass="Const", DataType="uint32")
GIMBAL_MANAGER_CAP_FLAGS_HAS_YAW_AXIS = Simulink.Parameter(256, StorageClass="Const", DataType="uint32")
GIMBAL_MANAGER_CAP_FLAGS_HAS_YAW_FOLLOW = Simulink.Parameter(512, StorageClass="Const", DataType="uint32")
GIMBAL_MANAGER_CAP_FLAGS_HAS_YAW_LOCK = Simulink.Parameter(1024, StorageClass="Const", DataType="uint32")
GIMBAL_MANAGER_CAP_FLAGS_SUPPORTS_INFINITE_YAW = Simulink.Parameter(2048, StorageClass="Const", DataType="uint32")
GIMBAL_MANAGER_CAP_FLAGS_CAN_POINT_LOCATION_LOCAL = Simulink.Parameter(65536, StorageClass="Const", DataType="uint32")
GIMBAL_MANAGER_CAP_FLAGS_CAN_POINT_LOCATION_GLOBAL = Simulink.Parameter(131072, StorageClass="Const", DataType="uint32")

GIMBAL_MANAGER_INFORMATION = enum(AddClassNameToEnumNames=true)
  GIMBAL_MANAGER_CAP_FLAGS_HAS_RETRACT = 1
  GIMBAL_MANAGER_CAP_FLAGS_HAS_NEUTRAL = 2
  GIMBAL_MANAGER_CAP_FLAGS_HAS_ROLL_AXIS = 4
  GIMBAL_MANAGER_CAP_FLAGS_HAS_ROLL_FOLLOW = 8
  GIMBAL_MANAGER_CAP_FLAGS_HAS_ROLL_LOCK = 16
  GIMBAL_MANAGER_CAP_FLAGS_HAS_PITCH_AXIS = 32
  GIMBAL_MANAGER_CAP_FLAGS_HAS_PITCH_FOLLOW = 64
  GIMBAL_MANAGER_CAP_FLAGS_HAS_PITCH_LOCK = 128
  GIMBAL_MANAGER_CAP_FLAGS_HAS_YAW_AXIS = 256
  GIMBAL_MANAGER_CAP_FLAGS_HAS_YAW_FOLLOW = 512
  GIMBAL_MANAGER_CAP_FLAGS_HAS_YAW_LOCK = 1024
  GIMBAL_MANAGER_CAP_FLAGS_SUPPORTS_INFINITE_YAW = 2048
  GIMBAL_MANAGER_CAP_FLAGS_CAN_POINT_LOCATION_LOCAL = 65536
  GIMBAL_MANAGER_CAP_FLAGS_CAN_POINT_LOCATION_GLOBAL = 131072

GIMBAL_MANAGER_FLAGS_RETRACT = Simulink.Parameter(1, StorageClass="Const", DataType="uint32")
GIMBAL_MANAGER_FLAGS_NEUTRAL = Simulink.Parameter(2, StorageClass="Const", DataType="uint32")
GIMBAL_MANAGER_FLAGS_ROLL_LOCK = Simulink.Parameter(4, StorageClass="Const", DataType="uint32")
GIMBAL_MANAGER_FLAGS_PITCH_LOCK = Simulink.Parameter(8, StorageClass="Const", DataType="uint32")
GIMBAL_MANAGER_FLAGS_YAW_LOCK = Simulink.Parameter(16, StorageClass="Const", DataType="uint32")

GIMBAL_MANAGER_SET_ATTITUDE = enum(AddClassNameToEnumNames=true)
  GIMBAL_MANAGER_FLAGS_RETRACT = 1
  GIMBAL_MANAGER_FLAGS_NEUTRAL = 2
  GIMBAL_MANAGER_FLAGS_ROLL_LOCK = 4
  GIMBAL_MANAGER_FLAGS_PITCH_LOCK = 8
  GIMBAL_MANAGER_FLAGS_YAW_LOCK = 16

GIMBAL_MANAGER_SET_MANUAL_CONTROL = enum(AddClassNameToEnumNames=true)
  GIMBAL_MANAGER_FLAGS_RETRACT = 1
  GIMBAL_MANAGER_FLAGS_NEUTRAL = 2
  GIMBAL_MANAGER_FLAGS_ROLL_LOCK = 4
  GIMBAL_MANAGER_FLAGS_PITCH_LOCK = 8
  GIMBAL_MANAGER_FLAGS_YAW_LOCK = 16

GPS_DUMP = enum(AddClassNameToEnumNames=true)
  ORB_QUEUE_LENGTH = 8

GPS_INJECT_DATA = enum(AddClassNameToEnumNames=true)
  ORB_QUEUE_LENGTH = 8
  MAX_INSTANCES = 2

COMMAND_GRAB = Simulink.Parameter(0, StorageClass="Const", DataType="int8")
COMMAND_RELEASE = Simulink.Parameter(1, StorageClass="Const", DataType="int8")

GRIPPER = enum(AddClassNameToEnumNames=true)
  COMMAND_GRAB = 0
  COMMAND_RELEASE = 1

MODE_GPIO = Simulink.Parameter(1, StorageClass="Const", DataType="uint8")
MODE_PX4IO = Simulink.Parameter(2, StorageClass="Const", DataType="uint8")

HEATER_STATUS = enum(AddClassNameToEnumNames=true)
  MODE_GPIO = 1
  MODE_PX4IO = 2

RC_INPUT_SOURCE_UNKNOWN = Simulink.Parameter(0, StorageClass="Const", DataType="uint8")
RC_INPUT_SOURCE_PX4FMU_PPM = Simulink.Parameter(1, StorageClass="Const", DataType="uint8")
RC_INPUT_SOURCE_PX4IO_PPM = Simulink.Parameter(2, StorageClass="Const", DataType="uint8")
RC_INPUT_SOURCE_PX4IO_SPEKTRUM = Simulink.Parameter(3, StorageClass="Const", DataType="uint8")
RC_INPUT_SOURCE_PX4IO_SBUS = Simulink.Parameter(4, StorageClass="Const", DataType="uint8")
RC_INPUT_SOURCE_PX4IO_ST24 = Simulink.Parameter(5, StorageClass="Const", DataType="uint8")
RC_INPUT_SOURCE_MAVLINK = Simulink.Parameter(6, StorageClass="Const", DataType="uint8")
RC_INPUT_SOURCE_QURT = Simulink.Parameter(7, StorageClass="Const", DataType="uint8")
RC_INPUT_SOURCE_PX4FMU_SPEKTRUM = Simulink.Parameter(8, StorageClass="Const", DataType="uint8")
RC_INPUT_SOURCE_PX4FMU_SBUS = Simulink.Parameter(9, StorageClass="Const", DataType="uint8")
RC_INPUT_SOURCE_PX4FMU_ST24 = Simulink.Parameter(10, StorageClass="Const", DataType="uint8")
RC_INPUT_SOURCE_PX4FMU_SUMD = Simulink.Parameter(11, StorageClass="Const", DataType="uint8")
RC_INPUT_SOURCE_PX4FMU_DSM = Simulink.Parameter(12, StorageClass="Const", DataType="uint8")
RC_INPUT_SOURCE_PX4IO_SUMD = Simulink.Parameter(13, StorageClass="Const", DataType="uint8")
RC_INPUT_SOURCE_PX4FMU_CRSF = Simulink.Parameter(14, StorageClass="Const", DataType="uint8")
RC_INPUT_SOURCE_PX4FMU_GHST = Simulink.Parameter(15, StorageClass="Const", DataType="uint8")
RC_INPUT_MAX_CHANNELS = Simulink.Parameter(18, StorageClass="Const", DataType="uint8")  % # Maximum number of R/C input channels in the system. S.Bus has up to 18 channels.
RSSI_MAX = Simulink.Parameter(100, StorageClass="Const", DataType="int8")

INPUT_RC = enum(AddClassNameToEnumNames=true)
  RC_INPUT_SOURCE_UNKNOWN = 0
  RC_INPUT_SOURCE_PX4FMU_PPM = 1
  RC_INPUT_SOURCE_PX4IO_PPM = 2
  RC_INPUT_SOURCE_PX4IO_SPEKTRUM = 3
  RC_INPUT_SOURCE_PX4IO_SBUS = 4
  RC_INPUT_SOURCE_PX4IO_ST24 = 5
  RC_INPUT_SOURCE_MAVLINK = 6
  RC_INPUT_SOURCE_QURT = 7
  RC_INPUT_SOURCE_PX4FMU_SPEKTRUM = 8
  RC_INPUT_SOURCE_PX4FMU_SBUS = 9
  RC_INPUT_SOURCE_PX4FMU_ST24 = 10
  RC_INPUT_SOURCE_PX4FMU_SUMD = 11
  RC_INPUT_SOURCE_PX4FMU_DSM = 12
  RC_INPUT_SOURCE_PX4IO_SUMD = 13
  RC_INPUT_SOURCE_PX4FMU_CRSF = 14
  RC_INPUT_SOURCE_PX4FMU_GHST = 15
  RC_INPUT_MAX_CHANNELS = 18  % # Maximum number of R/C input channels in the system. S.Bus has up to 18 channels.
  RSSI_MAX = 100

STATE_STOPPED = Simulink.Parameter(0, StorageClass="Const", DataType="uint8")  % # The engine is not running. This is the default state.
STATE_STARTING = Simulink.Parameter(1, StorageClass="Const", DataType="uint8")  % # The engine is starting. This is a transient state.
STATE_RUNNING = Simulink.Parameter(2, StorageClass="Const", DataType="uint8")  % # The engine is running normally.
STATE_FAULT = Simulink.Parameter(3, StorageClass="Const", DataType="uint8")  % # The engine can no longer function.
FLAG_GENERAL_ERROR = Simulink.Parameter(1, StorageClass="Const", DataType="uint32")  % # General error.
FLAG_CRANKSHAFT_SENSOR_ERROR_SUPPORTED = Simulink.Parameter(2, StorageClass="Const", DataType="uint32")  % # Error of the crankshaft sensor. This flag is optional.
FLAG_CRANKSHAFT_SENSOR_ERROR = Simulink.Parameter(4, StorageClass="Const", DataType="uint32")
FLAG_TEMPERATURE_SUPPORTED = Simulink.Parameter(8, StorageClass="Const", DataType="uint32")  % # Temperature levels. These flags are optional
FLAG_TEMPERATURE_BELOW_NOMINAL = Simulink.Parameter(16, StorageClass="Const", DataType="uint32")  % # Under-temperature warning
FLAG_TEMPERATURE_ABOVE_NOMINAL = Simulink.Parameter(32, StorageClass="Const", DataType="uint32")  % # Over-temperature warning
FLAG_TEMPERATURE_OVERHEATING = Simulink.Parameter(64, StorageClass="Const", DataType="uint32")  % # Critical overheating
FLAG_TEMPERATURE_EGT_ABOVE_NOMINAL = Simulink.Parameter(128, StorageClass="Const", DataType="uint32")  % # Exhaust gas over-temperature warning
FLAG_FUEL_PRESSURE_SUPPORTED = Simulink.Parameter(256, StorageClass="Const", DataType="uint32")  % # Fuel pressure. These flags are optional
FLAG_FUEL_PRESSURE_BELOW_NOMINAL = Simulink.Parameter(512, StorageClass="Const", DataType="uint32")  % # Under-pressure warning
FLAG_FUEL_PRESSURE_ABOVE_NOMINAL = Simulink.Parameter(1024, StorageClass="Const", DataType="uint32")  % # Over-pressure warning
FLAG_DETONATION_SUPPORTED = Simulink.Parameter(2048, StorageClass="Const", DataType="uint32")  % # Detonation warning. This flag is optional.
FLAG_DETONATION_OBSERVED = Simulink.Parameter(4096, StorageClass="Const", DataType="uint32")  % # Detonation condition observed warning
FLAG_MISFIRE_SUPPORTED = Simulink.Parameter(8192, StorageClass="Const", DataType="uint32")  % # Misfire warning. This flag is optional.
FLAG_MISFIRE_OBSERVED = Simulink.Parameter(16384, StorageClass="Const", DataType="uint32")  % # Misfire condition observed warning
FLAG_OIL_PRESSURE_SUPPORTED = Simulink.Parameter(32768, StorageClass="Const", DataType="uint32")  % # Oil pressure. These flags are optional
FLAG_OIL_PRESSURE_BELOW_NOMINAL = Simulink.Parameter(65536, StorageClass="Const", DataType="uint32")  % # Under-pressure warning
FLAG_OIL_PRESSURE_ABOVE_NOMINAL = Simulink.Parameter(131072, StorageClass="Const", DataType="uint32")  % # Over-pressure warning
FLAG_DEBRIS_SUPPORTED = Simulink.Parameter(262144, StorageClass="Const", DataType="uint32")  % # Debris warning. This flag is optional
FLAG_DEBRIS_DETECTED = Simulink.Parameter(524288, StorageClass="Const", DataType="uint32")  % # Detection of debris warning
SPARK_PLUG_SINGLE = Simulink.Parameter(0, StorageClass="Const", DataType="uint8")
SPARK_PLUG_FIRST_ACTIVE = Simulink.Parameter(1, StorageClass="Const", DataType="uint8")
SPARK_PLUG_SECOND_ACTIVE = Simulink.Parameter(2, StorageClass="Const", DataType="uint8")
SPARK_PLUG_BOTH_ACTIVE = Simulink.Parameter(3, StorageClass="Const", DataType="uint8")

INTERNAL_COMBUSTION_ENGINE_STATUS = enum(AddClassNameToEnumNames=true)
  STATE_STOPPED = 0  % # The engine is not running. This is the default state.
  STATE_STARTING = 1  % # The engine is starting. This is a transient state.
  STATE_RUNNING = 2  % # The engine is running normally.
  STATE_FAULT = 3  % # The engine can no longer function.
  FLAG_GENERAL_ERROR = 1  % # General error.
  FLAG_CRANKSHAFT_SENSOR_ERROR_SUPPORTED = 2  % # Error of the crankshaft sensor. This flag is optional.
  FLAG_CRANKSHAFT_SENSOR_ERROR = 4
  FLAG_TEMPERATURE_SUPPORTED = 8  % # Temperature levels. These flags are optional
  FLAG_TEMPERATURE_BELOW_NOMINAL = 16  % # Under-temperature warning
  FLAG_TEMPERATURE_ABOVE_NOMINAL = 32  % # Over-temperature warning
  FLAG_TEMPERATURE_OVERHEATING = 64  % # Critical overheating
  FLAG_TEMPERATURE_EGT_ABOVE_NOMINAL = 128  % # Exhaust gas over-temperature warning
  FLAG_FUEL_PRESSURE_SUPPORTED = 256  % # Fuel pressure. These flags are optional
  FLAG_FUEL_PRESSURE_BELOW_NOMINAL = 512  % # Under-pressure warning
  FLAG_FUEL_PRESSURE_ABOVE_NOMINAL = 1024  % # Over-pressure warning
  FLAG_DETONATION_SUPPORTED = 2048  % # Detonation warning. This flag is optional.
  FLAG_DETONATION_OBSERVED = 4096  % # Detonation condition observed warning
  FLAG_MISFIRE_SUPPORTED = 8192  % # Misfire warning. This flag is optional.
  FLAG_MISFIRE_OBSERVED = 16384  % # Misfire condition observed warning
  FLAG_OIL_PRESSURE_SUPPORTED = 32768  % # Oil pressure. These flags are optional
  FLAG_OIL_PRESSURE_BELOW_NOMINAL = 65536  % # Under-pressure warning
  FLAG_OIL_PRESSURE_ABOVE_NOMINAL = 131072  % # Over-pressure warning
  FLAG_DEBRIS_SUPPORTED = 262144  % # Debris warning. This flag is optional
  FLAG_DEBRIS_DETECTED = 524288  % # Detection of debris warning
  SPARK_PLUG_SINGLE = 0
  SPARK_PLUG_FIRST_ACTIVE = 1
  SPARK_PLUG_SECOND_ACTIVE = 2
  SPARK_PLUG_BOTH_ACTIVE = 3

GEAR_UP = Simulink.Parameter(1, StorageClass="Const", DataType="int8")  % # landing gear up
GEAR_DOWN = Simulink.Parameter(-1, StorageClass="Const", DataType="int8")  % # landing gear down
GEAR_KEEP = Simulink.Parameter(0, StorageClass="Const", DataType="int8")  % # keep the current state

LANDING_GEAR = enum(AddClassNameToEnumNames=true)
  GEAR_UP = 1  % # landing gear up
  GEAR_DOWN = -1  % # landing gear down
  GEAR_KEEP = 0  % # keep the current state

STATE_WAITING_FOR_LAUNCH = Simulink.Parameter(0, StorageClass="Const", DataType="uint8")  % # waiting for launch
STATE_LAUNCH_DETECTED_DISABLED_MOTOR = Simulink.Parameter(1, StorageClass="Const", DataType="uint8")  % # launch detected, but keep motor(s) disabled (e.g. because it can't spin freely while on catapult)
STATE_FLYING = Simulink.Parameter(2, StorageClass="Const", DataType="uint8")  % # launch detected, use normal takeoff/flying configuration

LAUNCH_DETECTION_STATUS = enum(AddClassNameToEnumNames=true)
  STATE_WAITING_FOR_LAUNCH = 0  % # waiting for launch
  STATE_LAUNCH_DETECTED_DISABLED_MOTOR = 1  % # launch detected, but keep motor(s) disabled (e.g. because it can't spin freely while on catapult)
  STATE_FLYING = 2  % # launch detected, use normal takeoff/flying configuration

COLOR_OFF = Simulink.Parameter(0, StorageClass="Const", DataType="uint8")  % # this is only used in the drivers
COLOR_RED = Simulink.Parameter(1, StorageClass="Const", DataType="uint8")
COLOR_GREEN = Simulink.Parameter(2, StorageClass="Const", DataType="uint8")
COLOR_BLUE = Simulink.Parameter(3, StorageClass="Const", DataType="uint8")
COLOR_YELLOW = Simulink.Parameter(4, StorageClass="Const", DataType="uint8")
COLOR_PURPLE = Simulink.Parameter(5, StorageClass="Const", DataType="uint8")
COLOR_AMBER = Simulink.Parameter(6, StorageClass="Const", DataType="uint8")
COLOR_CYAN = Simulink.Parameter(7, StorageClass="Const", DataType="uint8")
COLOR_WHITE = Simulink.Parameter(8, StorageClass="Const", DataType="uint8")
MODE_OFF = Simulink.Parameter(0, StorageClass="Const", DataType="uint8")  % # turn LED off
MODE_ON = Simulink.Parameter(1, StorageClass="Const", DataType="uint8")  % # turn LED on
MODE_DISABLED = Simulink.Parameter(2, StorageClass="Const", DataType="uint8")  % # disable this priority (switch to lower priority setting)
MODE_BLINK_SLOW = Simulink.Parameter(3, StorageClass="Const", DataType="uint8")
MODE_BLINK_NORMAL = Simulink.Parameter(4, StorageClass="Const", DataType="uint8")
MODE_BLINK_FAST = Simulink.Parameter(5, StorageClass="Const", DataType="uint8")
MODE_BREATHE = Simulink.Parameter(6, StorageClass="Const", DataType="uint8")  % # continuously increase & decrease brightness (solid color if driver does not support it)
MODE_FLASH = Simulink.Parameter(7, StorageClass="Const", DataType="uint8")  % # two fast blinks (on/off) with timing as in MODE_BLINK_FAST and then off for a while
MAX_PRIORITY = Simulink.Parameter(2, StorageClass="Const", DataType="uint8")  % # maximum priority (minimum is 0)

LED_CONTROL = enum(AddClassNameToEnumNames=true)
  COLOR_OFF = 0  % # this is only used in the drivers
  COLOR_RED = 1
  COLOR_GREEN = 2
  COLOR_BLUE = 3
  COLOR_YELLOW = 4
  COLOR_PURPLE = 5
  COLOR_AMBER = 6
  COLOR_CYAN = 7
  COLOR_WHITE = 8
  MODE_OFF = 0  % # turn LED off
  MODE_ON = 1  % # turn LED on
  MODE_DISABLED = 2  % # disable this priority (switch to lower priority setting)
  MODE_BLINK_SLOW = 3
  MODE_BLINK_NORMAL = 4
  MODE_BLINK_FAST = 5
  MODE_BREATHE = 6  % # continuously increase & decrease brightness (solid color if driver does not support it)
  MODE_FLASH = 7  % # two fast blinks (on/off) with timing as in MODE_BLINK_FAST and then off for a while
  MAX_PRIORITY = 2  % # maximum priority (minimum is 0)
  ORB_QUEUE_LENGTH = 8  % # needs to match BOARD_MAX_LEDS

LOG_MESSAGE = enum(AddClassNameToEnumNames=true)
  ORB_QUEUE_LENGTH = 4

LOGGER_TYPE_FULL = Simulink.Parameter(0, StorageClass="Const", DataType="uint8")  % # Normal, full size log
LOGGER_TYPE_MISSION = Simulink.Parameter(1, StorageClass="Const", DataType="uint8")  % # reduced mission log (e.g. for geotagging)
BACKEND_FILE = Simulink.Parameter(1, StorageClass="Const", DataType="uint8")
BACKEND_MAVLINK = Simulink.Parameter(2, StorageClass="Const", DataType="uint8")
BACKEND_ALL = Simulink.Parameter(3, StorageClass="Const", DataType="uint8")

LOGGER_STATUS = enum(AddClassNameToEnumNames=true)
  LOGGER_TYPE_FULL = 0  % # Normal, full size log
  LOGGER_TYPE_MISSION = 1  % # reduced mission log (e.g. for geotagging)
  BACKEND_FILE = 1
  BACKEND_MAVLINK = 2
  BACKEND_ALL = 3

MAX_MAGS = Simulink.Parameter(4, StorageClass="Const", DataType="uint8")

MAG_WORKER_DATA = enum(AddClassNameToEnumNames=true)
  MAX_MAGS = 4

SOURCE_UNKNOWN = Simulink.Parameter(0, StorageClass="Const", DataType="uint8")
SOURCE_RC = Simulink.Parameter(1, StorageClass="Const", DataType="uint8")  % # radio control (input_rc)
SOURCE_MAVLINK_0 = Simulink.Parameter(2, StorageClass="Const", DataType="uint8")  % # mavlink instance 0
SOURCE_MAVLINK_1 = Simulink.Parameter(3, StorageClass="Const", DataType="uint8")  % # mavlink instance 1
SOURCE_MAVLINK_2 = Simulink.Parameter(4, StorageClass="Const", DataType="uint8")  % # mavlink instance 2
SOURCE_MAVLINK_3 = Simulink.Parameter(5, StorageClass="Const", DataType="uint8")  % # mavlink instance 3
SOURCE_MAVLINK_4 = Simulink.Parameter(6, StorageClass="Const", DataType="uint8")  % # mavlink instance 4
SOURCE_MAVLINK_5 = Simulink.Parameter(7, StorageClass="Const", DataType="uint8")  % # mavlink instance 5

MANUAL_CONTROL_SETPOINT = enum(AddClassNameToEnumNames=true)
  SOURCE_UNKNOWN = 0
  SOURCE_RC = 1  % # radio control (input_rc)
  SOURCE_MAVLINK_0 = 2  % # mavlink instance 0
  SOURCE_MAVLINK_1 = 3  % # mavlink instance 1
  SOURCE_MAVLINK_2 = 4  % # mavlink instance 2
  SOURCE_MAVLINK_3 = 5  % # mavlink instance 3
  SOURCE_MAVLINK_4 = 6  % # mavlink instance 4
  SOURCE_MAVLINK_5 = 7  % # mavlink instance 5

SWITCH_POS_NONE = Simulink.Parameter(0, StorageClass="Const", DataType="uint8")  % # switch is not mapped
SWITCH_POS_ON = Simulink.Parameter(1, StorageClass="Const", DataType="uint8")  % # switch activated (value = 1)
SWITCH_POS_MIDDLE = Simulink.Parameter(2, StorageClass="Const", DataType="uint8")  % # middle position (value = 0)
SWITCH_POS_OFF = Simulink.Parameter(3, StorageClass="Const", DataType="uint8")  % # switch not activated (value = -1)
MODE_SLOT_NONE = Simulink.Parameter(0, StorageClass="Const", DataType="uint8")  % # no mode slot assigned
MODE_SLOT_1 = Simulink.Parameter(1, StorageClass="Const", DataType="uint8")  % # mode slot 1 selected
MODE_SLOT_2 = Simulink.Parameter(2, StorageClass="Const", DataType="uint8")  % # mode slot 2 selected
MODE_SLOT_3 = Simulink.Parameter(3, StorageClass="Const", DataType="uint8")  % # mode slot 3 selected
MODE_SLOT_4 = Simulink.Parameter(4, StorageClass="Const", DataType="uint8")  % # mode slot 4 selected
MODE_SLOT_5 = Simulink.Parameter(5, StorageClass="Const", DataType="uint8")  % # mode slot 5 selected
MODE_SLOT_6 = Simulink.Parameter(6, StorageClass="Const", DataType="uint8")  % # mode slot 6 selected
MODE_SLOT_NUM = Simulink.Parameter(6, StorageClass="Const", DataType="uint8")  % # number of slots

MANUAL_CONTROL_SWITCHES = enum(AddClassNameToEnumNames=true)
  SWITCH_POS_NONE = 0  % # switch is not mapped
  SWITCH_POS_ON = 1  % # switch activated (value = 1)
  SWITCH_POS_MIDDLE = 2  % # middle position (value = 0)
  SWITCH_POS_OFF = 3  % # switch not activated (value = -1)
  MODE_SLOT_NONE = 0  % # no mode slot assigned
  MODE_SLOT_1 = 1  % # mode slot 1 selected
  MODE_SLOT_2 = 2  % # mode slot 2 selected
  MODE_SLOT_3 = 3  % # mode slot 3 selected
  MODE_SLOT_4 = 4  % # mode slot 4 selected
  MODE_SLOT_5 = 5  % # mode slot 5 selected
  MODE_SLOT_6 = 6  % # mode slot 6 selected
  MODE_SLOT_NUM = 6  % # number of slots

MAVLINK_LOG = enum(AddClassNameToEnumNames=true)
  ORB_QUEUE_LENGTH = 8

MAV_TUNNEL_PAYLOAD_TYPE_UNKNOWN = Simulink.Parameter(0, StorageClass="Const", DataType="uint8")  % # Encoding of payload unknown
MAV_TUNNEL_PAYLOAD_TYPE_STORM32_RESERVED0 = Simulink.Parameter(200, StorageClass="Const", DataType="uint8")  % # Registered for STorM32 gimbal controller
MAV_TUNNEL_PAYLOAD_TYPE_STORM32_RESERVED1 = Simulink.Parameter(201, StorageClass="Const", DataType="uint8")  % # Registered for STorM32 gimbal controller
MAV_TUNNEL_PAYLOAD_TYPE_STORM32_RESERVED2 = Simulink.Parameter(202, StorageClass="Const", DataType="uint8")  % # Registered for STorM32 gimbal controller
MAV_TUNNEL_PAYLOAD_TYPE_STORM32_RESERVED3 = Simulink.Parameter(203, StorageClass="Const", DataType="uint8")  % # Registered for STorM32 gimbal controller
MAV_TUNNEL_PAYLOAD_TYPE_STORM32_RESERVED4 = Simulink.Parameter(204, StorageClass="Const", DataType="uint8")  % # Registered for STorM32 gimbal controller
MAV_TUNNEL_PAYLOAD_TYPE_STORM32_RESERVED5 = Simulink.Parameter(205, StorageClass="Const", DataType="uint8")  % # Registered for STorM32 gimbal controller
MAV_TUNNEL_PAYLOAD_TYPE_STORM32_RESERVED6 = Simulink.Parameter(206, StorageClass="Const", DataType="uint8")  % # Registered for STorM32 gimbal controller
MAV_TUNNEL_PAYLOAD_TYPE_STORM32_RESERVED7 = Simulink.Parameter(207, StorageClass="Const", DataType="uint8")  % # Registered for STorM32 gimbal controller
MAV_TUNNEL_PAYLOAD_TYPE_STORM32_RESERVED8 = Simulink.Parameter(208, StorageClass="Const", DataType="uint8")  % # Registered for STorM32 gimbal controller
MAV_TUNNEL_PAYLOAD_TYPE_STORM32_RESERVED9 = Simulink.Parameter(209, StorageClass="Const", DataType="uint8")  % # Registered for STorM32 gimbal controller

MAVLINK_TUNNEL = enum(AddClassNameToEnumNames=true)
  MAV_TUNNEL_PAYLOAD_TYPE_UNKNOWN = 0  % # Encoding of payload unknown
  MAV_TUNNEL_PAYLOAD_TYPE_STORM32_RESERVED0 = 200  % # Registered for STorM32 gimbal controller
  MAV_TUNNEL_PAYLOAD_TYPE_STORM32_RESERVED1 = 201  % # Registered for STorM32 gimbal controller
  MAV_TUNNEL_PAYLOAD_TYPE_STORM32_RESERVED2 = 202  % # Registered for STorM32 gimbal controller
  MAV_TUNNEL_PAYLOAD_TYPE_STORM32_RESERVED3 = 203  % # Registered for STorM32 gimbal controller
  MAV_TUNNEL_PAYLOAD_TYPE_STORM32_RESERVED4 = 204  % # Registered for STorM32 gimbal controller
  MAV_TUNNEL_PAYLOAD_TYPE_STORM32_RESERVED5 = 205  % # Registered for STorM32 gimbal controller
  MAV_TUNNEL_PAYLOAD_TYPE_STORM32_RESERVED6 = 206  % # Registered for STorM32 gimbal controller
  MAV_TUNNEL_PAYLOAD_TYPE_STORM32_RESERVED7 = 207  % # Registered for STorM32 gimbal controller
  MAV_TUNNEL_PAYLOAD_TYPE_STORM32_RESERVED8 = 208  % # Registered for STorM32 gimbal controller
  MAV_TUNNEL_PAYLOAD_TYPE_STORM32_RESERVED9 = 209  % # Registered for STorM32 gimbal controller

MISSION_EXECUTION_MODE_NORMAL = Simulink.Parameter(0, StorageClass="Const", DataType="uint8")  % # Execute the mission according to the planned items
MISSION_EXECUTION_MODE_REVERSE = Simulink.Parameter(1, StorageClass="Const", DataType="uint8")  % # Execute the mission in reverse order, ignoring commands and converting all waypoints to normal ones
MISSION_EXECUTION_MODE_FAST_FORWARD = Simulink.Parameter(2, StorageClass="Const", DataType="uint8")  % # Execute the mission as fast as possible, for example converting loiter waypoints to normal ones

MISSION_RESULT = enum(AddClassNameToEnumNames=true)
  MISSION_EXECUTION_MODE_NORMAL = 0  % # Execute the mission according to the planned items
  MISSION_EXECUTION_MODE_REVERSE = 1  % # Execute the mission in reverse order, ignoring commands and converting all waypoints to normal ones
  MISSION_EXECUTION_MODE_FAST_FORWARD = 2  % # Execute the mission as fast as possible, for example converting loiter waypoints to normal ones

RESULT_SUCCESS = Simulink.Parameter(0, StorageClass="Const", DataType="uint8")
RESULT_FAILURE_OTHER = Simulink.Parameter(100, StorageClass="Const", DataType="uint8")  % # Mode failed (generic error)

MODE_COMPLETED = enum(AddClassNameToEnumNames=true)
  RESULT_SUCCESS = 0
  RESULT_FAILURE_OTHER = 100  % # Mode failed (generic error)

MAV_FRAME_GLOBAL = Simulink.Parameter(0, StorageClass="Const", DataType="uint8")
MAV_FRAME_LOCAL_NED = Simulink.Parameter(1, StorageClass="Const", DataType="uint8")
MAV_FRAME_BODY_FRD = Simulink.Parameter(12, StorageClass="Const", DataType="uint8")

OBSTACLE_DISTANCE = enum(AddClassNameToEnumNames=true)
  MAV_FRAME_GLOBAL = 0
  MAV_FRAME_LOCAL_NED = 1
  MAV_FRAME_BODY_FRD = 12
  MAV_DISTANCE_SENSOR_LASER = 0
  MAV_DISTANCE_SENSOR_ULTRASOUND = 1
  MAV_DISTANCE_SENSOR_INFRARED = 2
  MAV_DISTANCE_SENSOR_RADAR = 3

ORBIT_YAW_BEHAVIOUR_HOLD_FRONT_TO_CIRCLE_CENTER = Simulink.Parameter(0, StorageClass="Const", DataType="uint8")
ORBIT_YAW_BEHAVIOUR_HOLD_INITIAL_HEADING = Simulink.Parameter(1, StorageClass="Const", DataType="uint8")
ORBIT_YAW_BEHAVIOUR_UNCONTROLLED = Simulink.Parameter(2, StorageClass="Const", DataType="uint8")
ORBIT_YAW_BEHAVIOUR_HOLD_FRONT_TANGENT_TO_CIRCLE = Simulink.Parameter(3, StorageClass="Const", DataType="uint8")
ORBIT_YAW_BEHAVIOUR_RC_CONTROLLED = Simulink.Parameter(4, StorageClass="Const", DataType="uint8")

ORBIT_STATUS = enum(AddClassNameToEnumNames=true)
  ORBIT_YAW_BEHAVIOUR_HOLD_FRONT_TO_CIRCLE_CENTER = 0
  ORBIT_YAW_BEHAVIOUR_HOLD_INITIAL_HEADING = 1
  ORBIT_YAW_BEHAVIOUR_UNCONTROLLED = 2
  ORBIT_YAW_BEHAVIOUR_HOLD_FRONT_TANGENT_TO_CIRCLE = 3
  ORBIT_YAW_BEHAVIOUR_RC_CONTROLLED = 4

NOT_ABORTED = Simulink.Parameter(0, StorageClass="Const", DataType="uint8")
ABORTED_BY_OPERATOR = Simulink.Parameter(1, StorageClass="Const", DataType="uint8")
TERRAIN_NOT_FOUND = Simulink.Parameter(2, StorageClass="Const", DataType="uint8")  % # FW_LND_ABORT (1 << 0)
TERRAIN_TIMEOUT = Simulink.Parameter(3, StorageClass="Const", DataType="uint8")  % # FW_LND_ABORT (1 << 1)
UNKNOWN_ABORT_CRITERION = Simulink.Parameter(4, StorageClass="Const", DataType="uint8")

POSITION_CONTROLLER_LANDING_STATUS = enum(AddClassNameToEnumNames=true)
  NOT_ABORTED = 0
  ABORTED_BY_OPERATOR = 1
  TERRAIN_NOT_FOUND = 2  % # FW_LND_ABORT (1 << 0)
  TERRAIN_TIMEOUT = 3  % # FW_LND_ABORT (1 << 1)
  UNKNOWN_ABORT_CRITERION = 4

SETPOINT_TYPE_POSITION = Simulink.Parameter(0, StorageClass="Const", DataType="uint8")  % # position setpoint
SETPOINT_TYPE_VELOCITY = Simulink.Parameter(1, StorageClass="Const", DataType="uint8")  % # velocity setpoint
SETPOINT_TYPE_LOITER = Simulink.Parameter(2, StorageClass="Const", DataType="uint8")  % # loiter setpoint
SETPOINT_TYPE_TAKEOFF = Simulink.Parameter(3, StorageClass="Const", DataType="uint8")  % # takeoff setpoint
SETPOINT_TYPE_LAND = Simulink.Parameter(4, StorageClass="Const", DataType="uint8")  % # land setpoint, altitude must be ignored, descend until landing
SETPOINT_TYPE_IDLE = Simulink.Parameter(5, StorageClass="Const", DataType="uint8")  % # do nothing, switch off motors or keep at idle speed (MC)

POSITION_SETPOINT = enum(AddClassNameToEnumNames=true)
  SETPOINT_TYPE_POSITION = 0  % # position setpoint
  SETPOINT_TYPE_VELOCITY = 1  % # velocity setpoint
  SETPOINT_TYPE_LOITER = 2  % # loiter setpoint
  SETPOINT_TYPE_TAKEOFF = 3  % # takeoff setpoint
  SETPOINT_TYPE_LAND = 4  % # land setpoint, altitude must be ignored, descend until landing
  SETPOINT_TYPE_IDLE = 5  % # do nothing, switch off motors or keep at idle speed (MC)

PWR_BUTTON_STATE_IDEL = Simulink.Parameter(0, StorageClass="Const", DataType="uint8")  % # Button went up without meeting shutdown button down time (delete event)
PWR_BUTTON_STATE_DOWN = Simulink.Parameter(1, StorageClass="Const", DataType="uint8")  % # Button went Down
PWR_BUTTON_STATE_UP = Simulink.Parameter(2, StorageClass="Const", DataType="uint8")  % # Button went Up
PWR_BUTTON_STATE_REQUEST_SHUTDOWN = Simulink.Parameter(3, StorageClass="Const", DataType="uint8")  % # Button went Up after meeting shutdown button down time

POWER_BUTTON_STATE = enum(AddClassNameToEnumNames=true)
  PWR_BUTTON_STATE_IDEL = 0  % # Button went up without meeting shutdown button down time (delete event)
  PWR_BUTTON_STATE_DOWN = 1  % # Button went Down
  PWR_BUTTON_STATE_UP = 2  % # Button went Up
  PWR_BUTTON_STATE_REQUEST_SHUTDOWN = 3  % # Button went Up after meeting shutdown button down time

MAX_STRLEN = Simulink.Parameter(100, StorageClass="Const", DataType="uint32")

QSHELL_REQ = enum(AddClassNameToEnumNames=true)
  MAX_STRLEN = 100

FUNCTION_THROTTLE = Simulink.Parameter(0, StorageClass="Const", DataType="uint8")
FUNCTION_ROLL = Simulink.Parameter(1, StorageClass="Const", DataType="uint8")
FUNCTION_PITCH = Simulink.Parameter(2, StorageClass="Const", DataType="uint8")
FUNCTION_YAW = Simulink.Parameter(3, StorageClass="Const", DataType="uint8")
FUNCTION_RETURN = Simulink.Parameter(4, StorageClass="Const", DataType="uint8")
FUNCTION_LOITER = Simulink.Parameter(5, StorageClass="Const", DataType="uint8")
FUNCTION_OFFBOARD = Simulink.Parameter(6, StorageClass="Const", DataType="uint8")
FUNCTION_FLAPS = Simulink.Parameter(7, StorageClass="Const", DataType="uint8")
FUNCTION_AUX_1 = Simulink.Parameter(8, StorageClass="Const", DataType="uint8")
FUNCTION_AUX_2 = Simulink.Parameter(9, StorageClass="Const", DataType="uint8")
FUNCTION_AUX_3 = Simulink.Parameter(10, StorageClass="Const", DataType="uint8")
FUNCTION_AUX_4 = Simulink.Parameter(11, StorageClass="Const", DataType="uint8")
FUNCTION_AUX_5 = Simulink.Parameter(12, StorageClass="Const", DataType="uint8")
FUNCTION_AUX_6 = Simulink.Parameter(13, StorageClass="Const", DataType="uint8")
FUNCTION_PARAM_1 = Simulink.Parameter(14, StorageClass="Const", DataType="uint8")
FUNCTION_PARAM_2 = Simulink.Parameter(15, StorageClass="Const", DataType="uint8")
FUNCTION_PARAM_3_5 = Simulink.Parameter(16, StorageClass="Const", DataType="uint8")
FUNCTION_KILLSWITCH = Simulink.Parameter(17, StorageClass="Const", DataType="uint8")
FUNCTION_TRANSITION = Simulink.Parameter(18, StorageClass="Const", DataType="uint8")
FUNCTION_GEAR = Simulink.Parameter(19, StorageClass="Const", DataType="uint8")
FUNCTION_ARMSWITCH = Simulink.Parameter(20, StorageClass="Const", DataType="uint8")
FUNCTION_FLTBTN_SLOT_1 = Simulink.Parameter(21, StorageClass="Const", DataType="uint8")
FUNCTION_FLTBTN_SLOT_2 = Simulink.Parameter(22, StorageClass="Const", DataType="uint8")
FUNCTION_FLTBTN_SLOT_3 = Simulink.Parameter(23, StorageClass="Const", DataType="uint8")
FUNCTION_FLTBTN_SLOT_4 = Simulink.Parameter(24, StorageClass="Const", DataType="uint8")
FUNCTION_FLTBTN_SLOT_5 = Simulink.Parameter(25, StorageClass="Const", DataType="uint8")
FUNCTION_FLTBTN_SLOT_6 = Simulink.Parameter(26, StorageClass="Const", DataType="uint8")
FUNCTION_ENGAGE_MAIN_MOTOR = Simulink.Parameter(27, StorageClass="Const", DataType="uint8")
FUNCTION_FLTBTN_SLOT_COUNT = Simulink.Parameter(6, StorageClass="Const", DataType="uint8")

RC_CHANNELS = enum(AddClassNameToEnumNames=true)
  FUNCTION_THROTTLE = 0
  FUNCTION_ROLL = 1
  FUNCTION_PITCH = 2
  FUNCTION_YAW = 3
  FUNCTION_RETURN = 4
  FUNCTION_LOITER = 5
  FUNCTION_OFFBOARD = 6
  FUNCTION_FLAPS = 7
  FUNCTION_AUX_1 = 8
  FUNCTION_AUX_2 = 9
  FUNCTION_AUX_3 = 10
  FUNCTION_AUX_4 = 11
  FUNCTION_AUX_5 = 12
  FUNCTION_AUX_6 = 13
  FUNCTION_PARAM_1 = 14
  FUNCTION_PARAM_2 = 15
  FUNCTION_PARAM_3_5 = 16
  FUNCTION_KILLSWITCH = 17
  FUNCTION_TRANSITION = 18
  FUNCTION_GEAR = 19
  FUNCTION_ARMSWITCH = 20
  FUNCTION_FLTBTN_SLOT_1 = 21
  FUNCTION_FLTBTN_SLOT_2 = 22
  FUNCTION_FLTBTN_SLOT_3 = 23
  FUNCTION_FLTBTN_SLOT_4 = 24
  FUNCTION_FLTBTN_SLOT_5 = 25
  FUNCTION_FLTBTN_SLOT_6 = 26
  FUNCTION_ENGAGE_MAIN_MOTOR = 27
  FUNCTION_FLTBTN_SLOT_COUNT = 6

RC_PARAM_MAP_NCHAN = Simulink.Parameter(3, StorageClass="Const", DataType="uint8")  % # This limit is also hardcoded in the enum RC_CHANNELS_FUNCTION in rc_channels.h
PARAM_ID_LEN = Simulink.Parameter(16, StorageClass="Const", DataType="uint8")  % # corresponds to MAVLINK_MSG_PARAM_VALUE_FIELD_PARAM_ID_LEN

RC_PARAMETER_MAP = enum(AddClassNameToEnumNames=true)
  RC_PARAM_MAP_NCHAN = 3  % # This limit is also hardcoded in the enum RC_CHANNELS_FUNCTION in rc_channels.h
  PARAM_ID_LEN = 16  % # corresponds to MAVLINK_MSG_PARAM_VALUE_FIELD_PARAM_ID_LEN

SAT_INFO_MAX_SATELLITES = Simulink.Parameter(20, StorageClass="Const", DataType="uint8")

SATELLITE_INFO = enum(AddClassNameToEnumNames=true)
  SAT_INFO_MAX_SATELLITES = 20

SENSOR_ACCEL = enum(AddClassNameToEnumNames=true)
  ORB_QUEUE_LENGTH = 8

SENSOR_BARO = enum(AddClassNameToEnumNames=true)
  ORB_QUEUE_LENGTH = 4

CLIPPING_X = Simulink.Parameter(1, StorageClass="Const", DataType="uint8")
CLIPPING_Y = Simulink.Parameter(2, StorageClass="Const", DataType="uint8")
CLIPPING_Z = Simulink.Parameter(4, StorageClass="Const", DataType="uint8")

SENSOR_COMBINED = enum(AddClassNameToEnumNames=true)
  RELATIVE_TIMESTAMP_INVALID = 2147483647  % # (0x7fffffff) If one of the relative timestamps is set to this value, it means the associated sensor values are invalid
  CLIPPING_X = 1
  CLIPPING_Y = 2
  CLIPPING_Z = 4

JAMMING_STATE_UNKNOWN = Simulink.Parameter(0, StorageClass="Const", DataType="uint8")
JAMMING_STATE_OK = Simulink.Parameter(1, StorageClass="Const", DataType="uint8")
JAMMING_STATE_WARNING = Simulink.Parameter(2, StorageClass="Const", DataType="uint8")
JAMMING_STATE_CRITICAL = Simulink.Parameter(3, StorageClass="Const", DataType="uint8")
SPOOFING_STATE_UNKNOWN = Simulink.Parameter(0, StorageClass="Const", DataType="uint8")
SPOOFING_STATE_NONE = Simulink.Parameter(1, StorageClass="Const", DataType="uint8")
SPOOFING_STATE_INDICATED = Simulink.Parameter(2, StorageClass="Const", DataType="uint8")
SPOOFING_STATE_MULTIPLE = Simulink.Parameter(3, StorageClass="Const", DataType="uint8")

SENSOR_GPS = enum(AddClassNameToEnumNames=true)
  JAMMING_STATE_UNKNOWN = 0
  JAMMING_STATE_OK = 1
  JAMMING_STATE_WARNING = 2
  JAMMING_STATE_CRITICAL = 3
  SPOOFING_STATE_UNKNOWN = 0
  SPOOFING_STATE_NONE = 1
  SPOOFING_STATE_INDICATED = 2
  SPOOFING_STATE_MULTIPLE = 3

SENSOR_GYRO = enum(AddClassNameToEnumNames=true)
  ORB_QUEUE_LENGTH = 8

SENSOR_GYRO_FIFO = enum(AddClassNameToEnumNames=true)
  ORB_QUEUE_LENGTH = 4

SENSOR_MAG = enum(AddClassNameToEnumNames=true)
  ORB_QUEUE_LENGTH = 4

MODE_UNKNOWN = Simulink.Parameter(0, StorageClass="Const", DataType="uint8")
MODE_BRIGHT = Simulink.Parameter(1, StorageClass="Const", DataType="uint8")
MODE_LOWLIGHT = Simulink.Parameter(2, StorageClass="Const", DataType="uint8")
MODE_SUPER_LOWLIGHT = Simulink.Parameter(3, StorageClass="Const", DataType="uint8")

SENSOR_OPTICAL_FLOW = enum(AddClassNameToEnumNames=true)
  MODE_UNKNOWN = 0
  MODE_BRIGHT = 1
  MODE_LOWLIGHT = 2
  MODE_SUPER_LOWLIGHT = 3

BRICK1_VALID_SHIFTS = Simulink.Parameter(0, StorageClass="Const", DataType="uint8")
BRICK1_VALID_MASK = Simulink.Parameter(1, StorageClass="Const", DataType="uint8")
BRICK2_VALID_SHIFTS = Simulink.Parameter(1, StorageClass="Const", DataType="uint8")
BRICK2_VALID_MASK = Simulink.Parameter(2, StorageClass="Const", DataType="uint8")
BRICK3_VALID_SHIFTS = Simulink.Parameter(2, StorageClass="Const", DataType="uint8")
BRICK3_VALID_MASK = Simulink.Parameter(4, StorageClass="Const", DataType="uint8")
BRICK4_VALID_SHIFTS = Simulink.Parameter(3, StorageClass="Const", DataType="uint8")
BRICK4_VALID_MASK = Simulink.Parameter(8, StorageClass="Const", DataType="uint8")

SYSTEM_POWER = enum(AddClassNameToEnumNames=true)
  BRICK1_VALID_SHIFTS = 0
  BRICK1_VALID_MASK = 1
  BRICK2_VALID_SHIFTS = 1
  BRICK2_VALID_MASK = 2
  BRICK3_VALID_SHIFTS = 2
  BRICK3_VALID_MASK = 4
  BRICK4_VALID_SHIFTS = 3
  BRICK4_VALID_MASK = 8

TAKEOFF_STATE_UNINITIALIZED = Simulink.Parameter(0, StorageClass="Const", DataType="uint8")
TAKEOFF_STATE_DISARMED = Simulink.Parameter(1, StorageClass="Const", DataType="uint8")
TAKEOFF_STATE_SPOOLUP = Simulink.Parameter(2, StorageClass="Const", DataType="uint8")
TAKEOFF_STATE_READY_FOR_TAKEOFF = Simulink.Parameter(3, StorageClass="Const", DataType="uint8")
TAKEOFF_STATE_RAMPUP = Simulink.Parameter(4, StorageClass="Const", DataType="uint8")
TAKEOFF_STATE_FLIGHT = Simulink.Parameter(5, StorageClass="Const", DataType="uint8")

TAKEOFF_STATUS = enum(AddClassNameToEnumNames=true)
  TAKEOFF_STATE_UNINITIALIZED = 0
  TAKEOFF_STATE_DISARMED = 1
  TAKEOFF_STATE_SPOOLUP = 2
  TAKEOFF_STATE_READY_FOR_TAKEOFF = 3
  TAKEOFF_STATE_RAMPUP = 4
  TAKEOFF_STATE_FLIGHT = 5

TASK_STACK_INFO = enum(AddClassNameToEnumNames=true)
  ORB_QUEUE_LENGTH = 2

TECS_MODE_NORMAL = Simulink.Parameter(0, StorageClass="Const", DataType="uint8")
TECS_MODE_UNDERSPEED = Simulink.Parameter(1, StorageClass="Const", DataType="uint8")

TECS_STATUS = enum(AddClassNameToEnumNames=true)
  TECS_MODE_NORMAL = 0
  TECS_MODE_UNDERSPEED = 1

LINK_TYPE_GENERIC = Simulink.Parameter(0, StorageClass="Const", DataType="uint8")
LINK_TYPE_UBIQUITY_BULLET = Simulink.Parameter(1, StorageClass="Const", DataType="uint8")
LINK_TYPE_WIRE = Simulink.Parameter(2, StorageClass="Const", DataType="uint8")
LINK_TYPE_USB = Simulink.Parameter(3, StorageClass="Const", DataType="uint8")
LINK_TYPE_IRIDIUM = Simulink.Parameter(4, StorageClass="Const", DataType="uint8")
HEARTBEAT_TIMEOUT_US = Simulink.Parameter(2500000, StorageClass="Const", DataType="uint64")  % # Heartbeat timeout (tolerate missing 1 + jitter)

TELEMETRY_STATUS = enum(AddClassNameToEnumNames=true)
  LINK_TYPE_GENERIC = 0
  LINK_TYPE_UBIQUITY_BULLET = 1
  LINK_TYPE_WIRE = 2
  LINK_TYPE_USB = 3
  LINK_TYPE_IRIDIUM = 4
  HEARTBEAT_TIMEOUT_US = 2500000  % # Heartbeat timeout (tolerate missing 1 + jitter)

SOURCE_PROTOCOL_UNKNOWN = Simulink.Parameter(0, StorageClass="Const", DataType="uint8")
SOURCE_PROTOCOL_MAVLINK = Simulink.Parameter(1, StorageClass="Const", DataType="uint8")
SOURCE_PROTOCOL_DDS = Simulink.Parameter(2, StorageClass="Const", DataType="uint8")

TIMESYNC_STATUS = enum(AddClassNameToEnumNames=true)
  SOURCE_PROTOCOL_UNKNOWN = 0
  SOURCE_PROTOCOL_MAVLINK = 1
  SOURCE_PROTOCOL_DDS = 2

PX4_ADSB_FLAGS_VALID_COORDS = Simulink.Parameter(1, StorageClass="Const", DataType="uint16")
PX4_ADSB_FLAGS_VALID_ALTITUDE = Simulink.Parameter(2, StorageClass="Const", DataType="uint16")
PX4_ADSB_FLAGS_VALID_HEADING = Simulink.Parameter(4, StorageClass="Const", DataType="uint16")
PX4_ADSB_FLAGS_VALID_VELOCITY = Simulink.Parameter(8, StorageClass="Const", DataType="uint16")
PX4_ADSB_FLAGS_VALID_CALLSIGN = Simulink.Parameter(16, StorageClass="Const", DataType="uint16")
PX4_ADSB_FLAGS_VALID_SQUAWK = Simulink.Parameter(32, StorageClass="Const", DataType="uint16")
PX4_ADSB_FLAGS_RETRANSLATE = Simulink.Parameter(256, StorageClass="Const", DataType="uint16")
ADSB_EMITTER_TYPE_NO_INFO = Simulink.Parameter(0, StorageClass="Const", DataType="uint16")
ADSB_EMITTER_TYPE_LIGHT = Simulink.Parameter(1, StorageClass="Const", DataType="uint16")
ADSB_EMITTER_TYPE_SMALL = Simulink.Parameter(2, StorageClass="Const", DataType="uint16")
ADSB_EMITTER_TYPE_LARGE = Simulink.Parameter(3, StorageClass="Const", DataType="uint16")
ADSB_EMITTER_TYPE_HIGH_VORTEX_LARGE = Simulink.Parameter(4, StorageClass="Const", DataType="uint16")
ADSB_EMITTER_TYPE_HEAVY = Simulink.Parameter(5, StorageClass="Const", DataType="uint16")
ADSB_EMITTER_TYPE_HIGHLY_MANUV = Simulink.Parameter(6, StorageClass="Const", DataType="uint16")
ADSB_EMITTER_TYPE_ROTOCRAFT = Simulink.Parameter(7, StorageClass="Const", DataType="uint16")
ADSB_EMITTER_TYPE_UNASSIGNED = Simulink.Parameter(8, StorageClass="Const", DataType="uint16")
ADSB_EMITTER_TYPE_GLIDER = Simulink.Parameter(9, StorageClass="Const", DataType="uint16")
ADSB_EMITTER_TYPE_LIGHTER_AIR = Simulink.Parameter(10, StorageClass="Const", DataType="uint16")
ADSB_EMITTER_TYPE_PARACHUTE = Simulink.Parameter(11, StorageClass="Const", DataType="uint16")
ADSB_EMITTER_TYPE_ULTRA_LIGHT = Simulink.Parameter(12, StorageClass="Const", DataType="uint16")
ADSB_EMITTER_TYPE_UNASSIGNED2 = Simulink.Parameter(13, StorageClass="Const", DataType="uint16")
ADSB_EMITTER_TYPE_UAV = Simulink.Parameter(14, StorageClass="Const", DataType="uint16")
ADSB_EMITTER_TYPE_SPACE = Simulink.Parameter(15, StorageClass="Const", DataType="uint16")
ADSB_EMITTER_TYPE_UNASSGINED3 = Simulink.Parameter(16, StorageClass="Const", DataType="uint16")
ADSB_EMITTER_TYPE_EMERGENCY_SURFACE = Simulink.Parameter(17, StorageClass="Const", DataType="uint16")
ADSB_EMITTER_TYPE_SERVICE_SURFACE = Simulink.Parameter(18, StorageClass="Const", DataType="uint16")
ADSB_EMITTER_TYPE_POINT_OBSTACLE = Simulink.Parameter(19, StorageClass="Const", DataType="uint16")
ADSB_EMITTER_TYPE_ENUM_END = Simulink.Parameter(20, StorageClass="Const", DataType="uint16")

TRANSPONDER_REPORT = enum(AddClassNameToEnumNames=true)
  PX4_ADSB_FLAGS_VALID_COORDS = 1
  PX4_ADSB_FLAGS_VALID_ALTITUDE = 2
  PX4_ADSB_FLAGS_VALID_HEADING = 4
  PX4_ADSB_FLAGS_VALID_VELOCITY = 8
  PX4_ADSB_FLAGS_VALID_CALLSIGN = 16
  PX4_ADSB_FLAGS_VALID_SQUAWK = 32
  PX4_ADSB_FLAGS_RETRANSLATE = 256
  ADSB_EMITTER_TYPE_NO_INFO = 0
  ADSB_EMITTER_TYPE_LIGHT = 1
  ADSB_EMITTER_TYPE_SMALL = 2
  ADSB_EMITTER_TYPE_LARGE = 3
  ADSB_EMITTER_TYPE_HIGH_VORTEX_LARGE = 4
  ADSB_EMITTER_TYPE_HEAVY = 5
  ADSB_EMITTER_TYPE_HIGHLY_MANUV = 6
  ADSB_EMITTER_TYPE_ROTOCRAFT = 7
  ADSB_EMITTER_TYPE_UNASSIGNED = 8
  ADSB_EMITTER_TYPE_GLIDER = 9
  ADSB_EMITTER_TYPE_LIGHTER_AIR = 10
  ADSB_EMITTER_TYPE_PARACHUTE = 11
  ADSB_EMITTER_TYPE_ULTRA_LIGHT = 12
  ADSB_EMITTER_TYPE_UNASSIGNED2 = 13
  ADSB_EMITTER_TYPE_UAV = 14
  ADSB_EMITTER_TYPE_SPACE = 15
  ADSB_EMITTER_TYPE_UNASSGINED3 = 16
  ADSB_EMITTER_TYPE_EMERGENCY_SURFACE = 17
  ADSB_EMITTER_TYPE_SERVICE_SURFACE = 18
  ADSB_EMITTER_TYPE_POINT_OBSTACLE = 19
  ADSB_EMITTER_TYPE_ENUM_END = 20
  ORB_QUEUE_LENGTH = 8

TUNE_ID_STOP = Simulink.Parameter(0, StorageClass="Const", DataType="uint8")
TUNE_ID_STARTUP = Simulink.Parameter(1, StorageClass="Const", DataType="uint8")
TUNE_ID_ERROR = Simulink.Parameter(2, StorageClass="Const", DataType="uint8")
TUNE_ID_NOTIFY_POSITIVE = Simulink.Parameter(3, StorageClass="Const", DataType="uint8")
TUNE_ID_NOTIFY_NEUTRAL = Simulink.Parameter(4, StorageClass="Const", DataType="uint8")
TUNE_ID_NOTIFY_NEGATIVE = Simulink.Parameter(5, StorageClass="Const", DataType="uint8")
TUNE_ID_ARMING_WARNING = Simulink.Parameter(6, StorageClass="Const", DataType="uint8")
TUNE_ID_BATTERY_WARNING_SLOW = Simulink.Parameter(7, StorageClass="Const", DataType="uint8")
TUNE_ID_BATTERY_WARNING_FAST = Simulink.Parameter(8, StorageClass="Const", DataType="uint8")
TUNE_ID_GPS_WARNING = Simulink.Parameter(9, StorageClass="Const", DataType="uint8")
TUNE_ID_ARMING_FAILURE = Simulink.Parameter(10, StorageClass="Const", DataType="uint8")
TUNE_ID_PARACHUTE_RELEASE = Simulink.Parameter(11, StorageClass="Const", DataType="uint8")
TUNE_ID_SINGLE_BEEP = Simulink.Parameter(12, StorageClass="Const", DataType="uint8")
TUNE_ID_HOME_SET = Simulink.Parameter(13, StorageClass="Const", DataType="uint8")
TUNE_ID_SD_INIT = Simulink.Parameter(14, StorageClass="Const", DataType="uint8")
TUNE_ID_SD_ERROR = Simulink.Parameter(15, StorageClass="Const", DataType="uint8")
TUNE_ID_PROG_PX4IO = Simulink.Parameter(16, StorageClass="Const", DataType="uint8")
TUNE_ID_PROG_PX4IO_OK = Simulink.Parameter(17, StorageClass="Const", DataType="uint8")
TUNE_ID_PROG_PX4IO_ERR = Simulink.Parameter(18, StorageClass="Const", DataType="uint8")
TUNE_ID_POWER_OFF = Simulink.Parameter(19, StorageClass="Const", DataType="uint8")
NUMBER_OF_TUNES = Simulink.Parameter(20, StorageClass="Const", DataType="uint8")
VOLUME_LEVEL_MIN = Simulink.Parameter(0, StorageClass="Const", DataType="uint8")
VOLUME_LEVEL_DEFAULT = Simulink.Parameter(20, StorageClass="Const", DataType="uint8")
VOLUME_LEVEL_MAX = Simulink.Parameter(100, StorageClass="Const", DataType="uint8")

TUNE_CONTROL = enum(AddClassNameToEnumNames=true)
  TUNE_ID_STOP = 0
  TUNE_ID_STARTUP = 1
  TUNE_ID_ERROR = 2
  TUNE_ID_NOTIFY_POSITIVE = 3
  TUNE_ID_NOTIFY_NEUTRAL = 4
  TUNE_ID_NOTIFY_NEGATIVE = 5
  TUNE_ID_ARMING_WARNING = 6
  TUNE_ID_BATTERY_WARNING_SLOW = 7
  TUNE_ID_BATTERY_WARNING_FAST = 8
  TUNE_ID_GPS_WARNING = 9
  TUNE_ID_ARMING_FAILURE = 10
  TUNE_ID_PARACHUTE_RELEASE = 11
  TUNE_ID_SINGLE_BEEP = 12
  TUNE_ID_HOME_SET = 13
  TUNE_ID_SD_INIT = 14
  TUNE_ID_SD_ERROR = 15
  TUNE_ID_PROG_PX4IO = 16
  TUNE_ID_PROG_PX4IO_OK = 17
  TUNE_ID_PROG_PX4IO_ERR = 18
  TUNE_ID_POWER_OFF = 19
  NUMBER_OF_TUNES = 20
  VOLUME_LEVEL_MIN = 0
  VOLUME_LEVEL_DEFAULT = 20
  VOLUME_LEVEL_MAX = 100
  ORB_QUEUE_LENGTH = 4

MESSAGE_TYPE_PARAM_REQUEST_READ = Simulink.Parameter(20, StorageClass="Const", DataType="uint8")  % # MAVLINK_MSG_ID_PARAM_REQUEST_READ
MESSAGE_TYPE_PARAM_REQUEST_LIST = Simulink.Parameter(21, StorageClass="Const", DataType="uint8")  % # MAVLINK_MSG_ID_PARAM_REQUEST_LIST
MESSAGE_TYPE_PARAM_SET = Simulink.Parameter(23, StorageClass="Const", DataType="uint8")  % # MAVLINK_MSG_ID_PARAM_SET
NODE_ID_ALL = Simulink.Parameter(0, StorageClass="Const", DataType="uint8")  % # MAV_COMP_ID_ALL
PARAM_TYPE_UINT8 = Simulink.Parameter(1, StorageClass="Const", DataType="uint8")  % # MAV_PARAM_TYPE_UINT8
PARAM_TYPE_INT64 = Simulink.Parameter(8, StorageClass="Const", DataType="uint8")  % # MAV_PARAM_TYPE_INT64
PARAM_TYPE_REAL32 = Simulink.Parameter(9, StorageClass="Const", DataType="uint8")  % # MAV_PARAM_TYPE_REAL32

UAVCAN_PARAMETER_REQUEST = enum(AddClassNameToEnumNames=true)
  MESSAGE_TYPE_PARAM_REQUEST_READ = 20  % # MAVLINK_MSG_ID_PARAM_REQUEST_READ
  MESSAGE_TYPE_PARAM_REQUEST_LIST = 21  % # MAVLINK_MSG_ID_PARAM_REQUEST_LIST
  MESSAGE_TYPE_PARAM_SET = 23  % # MAVLINK_MSG_ID_PARAM_SET
  NODE_ID_ALL = 0  % # MAV_COMP_ID_ALL
  PARAM_TYPE_UINT8 = 1  % # MAV_PARAM_TYPE_UINT8
  PARAM_TYPE_INT64 = 8  % # MAV_PARAM_TYPE_INT64
  PARAM_TYPE_REAL32 = 9  % # MAV_PARAM_TYPE_REAL32
  ORB_QUEUE_LENGTH = 4

FLAGS_NEED_ACK = Simulink.Parameter(1, StorageClass="Const", DataType="uint8")  % # if set, this message requires to be acked.

ULOG_STREAM = enum(AddClassNameToEnumNames=true)
  FLAGS_NEED_ACK = 1  % # if set, this message requires to be acked.
  ORB_QUEUE_LENGTH = 16  % # TODO: we might be able to reduce this if mavlink polled on the topic

ACK_TIMEOUT = Simulink.Parameter(50, StorageClass="Const", DataType="int32")  % # timeout waiting for an ack until we retry to send the message [ms]
ACK_MAX_TRIES = Simulink.Parameter(50, StorageClass="Const", DataType="int32")  % # maximum amount of tries to (re-)send a message, each time waiting ACK_TIMEOUT ms

ULOG_STREAM_ACK = enum(AddClassNameToEnumNames=true)
  ACK_TIMEOUT = 50  % # timeout waiting for an ack until we retry to send the message [ms]
  ACK_MAX_TRIES = 50  % # maximum amount of tries to (re-)send a message, each time waiting ACK_TIMEOUT ms

VEHICLE_CMD_CUSTOM_0 = Simulink.Parameter(0, StorageClass="Const", DataType="uint16")  % # test command
VEHICLE_CMD_CUSTOM_1 = Simulink.Parameter(1, StorageClass="Const", DataType="uint16")  % # test command
VEHICLE_CMD_CUSTOM_2 = Simulink.Parameter(2, StorageClass="Const", DataType="uint16")  % # test command
VEHICLE_CMD_NAV_WAYPOINT = Simulink.Parameter(16, StorageClass="Const", DataType="uint16")  % # Navigate to MISSION. |Hold time in decimal seconds. (ignored by fixed wing, time to stay at MISSION for rotary wing)| Acceptance radius in meters (if the sphere with this radius is hit, the MISSION counts as reached)| 0 to pass through the WP, if > 0 radius in meters to pass by WP. Positive value for clockwise orbit, negative value for counter-clockwise orbit. Allows trajectory control.| Desired yaw angle at MISSION (rotary wing)| Latitude| Longitude| Altitude|
VEHICLE_CMD_NAV_LOITER_UNLIM = Simulink.Parameter(17, StorageClass="Const", DataType="uint16")  % # Loiter around this MISSION an unlimited amount of time |Empty| Empty| Radius around MISSION, in meters. If positive loiter clockwise, else counter-clockwise| Desired yaw angle.| Latitude| Longitude| Altitude|
VEHICLE_CMD_NAV_LOITER_TURNS = Simulink.Parameter(18, StorageClass="Const", DataType="uint16")  % # Loiter around this MISSION for X turns |Turns| Empty| Radius around MISSION, in meters. If positive loiter clockwise, else counter-clockwise| Desired yaw angle.| Latitude| Longitude| Altitude|
VEHICLE_CMD_NAV_LOITER_TIME = Simulink.Parameter(19, StorageClass="Const", DataType="uint16")  % # Loiter around this MISSION for X seconds |Seconds (decimal)| Empty| Radius around MISSION, in meters. If positive loiter clockwise, else counter-clockwise| Desired yaw angle.| Latitude| Longitude| Altitude|
VEHICLE_CMD_NAV_RETURN_TO_LAUNCH = Simulink.Parameter(20, StorageClass="Const", DataType="uint16")  % # Return to launch location |Empty| Empty| Empty| Empty| Empty| Empty| Empty|
VEHICLE_CMD_NAV_LAND = Simulink.Parameter(21, StorageClass="Const", DataType="uint16")  % # Land at location |Empty| Empty| Empty| Desired yaw angle.| Latitude| Longitude| Altitude|
VEHICLE_CMD_NAV_TAKEOFF = Simulink.Parameter(22, StorageClass="Const", DataType="uint16")  % # Takeoff from ground / hand |Minimum pitch (if airspeed sensor present), desired pitch without sensor| Empty| Empty| Yaw angle (if magnetometer present), ignored without magnetometer| Latitude| Longitude| Altitude|
VEHICLE_CMD_NAV_PRECLAND = Simulink.Parameter(23, StorageClass="Const", DataType="uint16")  % # Attempt a precision landing
VEHICLE_CMD_DO_ORBIT = Simulink.Parameter(34, StorageClass="Const", DataType="uint16")  % # Start orbiting on the circumference of a circle defined by the parameters. |Radius [m] |Velocity [m/s] |Yaw behaviour |Empty |Latitude/X |Longitude/Y |Altitude/Z |
VEHICLE_CMD_NAV_ROI = Simulink.Parameter(80, StorageClass="Const", DataType="uint16")  % # Sets the region of interest (ROI) for a sensor set or the vehicle itself. This can then be used by the vehicles control system to control the vehicle attitude and the attitude of various sensors such as cameras. |Region of interest mode. (see MAV_ROI enum)| MISSION index/ target ID. (see MAV_ROI enum)| ROI index (allows a vehicle to manage multiple ROI's)| Empty| x the location of the fixed ROI (see MAV_FRAME)| y| z|
VEHICLE_CMD_NAV_PATHPLANNING = Simulink.Parameter(81, StorageClass="Const", DataType="uint16")  % # Control autonomous path planning on the MAV. |0: Disable local obstacle avoidance / local path planning (without resetting map), 1: Enable local path planning, 2: Enable and reset local path planning| 0: Disable full path planning (without resetting map), 1: Enable, 2: Enable and reset map/occupancy grid, 3: Enable and reset planned route, but not occupancy grid| Empty| Yaw angle at goal, in compass degrees, [0..360]| Latitude/X of goal| Longitude/Y of goal| Altitude/Z of goal|
VEHICLE_CMD_NAV_VTOL_TAKEOFF = Simulink.Parameter(84, StorageClass="Const", DataType="uint16")  % # Takeoff from ground / hand and transition to fixed wing |Minimum pitch (if airspeed sensor present), desired pitch without sensor| Empty| Empty| Yaw angle (if magnetometer present), ignored without magnetometer| Latitude| Longitude| Altitude|
VEHICLE_CMD_NAV_VTOL_LAND = Simulink.Parameter(85, StorageClass="Const", DataType="uint16")  % # Transition to MC and land at location |Empty| Empty| Empty| Desired yaw angle.| Latitude| Longitude| Altitude|
VEHICLE_CMD_NAV_GUIDED_LIMITS = Simulink.Parameter(90, StorageClass="Const", DataType="uint16")  % # set limits for external control |timeout - maximum time (in seconds) that external controller will be allowed to control vehicle. 0 means no timeout| absolute altitude min (in meters, AMSL) - if vehicle moves below this alt, the command will be aborted and the mission will continue.  0 means no lower altitude limit| absolute altitude max (in meters)- if vehicle moves above this alt, the command will be aborted and the mission will continue.  0 means no upper altitude limit| horizontal move limit (in meters, AMSL) - if vehicle moves more than this distance from it's location at the moment the command was executed, the command will be aborted and the mission will continue. 0 means no horizontal altitude limit| Empty| Empty| Empty|
VEHICLE_CMD_NAV_GUIDED_MASTER = Simulink.Parameter(91, StorageClass="Const", DataType="uint16")  % # set id of master controller |System ID| Component ID| Empty| Empty| Empty| Empty| Empty|
VEHICLE_CMD_NAV_DELAY = Simulink.Parameter(93, StorageClass="Const", DataType="uint16")  % # Delay the next navigation command a number of seconds or until a specified time |Delay in seconds (decimal, -1 to enable time-of-day fields)| hour (24h format, UTC, -1 to ignore)| minute (24h format, UTC, -1 to ignore)| second (24h format, UTC)| Empty| Empty| Empty|
VEHICLE_CMD_NAV_LAST = Simulink.Parameter(95, StorageClass="Const", DataType="uint16")  % # NOP - This command is only used to mark the upper limit of the NAV/ACTION commands in the enumeration |Empty| Empty| Empty| Empty| Empty| Empty| Empty|
VEHICLE_CMD_CONDITION_DELAY = Simulink.Parameter(112, StorageClass="Const", DataType="uint16")  % # Delay mission state machine. |Delay in seconds (decimal)| Empty| Empty| Empty| Empty| Empty| Empty|
VEHICLE_CMD_CONDITION_CHANGE_ALT = Simulink.Parameter(113, StorageClass="Const", DataType="uint16")  % # Ascend/descend at rate.  Delay mission state machine until desired altitude reached. |Descent / Ascend rate (m/s)| Empty| Empty| Empty| Empty| Empty| Finish Altitude|
VEHICLE_CMD_CONDITION_DISTANCE = Simulink.Parameter(114, StorageClass="Const", DataType="uint16")  % # Delay mission state machine until within desired distance of next NAV point. |Distance (meters)| Empty| Empty| Empty| Empty| Empty| Empty|
VEHICLE_CMD_CONDITION_YAW = Simulink.Parameter(115, StorageClass="Const", DataType="uint16")  % # Reach a certain target angle. |target angle: [0-360], 0 is north| speed during yaw change:[deg per second]| direction: negative: counter clockwise, positive: clockwise [-1,1]| relative offset or absolute angle: [ 1,0]| Empty| Empty| Empty|
VEHICLE_CMD_CONDITION_LAST = Simulink.Parameter(159, StorageClass="Const", DataType="uint16")  % # NOP - This command is only used to mark the upper limit of the CONDITION commands in the enumeration |Empty| Empty| Empty| Empty| Empty| Empty| Empty|
VEHICLE_CMD_CONDITION_GATE = Simulink.Parameter(4501, StorageClass="Const", DataType="uint16")  % # Wait until passing a threshold |2D coord mode: 0: Orthogonal to planned route | Altitude mode: 0: Ignore altitude| Empty| Empty| Lat| Lon| Alt|
VEHICLE_CMD_DO_SET_MODE = Simulink.Parameter(176, StorageClass="Const", DataType="uint16")  % # Set system mode. |Mode, as defined by ENUM MAV_MODE| Empty| Empty| Empty| Empty| Empty| Empty|
VEHICLE_CMD_DO_JUMP = Simulink.Parameter(177, StorageClass="Const", DataType="uint16")  % # Jump to the desired command in the mission list.  Repeat this action only the specified number of times |Sequence number| Repeat count| Empty| Empty| Empty| Empty| Empty|
VEHICLE_CMD_DO_CHANGE_SPEED = Simulink.Parameter(178, StorageClass="Const", DataType="uint16")  % # Change speed and/or throttle set points. |Speed type (0=Airspeed, 1=Ground Speed)| Speed  (m/s, -1 indicates no change)| Throttle  ( Percent, -1 indicates no change)| Empty| Empty| Empty| Empty|
VEHICLE_CMD_DO_SET_HOME = Simulink.Parameter(179, StorageClass="Const", DataType="uint16")  % # Changes the home location either to the current location or a specified location. |Use current (1=use current location, 0=use specified location)| Empty| Empty| Empty| Latitude| Longitude| Altitude|
VEHICLE_CMD_DO_SET_PARAMETER = Simulink.Parameter(180, StorageClass="Const", DataType="uint16")  % # Set a system parameter.  Caution!  Use of this command requires knowledge of the numeric enumeration value of the parameter. |Parameter number| Parameter value| Empty| Empty| Empty| Empty| Empty|
VEHICLE_CMD_DO_SET_RELAY = Simulink.Parameter(181, StorageClass="Const", DataType="uint16")  % # Set a relay to a condition. |Relay number| Setting (1=on, 0=off, others possible depending on system hardware)| Empty| Empty| Empty| Empty| Empty|
VEHICLE_CMD_DO_REPEAT_RELAY = Simulink.Parameter(182, StorageClass="Const", DataType="uint16")  % # Cycle a relay on and off for a desired number of cycles with a desired period. |Relay number| Cycle count| Cycle time (seconds, decimal)| Empty| Empty| Empty| Empty|
VEHICLE_CMD_DO_REPEAT_SERVO = Simulink.Parameter(184, StorageClass="Const", DataType="uint16")  % # Cycle a between its nominal setting and a desired PWM for a desired number of cycles with a desired period. |Servo number| PWM (microseconds, 1000 to 2000 typical)| Cycle count| Cycle time (seconds)| Empty| Empty| Empty|
VEHICLE_CMD_DO_FLIGHTTERMINATION = Simulink.Parameter(185, StorageClass="Const", DataType="uint16")  % # Terminate flight immediately |Flight termination activated if > 0.5| Empty| Empty| Empty| Empty| Empty| Empty|
VEHICLE_CMD_DO_CHANGE_ALTITUDE = Simulink.Parameter(186, StorageClass="Const", DataType="uint16")  % # Set the vehicle to Loiter mode and change the altitude to specified value |Altitude| Frame of new altitude | Empty| Empty| Empty| Empty| Empty|
VEHICLE_CMD_DO_SET_ACTUATOR = Simulink.Parameter(187, StorageClass="Const", DataType="uint16")  % # Sets actuators (e.g. servos) to a desired value. |Actuator 1| Actuator 2| Actuator 3| Actuator 4| Actuator 5| Actuator 6| Index|
VEHICLE_CMD_DO_LAND_START = Simulink.Parameter(189, StorageClass="Const", DataType="uint16")  % # Mission command to perform a landing. This is used as a marker in a mission to tell the autopilot where a sequence of mission items that represents a landing starts. It may also be sent via a COMMAND_LONG to trigger a landing, in which case the nearest (geographically) landing sequence in the mission will be used. The Latitude/Longitude is optional, and may be set to 0/0 if not needed. If specified then it will be used to help find the closest landing sequence. |Empty| Empty| Empty| Empty| Latitude| Longitude| Empty|
VEHICLE_CMD_DO_GO_AROUND = Simulink.Parameter(191, StorageClass="Const", DataType="uint16")  % # Mission command to safely abort an autonomous landing. |Altitude (meters)| Empty| Empty| Empty| Empty| Empty| Empty|
VEHICLE_CMD_DO_REPOSITION = Simulink.Parameter(192, StorageClass="Const", DataType="uint16")
VEHICLE_CMD_DO_PAUSE_CONTINUE = Simulink.Parameter(193, StorageClass="Const", DataType="uint16")
VEHICLE_CMD_DO_SET_ROI_LOCATION = Simulink.Parameter(195, StorageClass="Const", DataType="uint16")  % # Sets the region of interest (ROI) to a location. This can then be used by the vehicles control system to control the vehicle attitude and the attitude of various sensors such as cameras. |Empty| Empty| Empty| Empty| Latitude| Longitude| Altitude|
VEHICLE_CMD_DO_SET_ROI_WPNEXT_OFFSET = Simulink.Parameter(196, StorageClass="Const", DataType="uint16")  % # Sets the region of interest (ROI) to be toward next waypoint, with optional pitch/roll/yaw offset. This can then be used by the vehicles control system to control the vehicle attitude and the attitude of various sensors such as cameras. |Empty| Empty| Empty| Empty| pitch offset from next waypoint| roll offset from next waypoint| yaw offset from next waypoint|
VEHICLE_CMD_DO_SET_ROI_NONE = Simulink.Parameter(197, StorageClass="Const", DataType="uint16")  % # Cancels any previous ROI command returning the vehicle/sensors to default flight characteristics. This can then be used by the vehicles control system to control the vehicle attitude and the attitude of various sensors such as cameras. |Empty| Empty| Empty| Empty| Empty| Empty| Empty|
VEHICLE_CMD_DO_CONTROL_VIDEO = Simulink.Parameter(200, StorageClass="Const", DataType="uint16")  % # Control onboard camera system. |Camera ID (-1 for all)| Transmission: 0: disabled, 1: enabled compressed, 2: enabled raw| Transmission mode: 0: video stream, >0: single images every n seconds (decimal)| Recording: 0: disabled, 1: enabled compressed, 2: enabled raw| Empty| Empty| Empty|
VEHICLE_CMD_DO_SET_ROI = Simulink.Parameter(201, StorageClass="Const", DataType="uint16")  % # Sets the region of interest (ROI) for a sensor set or the vehicle itself. This can then be used by the vehicles control system to control the vehicle attitude and the attitude of various sensors such as cameras. |Region of interest mode. (see MAV_ROI enum)| MISSION index/ target ID. (see MAV_ROI enum)| ROI index (allows a vehicle to manage multiple ROI's)| Empty| x the location of the fixed ROI (see MAV_FRAME)| y| z|
VEHICLE_CMD_DO_DIGICAM_CONTROL = Simulink.Parameter(203, StorageClass="Const", DataType="uint16")
VEHICLE_CMD_DO_MOUNT_CONFIGURE = Simulink.Parameter(204, StorageClass="Const", DataType="uint16")  % # Mission command to configure a camera or antenna mount |Mount operation mode (see MAV_MOUNT_MODE enum)| stabilize roll? (1 = yes, 0 = no)| stabilize pitch? (1 = yes, 0 = no)| stabilize yaw? (1 = yes, 0 = no)| Empty| Empty| Empty|
VEHICLE_CMD_DO_MOUNT_CONTROL = Simulink.Parameter(205, StorageClass="Const", DataType="uint16")  % # Mission command to control a camera or antenna mount |pitch or lat in degrees, depending on mount mode.| roll or lon in degrees depending on mount mode| yaw or alt (in meters) depending on mount mode| reserved| reserved| reserved| MAV_MOUNT_MODE enum value|
VEHICLE_CMD_DO_SET_CAM_TRIGG_DIST = Simulink.Parameter(206, StorageClass="Const", DataType="uint16")  % # Mission command to set TRIG_DIST for this flight |Camera trigger distance (meters)| Shutter integration time (ms)| Empty| Empty| Empty| Empty| Empty|
VEHICLE_CMD_DO_FENCE_ENABLE = Simulink.Parameter(207, StorageClass="Const", DataType="uint16")  % # Mission command to enable the geofence |enable? (0=disable, 1=enable)| Empty| Empty| Empty| Empty| Empty| Empty|
VEHICLE_CMD_DO_PARACHUTE = Simulink.Parameter(208, StorageClass="Const", DataType="uint16")  % # Mission command to trigger a parachute |action (0=disable, 1=enable, 2=release, for some systems see PARACHUTE_ACTION enum, not in general message set.)| Empty| Empty| Empty| Empty| Empty| Empty|
VEHICLE_CMD_DO_MOTOR_TEST = Simulink.Parameter(209, StorageClass="Const", DataType="uint16")  % # motor test command |Instance (1, ...)| throttle type| throttle| timeout [s]| Motor count | Test order| Empty|
VEHICLE_CMD_DO_INVERTED_FLIGHT = Simulink.Parameter(210, StorageClass="Const", DataType="uint16")  % # Change to/from inverted flight |inverted (0=normal, 1=inverted)| Empty| Empty| Empty| Empty| Empty| Empty|
VEHICLE_CMD_DO_GRIPPER = Simulink.Parameter(211, StorageClass="Const", DataType="uint16")  % # Command to operate a gripper
VEHICLE_CMD_DO_SET_CAM_TRIGG_INTERVAL = Simulink.Parameter(214, StorageClass="Const", DataType="uint16")  % # Mission command to set TRIG_INTERVAL for this flight |Camera trigger distance (meters)| Shutter integration time (ms)| Empty| Empty| Empty| Empty| Empty|
VEHICLE_CMD_DO_MOUNT_CONTROL_QUAT = Simulink.Parameter(220, StorageClass="Const", DataType="uint16")  % # Mission command to control a camera or antenna mount, using a quaternion as reference. |q1 - quaternion param #1, w (1 in null-rotation)| q2 - quaternion param #2, x (0 in null-rotation)| q3 - quaternion param #3, y (0 in null-rotation)| q4 - quaternion param #4, z (0 in null-rotation)| Empty| Empty| Empty|
VEHICLE_CMD_DO_GUIDED_MASTER = Simulink.Parameter(221, StorageClass="Const", DataType="uint16")  % # set id of master controller |System ID| Component ID| Empty| Empty| Empty| Empty| Empty|
VEHICLE_CMD_DO_GUIDED_LIMITS = Simulink.Parameter(222, StorageClass="Const", DataType="uint16")  % # set limits for external control |timeout - maximum time (in seconds) that external controller will be allowed to control vehicle. 0 means no timeout| absolute altitude min (in meters, AMSL) - if vehicle moves below this alt, the command will be aborted and the mission will continue.  0 means no lower altitude limit| absolute altitude max (in meters)- if vehicle moves above this alt, the command will be aborted and the mission will continue.  0 means no upper altitude limit| horizontal move limit (in meters, AMSL) - if vehicle moves more than this distance from it's location at the moment the command was executed, the command will be aborted and the mission will continue. 0 means no horizontal altitude limit| Empty| Empty| Empty|
VEHICLE_CMD_DO_LAST = Simulink.Parameter(240, StorageClass="Const", DataType="uint16")  % # NOP - This command is only used to mark the upper limit of the DO commands in the enumeration |Empty| Empty| Empty| Empty| Empty| Empty| Empty|
VEHICLE_CMD_PREFLIGHT_CALIBRATION = Simulink.Parameter(241, StorageClass="Const", DataType="uint16")  % # Trigger calibration. This command will be only accepted if in pre-flight mode. See mavlink spec MAV_CMD_PREFLIGHT_CALIBRATION
PREFLIGHT_CALIBRATION_TEMPERATURE_CALIBRATION = Simulink.Parameter(3, StorageClass="Const", DataType="uint16")  % # param value for VEHICLE_CMD_PREFLIGHT_CALIBRATION to start temperature calibration
VEHICLE_CMD_PREFLIGHT_SET_SENSOR_OFFSETS = Simulink.Parameter(242, StorageClass="Const", DataType="uint16")  % # Set sensor offsets. This command will be only accepted if in pre-flight mode. |Sensor to adjust the offsets for: 0: gyros, 1: accelerometer, 2: magnetometer, 3: barometer, 4: optical flow| X axis offset (or generic dimension 1), in the sensor's raw units| Y axis offset (or generic dimension 2), in the sensor's raw units| Z axis offset (or generic dimension 3), in the sensor's raw units| Generic dimension 4, in the sensor's raw units| Generic dimension 5, in the sensor's raw units| Generic dimension 6, in the sensor's raw units|
VEHICLE_CMD_PREFLIGHT_UAVCAN = Simulink.Parameter(243, StorageClass="Const", DataType="uint16")  % # UAVCAN configuration. If param 1 == 1 actuator mapping and direction assignment should be started
VEHICLE_CMD_PREFLIGHT_STORAGE = Simulink.Parameter(245, StorageClass="Const", DataType="uint16")  % # Request storage of different parameter values and logs. This command will be only accepted if in pre-flight mode. |Parameter storage: 0: READ FROM FLASH/EEPROM, 1: WRITE CURRENT TO FLASH/EEPROM| Mission storage: 0: READ FROM FLASH/EEPROM, 1: WRITE CURRENT TO FLASH/EEPROM| Reserved| Reserved| Empty| Empty| Empty|
VEHICLE_CMD_PREFLIGHT_REBOOT_SHUTDOWN = Simulink.Parameter(246, StorageClass="Const", DataType="uint16")  % # Request the reboot or shutdown of system components. |0: Do nothing for autopilot, 1: Reboot autopilot, 2: Shutdown autopilot.| 0: Do nothing for onboard computer, 1: Reboot onboard computer, 2: Shutdown onboard computer.| Reserved| Reserved| Empty| Empty| Empty|
VEHICLE_CMD_OBLIQUE_SURVEY = Simulink.Parameter(260, StorageClass="Const", DataType="uint16")  % # Mission command to set a Camera Auto Mount Pivoting Oblique Survey for this flight|Camera trigger distance (meters)| Shutter integration time (ms)| Camera minimum trigger interval| Number of positions| Roll| Pitch| Empty|
VEHICLE_CMD_GIMBAL_DEVICE_INFORMATION = Simulink.Parameter(283, StorageClass="Const", DataType="uint16")  % # Command to ask information about a low level gimbal
VEHICLE_CMD_MISSION_START = Simulink.Parameter(300, StorageClass="Const", DataType="uint16")  % # start running a mission |first_item: the first mission item to run| last_item:  the last mission item to run (after this item is run, the mission ends)|
VEHICLE_CMD_ACTUATOR_TEST = Simulink.Parameter(310, StorageClass="Const", DataType="uint16")  % # Actuator testing command|value [-1,1]|timeout [s]|Empty|Empty|output function|
VEHICLE_CMD_CONFIGURE_ACTUATOR = Simulink.Parameter(311, StorageClass="Const", DataType="uint16")  % # Actuator configuration command|configuration|Empty|Empty|Empty|output function|
VEHICLE_CMD_COMPONENT_ARM_DISARM = Simulink.Parameter(400, StorageClass="Const", DataType="uint16")  % # Arms / Disarms a component |1 to arm, 0 to disarm
VEHICLE_CMD_RUN_PREARM_CHECKS = Simulink.Parameter(401, StorageClass="Const", DataType="uint16")  % # Instructs a target system to run pre-arm checks.
VEHICLE_CMD_INJECT_FAILURE = Simulink.Parameter(420, StorageClass="Const", DataType="uint16")  % # Inject artificial failure for testing purposes
VEHICLE_CMD_START_RX_PAIR = Simulink.Parameter(500, StorageClass="Const", DataType="uint16")  % # Starts receiver pairing |0:Spektrum| 0:Spektrum DSM2, 1:Spektrum DSMX|
VEHICLE_CMD_REQUEST_MESSAGE = Simulink.Parameter(512, StorageClass="Const", DataType="uint16")  % # Request to send a single instance of the specified message
VEHICLE_CMD_SET_CAMERA_MODE = Simulink.Parameter(530, StorageClass="Const", DataType="uint16")  % # Set camera capture mode (photo, video, etc.)
VEHICLE_CMD_SET_CAMERA_ZOOM = Simulink.Parameter(531, StorageClass="Const", DataType="uint16")  % # Set camera zoom
VEHICLE_CMD_SET_CAMERA_FOCUS = Simulink.Parameter(532, StorageClass="Const", DataType="uint16")
VEHICLE_CMD_DO_GIMBAL_MANAGER_PITCHYAW = Simulink.Parameter(1000, StorageClass="Const", DataType="uint16")  % # Setpoint to be sent to a gimbal manager to set a gimbal pitch and yaw
VEHICLE_CMD_DO_GIMBAL_MANAGER_CONFIGURE = Simulink.Parameter(1001, StorageClass="Const", DataType="uint16")  % # Gimbal configuration to set which sysid/compid is in primary and secondary control
VEHICLE_CMD_IMAGE_START_CAPTURE = Simulink.Parameter(2000, StorageClass="Const", DataType="uint16")  % # Start image capture sequence.
VEHICLE_CMD_DO_TRIGGER_CONTROL = Simulink.Parameter(2003, StorageClass="Const", DataType="uint16")  % # Enable or disable on-board camera triggering system
VEHICLE_CMD_VIDEO_START_CAPTURE = Simulink.Parameter(2500, StorageClass="Const", DataType="uint16")  % # Start a video capture.
VEHICLE_CMD_VIDEO_STOP_CAPTURE = Simulink.Parameter(2501, StorageClass="Const", DataType="uint16")  % # Stop the current video capture.
VEHICLE_CMD_LOGGING_START = Simulink.Parameter(2510, StorageClass="Const", DataType="uint16")  % # start streaming ULog data
VEHICLE_CMD_LOGGING_STOP = Simulink.Parameter(2511, StorageClass="Const", DataType="uint16")  % # stop streaming ULog data
VEHICLE_CMD_CONTROL_HIGH_LATENCY = Simulink.Parameter(2600, StorageClass="Const", DataType="uint16")  % # control starting/stopping transmitting data over the high latency link
VEHICLE_CMD_DO_VTOL_TRANSITION = Simulink.Parameter(3000, StorageClass="Const", DataType="uint16")  % # Command VTOL transition
VEHICLE_CMD_ARM_AUTHORIZATION_REQUEST = Simulink.Parameter(3001, StorageClass="Const", DataType="uint16")  % # Request arm authorization
VEHICLE_CMD_PAYLOAD_PREPARE_DEPLOY = Simulink.Parameter(30001, StorageClass="Const", DataType="uint16")  % # Prepare a payload deployment in the flight plan
VEHICLE_CMD_PAYLOAD_CONTROL_DEPLOY = Simulink.Parameter(30002, StorageClass="Const", DataType="uint16")  % # Control a pre-programmed payload deployment
VEHICLE_CMD_FIXED_MAG_CAL_YAW = Simulink.Parameter(42006, StorageClass="Const", DataType="uint16")  % # Magnetometer calibration based on provided known yaw. This allows for fast calibration using WMM field tables in the vehicle, given only the known yaw of the vehicle. If Latitude and longitude are both zero then use the current vehicle location.
VEHICLE_CMD_DO_WINCH = Simulink.Parameter(42600, StorageClass="Const", DataType="uint16")  % # Command to operate winch.
VEHICLE_CMD_PX4_INTERNAL_START = Simulink.Parameter(65537, StorageClass="Const", DataType="uint32")  % # start of PX4 internal only vehicle commands (> UINT16_MAX)
VEHICLE_CMD_SET_GPS_GLOBAL_ORIGIN = Simulink.Parameter(100000, StorageClass="Const", DataType="uint32")  % # Sets the GPS coordinates of the vehicle local origin (0,0,0) position. |Empty|Empty|Empty|Empty|Latitude|Longitude|Altitude|
VEHICLE_MOUNT_MODE_RETRACT = Simulink.Parameter(0, StorageClass="Const", DataType="uint8")  % # Load and keep safe position (Roll,Pitch,Yaw) from permanent memory and stop stabilization |
VEHICLE_MOUNT_MODE_NEUTRAL = Simulink.Parameter(1, StorageClass="Const", DataType="uint8")  % # Load and keep neutral position (Roll,Pitch,Yaw) from permanent memory. |
VEHICLE_MOUNT_MODE_MAVLINK_TARGETING = Simulink.Parameter(2, StorageClass="Const", DataType="uint8")  % # Load neutral position and start MAVLink Roll,Pitch,Yaw control with stabilization |
VEHICLE_MOUNT_MODE_RC_TARGETING = Simulink.Parameter(3, StorageClass="Const", DataType="uint8")  % # Load neutral position and start RC Roll,Pitch,Yaw control with stabilization |
VEHICLE_MOUNT_MODE_GPS_POINT = Simulink.Parameter(4, StorageClass="Const", DataType="uint8")  % # Load neutral position and start to point to Lat,Lon,Alt |
VEHICLE_MOUNT_MODE_ENUM_END = Simulink.Parameter(5, StorageClass="Const", DataType="uint8")  % #
VEHICLE_ROI_NONE = Simulink.Parameter(0, StorageClass="Const", DataType="uint8")  % # No region of interest |
VEHICLE_ROI_WPNEXT = Simulink.Parameter(1, StorageClass="Const", DataType="uint8")  % # Point toward next MISSION |
VEHICLE_ROI_WPINDEX = Simulink.Parameter(2, StorageClass="Const", DataType="uint8")  % # Point toward given MISSION |
VEHICLE_ROI_LOCATION = Simulink.Parameter(3, StorageClass="Const", DataType="uint8")  % # Point toward fixed location |
VEHICLE_ROI_TARGET = Simulink.Parameter(4, StorageClass="Const", DataType="uint8")  % # Point toward target
VEHICLE_ROI_ENUM_END = Simulink.Parameter(5, StorageClass="Const", DataType="uint8")
PARACHUTE_ACTION_DISABLE = Simulink.Parameter(0, StorageClass="Const", DataType="uint8")
PARACHUTE_ACTION_ENABLE = Simulink.Parameter(1, StorageClass="Const", DataType="uint8")
PARACHUTE_ACTION_RELEASE = Simulink.Parameter(2, StorageClass="Const", DataType="uint8")
FAILURE_UNIT_SENSOR_GYRO = Simulink.Parameter(0, StorageClass="Const", DataType="uint8")
FAILURE_UNIT_SENSOR_ACCEL = Simulink.Parameter(1, StorageClass="Const", DataType="uint8")
FAILURE_UNIT_SENSOR_MAG = Simulink.Parameter(2, StorageClass="Const", DataType="uint8")
FAILURE_UNIT_SENSOR_BARO = Simulink.Parameter(3, StorageClass="Const", DataType="uint8")
FAILURE_UNIT_SENSOR_GPS = Simulink.Parameter(4, StorageClass="Const", DataType="uint8")
FAILURE_UNIT_SENSOR_OPTICAL_FLOW = Simulink.Parameter(5, StorageClass="Const", DataType="uint8")
FAILURE_UNIT_SENSOR_VIO = Simulink.Parameter(6, StorageClass="Const", DataType="uint8")
FAILURE_UNIT_SENSOR_DISTANCE_SENSOR = Simulink.Parameter(7, StorageClass="Const", DataType="uint8")
FAILURE_UNIT_SENSOR_AIRSPEED = Simulink.Parameter(8, StorageClass="Const", DataType="uint8")
FAILURE_UNIT_SYSTEM_BATTERY = Simulink.Parameter(100, StorageClass="Const", DataType="uint8")
FAILURE_UNIT_SYSTEM_MOTOR = Simulink.Parameter(101, StorageClass="Const", DataType="uint8")
FAILURE_UNIT_SYSTEM_SERVO = Simulink.Parameter(102, StorageClass="Const", DataType="uint8")
FAILURE_UNIT_SYSTEM_AVOIDANCE = Simulink.Parameter(103, StorageClass="Const", DataType="uint8")
FAILURE_UNIT_SYSTEM_RC_SIGNAL = Simulink.Parameter(104, StorageClass="Const", DataType="uint8")
FAILURE_UNIT_SYSTEM_MAVLINK_SIGNAL = Simulink.Parameter(105, StorageClass="Const", DataType="uint8")
FAILURE_TYPE_OK = Simulink.Parameter(0, StorageClass="Const", DataType="uint8")
FAILURE_TYPE_OFF = Simulink.Parameter(1, StorageClass="Const", DataType="uint8")
FAILURE_TYPE_STUCK = Simulink.Parameter(2, StorageClass="Const", DataType="uint8")
FAILURE_TYPE_GARBAGE = Simulink.Parameter(3, StorageClass="Const", DataType="uint8")
FAILURE_TYPE_WRONG = Simulink.Parameter(4, StorageClass="Const", DataType="uint8")
FAILURE_TYPE_SLOW = Simulink.Parameter(5, StorageClass="Const", DataType="uint8")
FAILURE_TYPE_DELAYED = Simulink.Parameter(6, StorageClass="Const", DataType="uint8")
FAILURE_TYPE_INTERMITTENT = Simulink.Parameter(7, StorageClass="Const", DataType="uint8")
SPEED_TYPE_AIRSPEED = Simulink.Parameter(0, StorageClass="Const", DataType="uint8")
SPEED_TYPE_GROUNDSPEED = Simulink.Parameter(1, StorageClass="Const", DataType="uint8")
SPEED_TYPE_CLIMB_SPEED = Simulink.Parameter(2, StorageClass="Const", DataType="uint8")
SPEED_TYPE_DESCEND_SPEED = Simulink.Parameter(3, StorageClass="Const", DataType="uint8")
ARMING_ACTION_DISARM = Simulink.Parameter(0, StorageClass="Const", DataType="int8")
ARMING_ACTION_ARM = Simulink.Parameter(1, StorageClass="Const", DataType="int8")
GRIPPER_ACTION_RELEASE = Simulink.Parameter(0, StorageClass="Const", DataType="uint8")
GRIPPER_ACTION_GRAB = Simulink.Parameter(1, StorageClass="Const", DataType="uint8")

VEHICLE_COMMAND = enum(AddClassNameToEnumNames=true)
  VEHICLE_CMD_CUSTOM_0 = 0  % # test command
  VEHICLE_CMD_CUSTOM_1 = 1  % # test command
  VEHICLE_CMD_CUSTOM_2 = 2  % # test command
  VEHICLE_CMD_NAV_WAYPOINT = 16  % # Navigate to MISSION. |Hold time in decimal seconds. (ignored by fixed wing, time to stay at MISSION for rotary wing)| Acceptance radius in meters (if the sphere with this radius is hit, the MISSION counts as reached)| 0 to pass through the WP, if > 0 radius in meters to pass by WP. Positive value for clockwise orbit, negative value for counter-clockwise orbit. Allows trajectory control.| Desired yaw angle at MISSION (rotary wing)| Latitude| Longitude| Altitude|
  VEHICLE_CMD_NAV_LOITER_UNLIM = 17  % # Loiter around this MISSION an unlimited amount of time |Empty| Empty| Radius around MISSION, in meters. If positive loiter clockwise, else counter-clockwise| Desired yaw angle.| Latitude| Longitude| Altitude|
  VEHICLE_CMD_NAV_LOITER_TURNS = 18  % # Loiter around this MISSION for X turns |Turns| Empty| Radius around MISSION, in meters. If positive loiter clockwise, else counter-clockwise| Desired yaw angle.| Latitude| Longitude| Altitude|
  VEHICLE_CMD_NAV_LOITER_TIME = 19  % # Loiter around this MISSION for X seconds |Seconds (decimal)| Empty| Radius around MISSION, in meters. If positive loiter clockwise, else counter-clockwise| Desired yaw angle.| Latitude| Longitude| Altitude|
  VEHICLE_CMD_NAV_RETURN_TO_LAUNCH = 20  % # Return to launch location |Empty| Empty| Empty| Empty| Empty| Empty| Empty|
  VEHICLE_CMD_NAV_LAND = 21  % # Land at location |Empty| Empty| Empty| Desired yaw angle.| Latitude| Longitude| Altitude|
  VEHICLE_CMD_NAV_TAKEOFF = 22  % # Takeoff from ground / hand |Minimum pitch (if airspeed sensor present), desired pitch without sensor| Empty| Empty| Yaw angle (if magnetometer present), ignored without magnetometer| Latitude| Longitude| Altitude|
  VEHICLE_CMD_NAV_PRECLAND = 23  % # Attempt a precision landing
  VEHICLE_CMD_DO_ORBIT = 34  % # Start orbiting on the circumference of a circle defined by the parameters. |Radius [m] |Velocity [m/s] |Yaw behaviour |Empty |Latitude/X |Longitude/Y |Altitude/Z |
  VEHICLE_CMD_NAV_ROI = 80  % # Sets the region of interest (ROI) for a sensor set or the vehicle itself. This can then be used by the vehicles control system to control the vehicle attitude and the attitude of various sensors such as cameras. |Region of interest mode. (see MAV_ROI enum)| MISSION index/ target ID. (see MAV_ROI enum)| ROI index (allows a vehicle to manage multiple ROI's)| Empty| x the location of the fixed ROI (see MAV_FRAME)| y| z|
  VEHICLE_CMD_NAV_PATHPLANNING = 81  % # Control autonomous path planning on the MAV. |0: Disable local obstacle avoidance / local path planning (without resetting map), 1: Enable local path planning, 2: Enable and reset local path planning| 0: Disable full path planning (without resetting map), 1: Enable, 2: Enable and reset map/occupancy grid, 3: Enable and reset planned route, but not occupancy grid| Empty| Yaw angle at goal, in compass degrees, [0..360]| Latitude/X of goal| Longitude/Y of goal| Altitude/Z of goal|
  VEHICLE_CMD_NAV_VTOL_TAKEOFF = 84  % # Takeoff from ground / hand and transition to fixed wing |Minimum pitch (if airspeed sensor present), desired pitch without sensor| Empty| Empty| Yaw angle (if magnetometer present), ignored without magnetometer| Latitude| Longitude| Altitude|
  VEHICLE_CMD_NAV_VTOL_LAND = 85  % # Transition to MC and land at location |Empty| Empty| Empty| Desired yaw angle.| Latitude| Longitude| Altitude|
  VEHICLE_CMD_NAV_GUIDED_LIMITS = 90  % # set limits for external control |timeout - maximum time (in seconds) that external controller will be allowed to control vehicle. 0 means no timeout| absolute altitude min (in meters, AMSL) - if vehicle moves below this alt, the command will be aborted and the mission will continue.  0 means no lower altitude limit| absolute altitude max (in meters)- if vehicle moves above this alt, the command will be aborted and the mission will continue.  0 means no upper altitude limit| horizontal move limit (in meters, AMSL) - if vehicle moves more than this distance from it's location at the moment the command was executed, the command will be aborted and the mission will continue. 0 means no horizontal altitude limit| Empty| Empty| Empty|
  VEHICLE_CMD_NAV_GUIDED_MASTER = 91  % # set id of master controller |System ID| Component ID| Empty| Empty| Empty| Empty| Empty|
  VEHICLE_CMD_NAV_DELAY = 93  % # Delay the next navigation command a number of seconds or until a specified time |Delay in seconds (decimal, -1 to enable time-of-day fields)| hour (24h format, UTC, -1 to ignore)| minute (24h format, UTC, -1 to ignore)| second (24h format, UTC)| Empty| Empty| Empty|
  VEHICLE_CMD_NAV_LAST = 95  % # NOP - This command is only used to mark the upper limit of the NAV/ACTION commands in the enumeration |Empty| Empty| Empty| Empty| Empty| Empty| Empty|
  VEHICLE_CMD_CONDITION_DELAY = 112  % # Delay mission state machine. |Delay in seconds (decimal)| Empty| Empty| Empty| Empty| Empty| Empty|
  VEHICLE_CMD_CONDITION_CHANGE_ALT = 113  % # Ascend/descend at rate.  Delay mission state machine until desired altitude reached. |Descent / Ascend rate (m/s)| Empty| Empty| Empty| Empty| Empty| Finish Altitude|
  VEHICLE_CMD_CONDITION_DISTANCE = 114  % # Delay mission state machine until within desired distance of next NAV point. |Distance (meters)| Empty| Empty| Empty| Empty| Empty| Empty|
  VEHICLE_CMD_CONDITION_YAW = 115  % # Reach a certain target angle. |target angle: [0-360], 0 is north| speed during yaw change:[deg per second]| direction: negative: counter clockwise, positive: clockwise [-1,1]| relative offset or absolute angle: [ 1,0]| Empty| Empty| Empty|
  VEHICLE_CMD_CONDITION_LAST = 159  % # NOP - This command is only used to mark the upper limit of the CONDITION commands in the enumeration |Empty| Empty| Empty| Empty| Empty| Empty| Empty|
  VEHICLE_CMD_CONDITION_GATE = 4501  % # Wait until passing a threshold |2D coord mode: 0: Orthogonal to planned route | Altitude mode: 0: Ignore altitude| Empty| Empty| Lat| Lon| Alt|
  VEHICLE_CMD_DO_SET_MODE = 176  % # Set system mode. |Mode, as defined by ENUM MAV_MODE| Empty| Empty| Empty| Empty| Empty| Empty|
  VEHICLE_CMD_DO_JUMP = 177  % # Jump to the desired command in the mission list.  Repeat this action only the specified number of times |Sequence number| Repeat count| Empty| Empty| Empty| Empty| Empty|
  VEHICLE_CMD_DO_CHANGE_SPEED = 178  % # Change speed and/or throttle set points. |Speed type (0=Airspeed, 1=Ground Speed)| Speed  (m/s, -1 indicates no change)| Throttle  ( Percent, -1 indicates no change)| Empty| Empty| Empty| Empty|
  VEHICLE_CMD_DO_SET_HOME = 179  % # Changes the home location either to the current location or a specified location. |Use current (1=use current location, 0=use specified location)| Empty| Empty| Empty| Latitude| Longitude| Altitude|
  VEHICLE_CMD_DO_SET_PARAMETER = 180  % # Set a system parameter.  Caution!  Use of this command requires knowledge of the numeric enumeration value of the parameter. |Parameter number| Parameter value| Empty| Empty| Empty| Empty| Empty|
  VEHICLE_CMD_DO_SET_RELAY = 181  % # Set a relay to a condition. |Relay number| Setting (1=on, 0=off, others possible depending on system hardware)| Empty| Empty| Empty| Empty| Empty|
  VEHICLE_CMD_DO_REPEAT_RELAY = 182  % # Cycle a relay on and off for a desired number of cycles with a desired period. |Relay number| Cycle count| Cycle time (seconds, decimal)| Empty| Empty| Empty| Empty|
  VEHICLE_CMD_DO_REPEAT_SERVO = 184  % # Cycle a between its nominal setting and a desired PWM for a desired number of cycles with a desired period. |Servo number| PWM (microseconds, 1000 to 2000 typical)| Cycle count| Cycle time (seconds)| Empty| Empty| Empty|
  VEHICLE_CMD_DO_FLIGHTTERMINATION = 185  % # Terminate flight immediately |Flight termination activated if > 0.5| Empty| Empty| Empty| Empty| Empty| Empty|
  VEHICLE_CMD_DO_CHANGE_ALTITUDE = 186  % # Set the vehicle to Loiter mode and change the altitude to specified value |Altitude| Frame of new altitude | Empty| Empty| Empty| Empty| Empty|
  VEHICLE_CMD_DO_SET_ACTUATOR = 187  % # Sets actuators (e.g. servos) to a desired value. |Actuator 1| Actuator 2| Actuator 3| Actuator 4| Actuator 5| Actuator 6| Index|
  VEHICLE_CMD_DO_LAND_START = 189  % # Mission command to perform a landing. This is used as a marker in a mission to tell the autopilot where a sequence of mission items that represents a landing starts. It may also be sent via a COMMAND_LONG to trigger a landing, in which case the nearest (geographically) landing sequence in the mission will be used. The Latitude/Longitude is optional, and may be set to 0/0 if not needed. If specified then it will be used to help find the closest landing sequence. |Empty| Empty| Empty| Empty| Latitude| Longitude| Empty|
  VEHICLE_CMD_DO_GO_AROUND = 191  % # Mission command to safely abort an autonomous landing. |Altitude (meters)| Empty| Empty| Empty| Empty| Empty| Empty|
  VEHICLE_CMD_DO_REPOSITION = 192
  VEHICLE_CMD_DO_PAUSE_CONTINUE = 193
  VEHICLE_CMD_DO_SET_ROI_LOCATION = 195  % # Sets the region of interest (ROI) to a location. This can then be used by the vehicles control system to control the vehicle attitude and the attitude of various sensors such as cameras. |Empty| Empty| Empty| Empty| Latitude| Longitude| Altitude|
  VEHICLE_CMD_DO_SET_ROI_WPNEXT_OFFSET = 196  % # Sets the region of interest (ROI) to be toward next waypoint, with optional pitch/roll/yaw offset. This can then be used by the vehicles control system to control the vehicle attitude and the attitude of various sensors such as cameras. |Empty| Empty| Empty| Empty| pitch offset from next waypoint| roll offset from next waypoint| yaw offset from next waypoint|
  VEHICLE_CMD_DO_SET_ROI_NONE = 197  % # Cancels any previous ROI command returning the vehicle/sensors to default flight characteristics. This can then be used by the vehicles control system to control the vehicle attitude and the attitude of various sensors such as cameras. |Empty| Empty| Empty| Empty| Empty| Empty| Empty|
  VEHICLE_CMD_DO_CONTROL_VIDEO = 200  % # Control onboard camera system. |Camera ID (-1 for all)| Transmission: 0: disabled, 1: enabled compressed, 2: enabled raw| Transmission mode: 0: video stream, >0: single images every n seconds (decimal)| Recording: 0: disabled, 1: enabled compressed, 2: enabled raw| Empty| Empty| Empty|
  VEHICLE_CMD_DO_SET_ROI = 201  % # Sets the region of interest (ROI) for a sensor set or the vehicle itself. This can then be used by the vehicles control system to control the vehicle attitude and the attitude of various sensors such as cameras. |Region of interest mode. (see MAV_ROI enum)| MISSION index/ target ID. (see MAV_ROI enum)| ROI index (allows a vehicle to manage multiple ROI's)| Empty| x the location of the fixed ROI (see MAV_FRAME)| y| z|
  VEHICLE_CMD_DO_DIGICAM_CONTROL = 203
  VEHICLE_CMD_DO_MOUNT_CONFIGURE = 204  % # Mission command to configure a camera or antenna mount |Mount operation mode (see MAV_MOUNT_MODE enum)| stabilize roll? (1 = yes, 0 = no)| stabilize pitch? (1 = yes, 0 = no)| stabilize yaw? (1 = yes, 0 = no)| Empty| Empty| Empty|
  VEHICLE_CMD_DO_MOUNT_CONTROL = 205  % # Mission command to control a camera or antenna mount |pitch or lat in degrees, depending on mount mode.| roll or lon in degrees depending on mount mode| yaw or alt (in meters) depending on mount mode| reserved| reserved| reserved| MAV_MOUNT_MODE enum value|
  VEHICLE_CMD_DO_SET_CAM_TRIGG_DIST = 206  % # Mission command to set TRIG_DIST for this flight |Camera trigger distance (meters)| Shutter integration time (ms)| Empty| Empty| Empty| Empty| Empty|
  VEHICLE_CMD_DO_FENCE_ENABLE = 207  % # Mission command to enable the geofence |enable? (0=disable, 1=enable)| Empty| Empty| Empty| Empty| Empty| Empty|
  VEHICLE_CMD_DO_PARACHUTE = 208  % # Mission command to trigger a parachute |action (0=disable, 1=enable, 2=release, for some systems see PARACHUTE_ACTION enum, not in general message set.)| Empty| Empty| Empty| Empty| Empty| Empty|
  VEHICLE_CMD_DO_MOTOR_TEST = 209  % # motor test command |Instance (1, ...)| throttle type| throttle| timeout [s]| Motor count | Test order| Empty|
  VEHICLE_CMD_DO_INVERTED_FLIGHT = 210  % # Change to/from inverted flight |inverted (0=normal, 1=inverted)| Empty| Empty| Empty| Empty| Empty| Empty|
  VEHICLE_CMD_DO_GRIPPER = 211  % # Command to operate a gripper
  VEHICLE_CMD_DO_SET_CAM_TRIGG_INTERVAL = 214  % # Mission command to set TRIG_INTERVAL for this flight |Camera trigger distance (meters)| Shutter integration time (ms)| Empty| Empty| Empty| Empty| Empty|
  VEHICLE_CMD_DO_MOUNT_CONTROL_QUAT = 220  % # Mission command to control a camera or antenna mount, using a quaternion as reference. |q1 - quaternion param #1, w (1 in null-rotation)| q2 - quaternion param #2, x (0 in null-rotation)| q3 - quaternion param #3, y (0 in null-rotation)| q4 - quaternion param #4, z (0 in null-rotation)| Empty| Empty| Empty|
  VEHICLE_CMD_DO_GUIDED_MASTER = 221  % # set id of master controller |System ID| Component ID| Empty| Empty| Empty| Empty| Empty|
  VEHICLE_CMD_DO_GUIDED_LIMITS = 222  % # set limits for external control |timeout - maximum time (in seconds) that external controller will be allowed to control vehicle. 0 means no timeout| absolute altitude min (in meters, AMSL) - if vehicle moves below this alt, the command will be aborted and the mission will continue.  0 means no lower altitude limit| absolute altitude max (in meters)- if vehicle moves above this alt, the command will be aborted and the mission will continue.  0 means no upper altitude limit| horizontal move limit (in meters, AMSL) - if vehicle moves more than this distance from it's location at the moment the command was executed, the command will be aborted and the mission will continue. 0 means no horizontal altitude limit| Empty| Empty| Empty|
  VEHICLE_CMD_DO_LAST = 240  % # NOP - This command is only used to mark the upper limit of the DO commands in the enumeration |Empty| Empty| Empty| Empty| Empty| Empty| Empty|
  VEHICLE_CMD_PREFLIGHT_CALIBRATION = 241  % # Trigger calibration. This command will be only accepted if in pre-flight mode. See mavlink spec MAV_CMD_PREFLIGHT_CALIBRATION
  PREFLIGHT_CALIBRATION_TEMPERATURE_CALIBRATION = 3  % # param value for VEHICLE_CMD_PREFLIGHT_CALIBRATION to start temperature calibration
  VEHICLE_CMD_PREFLIGHT_SET_SENSOR_OFFSETS = 242  % # Set sensor offsets. This command will be only accepted if in pre-flight mode. |Sensor to adjust the offsets for: 0: gyros, 1: accelerometer, 2: magnetometer, 3: barometer, 4: optical flow| X axis offset (or generic dimension 1), in the sensor's raw units| Y axis offset (or generic dimension 2), in the sensor's raw units| Z axis offset (or generic dimension 3), in the sensor's raw units| Generic dimension 4, in the sensor's raw units| Generic dimension 5, in the sensor's raw units| Generic dimension 6, in the sensor's raw units|
  VEHICLE_CMD_PREFLIGHT_UAVCAN = 243  % # UAVCAN configuration. If param 1 == 1 actuator mapping and direction assignment should be started
  VEHICLE_CMD_PREFLIGHT_STORAGE = 245  % # Request storage of different parameter values and logs. This command will be only accepted if in pre-flight mode. |Parameter storage: 0: READ FROM FLASH/EEPROM, 1: WRITE CURRENT TO FLASH/EEPROM| Mission storage: 0: READ FROM FLASH/EEPROM, 1: WRITE CURRENT TO FLASH/EEPROM| Reserved| Reserved| Empty| Empty| Empty|
  VEHICLE_CMD_PREFLIGHT_REBOOT_SHUTDOWN = 246  % # Request the reboot or shutdown of system components. |0: Do nothing for autopilot, 1: Reboot autopilot, 2: Shutdown autopilot.| 0: Do nothing for onboard computer, 1: Reboot onboard computer, 2: Shutdown onboard computer.| Reserved| Reserved| Empty| Empty| Empty|
  VEHICLE_CMD_OBLIQUE_SURVEY = 260  % # Mission command to set a Camera Auto Mount Pivoting Oblique Survey for this flight|Camera trigger distance (meters)| Shutter integration time (ms)| Camera minimum trigger interval| Number of positions| Roll| Pitch| Empty|
  VEHICLE_CMD_GIMBAL_DEVICE_INFORMATION = 283  % # Command to ask information about a low level gimbal
  VEHICLE_CMD_MISSION_START = 300  % # start running a mission |first_item: the first mission item to run| last_item:  the last mission item to run (after this item is run, the mission ends)|
  VEHICLE_CMD_ACTUATOR_TEST = 310  % # Actuator testing command|value [-1,1]|timeout [s]|Empty|Empty|output function|
  VEHICLE_CMD_CONFIGURE_ACTUATOR = 311  % # Actuator configuration command|configuration|Empty|Empty|Empty|output function|
  VEHICLE_CMD_COMPONENT_ARM_DISARM = 400  % # Arms / Disarms a component |1 to arm, 0 to disarm
  VEHICLE_CMD_RUN_PREARM_CHECKS = 401  % # Instructs a target system to run pre-arm checks.
  VEHICLE_CMD_INJECT_FAILURE = 420  % # Inject artificial failure for testing purposes
  VEHICLE_CMD_START_RX_PAIR = 500  % # Starts receiver pairing |0:Spektrum| 0:Spektrum DSM2, 1:Spektrum DSMX|
  VEHICLE_CMD_REQUEST_MESSAGE = 512  % # Request to send a single instance of the specified message
  VEHICLE_CMD_SET_CAMERA_MODE = 530  % # Set camera capture mode (photo, video, etc.)
  VEHICLE_CMD_SET_CAMERA_ZOOM = 531  % # Set camera zoom
  VEHICLE_CMD_SET_CAMERA_FOCUS = 532
  VEHICLE_CMD_DO_GIMBAL_MANAGER_PITCHYAW = 1000  % # Setpoint to be sent to a gimbal manager to set a gimbal pitch and yaw
  VEHICLE_CMD_DO_GIMBAL_MANAGER_CONFIGURE = 1001  % # Gimbal configuration to set which sysid/compid is in primary and secondary control
  VEHICLE_CMD_IMAGE_START_CAPTURE = 2000  % # Start image capture sequence.
  VEHICLE_CMD_DO_TRIGGER_CONTROL = 2003  % # Enable or disable on-board camera triggering system
  VEHICLE_CMD_VIDEO_START_CAPTURE = 2500  % # Start a video capture.
  VEHICLE_CMD_VIDEO_STOP_CAPTURE = 2501  % # Stop the current video capture.
  VEHICLE_CMD_LOGGING_START = 2510  % # start streaming ULog data
  VEHICLE_CMD_LOGGING_STOP = 2511  % # stop streaming ULog data
  VEHICLE_CMD_CONTROL_HIGH_LATENCY = 2600  % # control starting/stopping transmitting data over the high latency link
  VEHICLE_CMD_DO_VTOL_TRANSITION = 3000  % # Command VTOL transition
  VEHICLE_CMD_ARM_AUTHORIZATION_REQUEST = 3001  % # Request arm authorization
  VEHICLE_CMD_PAYLOAD_PREPARE_DEPLOY = 30001  % # Prepare a payload deployment in the flight plan
  VEHICLE_CMD_PAYLOAD_CONTROL_DEPLOY = 30002  % # Control a pre-programmed payload deployment
  VEHICLE_CMD_FIXED_MAG_CAL_YAW = 42006  % # Magnetometer calibration based on provided known yaw. This allows for fast calibration using WMM field tables in the vehicle, given only the known yaw of the vehicle. If Latitude and longitude are both zero then use the current vehicle location.
  VEHICLE_CMD_DO_WINCH = 42600  % # Command to operate winch.
  VEHICLE_CMD_PX4_INTERNAL_START = 65537  % # start of PX4 internal only vehicle commands (> UINT16_MAX)
  VEHICLE_CMD_SET_GPS_GLOBAL_ORIGIN = 100000  % # Sets the GPS coordinates of the vehicle local origin (0,0,0) position. |Empty|Empty|Empty|Empty|Latitude|Longitude|Altitude|
  VEHICLE_MOUNT_MODE_RETRACT = 0  % # Load and keep safe position (Roll,Pitch,Yaw) from permanent memory and stop stabilization |
  VEHICLE_MOUNT_MODE_NEUTRAL = 1  % # Load and keep neutral position (Roll,Pitch,Yaw) from permanent memory. |
  VEHICLE_MOUNT_MODE_MAVLINK_TARGETING = 2  % # Load neutral position and start MAVLink Roll,Pitch,Yaw control with stabilization |
  VEHICLE_MOUNT_MODE_RC_TARGETING = 3  % # Load neutral position and start RC Roll,Pitch,Yaw control with stabilization |
  VEHICLE_MOUNT_MODE_GPS_POINT = 4  % # Load neutral position and start to point to Lat,Lon,Alt |
  VEHICLE_MOUNT_MODE_ENUM_END = 5  % #
  VEHICLE_ROI_NONE = 0  % # No region of interest |
  VEHICLE_ROI_WPNEXT = 1  % # Point toward next MISSION |
  VEHICLE_ROI_WPINDEX = 2  % # Point toward given MISSION |
  VEHICLE_ROI_LOCATION = 3  % # Point toward fixed location |
  VEHICLE_ROI_TARGET = 4  % # Point toward target
  VEHICLE_ROI_ENUM_END = 5
  PARACHUTE_ACTION_DISABLE = 0
  PARACHUTE_ACTION_ENABLE = 1
  PARACHUTE_ACTION_RELEASE = 2
  FAILURE_UNIT_SENSOR_GYRO = 0
  FAILURE_UNIT_SENSOR_ACCEL = 1
  FAILURE_UNIT_SENSOR_MAG = 2
  FAILURE_UNIT_SENSOR_BARO = 3
  FAILURE_UNIT_SENSOR_GPS = 4
  FAILURE_UNIT_SENSOR_OPTICAL_FLOW = 5
  FAILURE_UNIT_SENSOR_VIO = 6
  FAILURE_UNIT_SENSOR_DISTANCE_SENSOR = 7
  FAILURE_UNIT_SENSOR_AIRSPEED = 8
  FAILURE_UNIT_SYSTEM_BATTERY = 100
  FAILURE_UNIT_SYSTEM_MOTOR = 101
  FAILURE_UNIT_SYSTEM_SERVO = 102
  FAILURE_UNIT_SYSTEM_AVOIDANCE = 103
  FAILURE_UNIT_SYSTEM_RC_SIGNAL = 104
  FAILURE_UNIT_SYSTEM_MAVLINK_SIGNAL = 105
  FAILURE_TYPE_OK = 0
  FAILURE_TYPE_OFF = 1
  FAILURE_TYPE_STUCK = 2
  FAILURE_TYPE_GARBAGE = 3
  FAILURE_TYPE_WRONG = 4
  FAILURE_TYPE_SLOW = 5
  FAILURE_TYPE_DELAYED = 6
  FAILURE_TYPE_INTERMITTENT = 7
  SPEED_TYPE_AIRSPEED = 0
  SPEED_TYPE_GROUNDSPEED = 1
  SPEED_TYPE_CLIMB_SPEED = 2
  SPEED_TYPE_DESCEND_SPEED = 3
  ARMING_ACTION_DISARM = 0
  ARMING_ACTION_ARM = 1
  GRIPPER_ACTION_RELEASE = 0
  GRIPPER_ACTION_GRAB = 1
  ORB_QUEUE_LENGTH = 8

VEHICLE_CMD_RESULT_ACCEPTED = Simulink.Parameter(0, StorageClass="Const", DataType="uint8")  % # Command ACCEPTED and EXECUTED |
VEHICLE_CMD_RESULT_TEMPORARILY_REJECTED = Simulink.Parameter(1, StorageClass="Const", DataType="uint8")  % # Command TEMPORARY REJECTED/DENIED |
VEHICLE_CMD_RESULT_DENIED = Simulink.Parameter(2, StorageClass="Const", DataType="uint8")  % # Command PERMANENTLY DENIED |
VEHICLE_CMD_RESULT_UNSUPPORTED = Simulink.Parameter(3, StorageClass="Const", DataType="uint8")  % # Command UNKNOWN/UNSUPPORTED |
VEHICLE_CMD_RESULT_FAILED = Simulink.Parameter(4, StorageClass="Const", DataType="uint8")  % # Command executed, but failed |
VEHICLE_CMD_RESULT_IN_PROGRESS = Simulink.Parameter(5, StorageClass="Const", DataType="uint8")  % # Command being executed |
VEHICLE_CMD_RESULT_CANCELLED = Simulink.Parameter(6, StorageClass="Const", DataType="uint8")  % # Command Canceled
ARM_AUTH_DENIED_REASON_GENERIC = Simulink.Parameter(0, StorageClass="Const", DataType="uint16")
ARM_AUTH_DENIED_REASON_NONE = Simulink.Parameter(1, StorageClass="Const", DataType="uint16")
ARM_AUTH_DENIED_REASON_INVALID_WAYPOINT = Simulink.Parameter(2, StorageClass="Const", DataType="uint16")
ARM_AUTH_DENIED_REASON_TIMEOUT = Simulink.Parameter(3, StorageClass="Const", DataType="uint16")
ARM_AUTH_DENIED_REASON_AIRSPACE_IN_USE = Simulink.Parameter(4, StorageClass="Const", DataType="uint16")
ARM_AUTH_DENIED_REASON_BAD_WEATHER = Simulink.Parameter(5, StorageClass="Const", DataType="uint16")

VEHICLE_COMMAND_ACK = enum(AddClassNameToEnumNames=true)
  VEHICLE_CMD_RESULT_ACCEPTED = 0  % # Command ACCEPTED and EXECUTED |
  VEHICLE_CMD_RESULT_TEMPORARILY_REJECTED = 1  % # Command TEMPORARY REJECTED/DENIED |
  VEHICLE_CMD_RESULT_DENIED = 2  % # Command PERMANENTLY DENIED |
  VEHICLE_CMD_RESULT_UNSUPPORTED = 3  % # Command UNKNOWN/UNSUPPORTED |
  VEHICLE_CMD_RESULT_FAILED = 4  % # Command executed, but failed |
  VEHICLE_CMD_RESULT_IN_PROGRESS = 5  % # Command being executed |
  VEHICLE_CMD_RESULT_CANCELLED = 6  % # Command Canceled
  ARM_AUTH_DENIED_REASON_GENERIC = 0
  ARM_AUTH_DENIED_REASON_NONE = 1
  ARM_AUTH_DENIED_REASON_INVALID_WAYPOINT = 2
  ARM_AUTH_DENIED_REASON_TIMEOUT = 3
  ARM_AUTH_DENIED_REASON_AIRSPACE_IN_USE = 4
  ARM_AUTH_DENIED_REASON_BAD_WEATHER = 5
  ORB_QUEUE_LENGTH = 4

VEHICLE_IMU = enum(AddClassNameToEnumNames=true)
  CLIPPING_X = 1
  CLIPPING_Y = 2
  CLIPPING_Z = 4

DIST_BOTTOM_SENSOR_NONE = Simulink.Parameter(0, StorageClass="Const", DataType="uint8")
DIST_BOTTOM_SENSOR_RANGE = Simulink.Parameter(1, StorageClass="Const", DataType="uint8")  % # (1 << 0) a range sensor is used to estimate dist_bottom field
DIST_BOTTOM_SENSOR_FLOW = Simulink.Parameter(2, StorageClass="Const", DataType="uint8")  % # (1 << 1) a flow sensor is used to estimate dist_bottom field (mostly fixed-wing use case)

VEHICLE_LOCAL_POSITION = enum(AddClassNameToEnumNames=true)
  DIST_BOTTOM_SENSOR_NONE = 0
  DIST_BOTTOM_SENSOR_RANGE = 1  % # (1 << 0) a range sensor is used to estimate dist_bottom field
  DIST_BOTTOM_SENSOR_FLOW = 2  % # (1 << 1) a flow sensor is used to estimate dist_bottom field (mostly fixed-wing use case)

POSE_FRAME_UNKNOWN = Simulink.Parameter(0, StorageClass="Const", DataType="uint8")
POSE_FRAME_NED = Simulink.Parameter(1, StorageClass="Const", DataType="uint8")  % # NED earth-fixed frame
POSE_FRAME_FRD = Simulink.Parameter(2, StorageClass="Const", DataType="uint8")  % # FRD world-fixed frame, arbitrary heading reference
VELOCITY_FRAME_UNKNOWN = Simulink.Parameter(0, StorageClass="Const", DataType="uint8")
VELOCITY_FRAME_NED = Simulink.Parameter(1, StorageClass="Const", DataType="uint8")  % # NED earth-fixed frame
VELOCITY_FRAME_FRD = Simulink.Parameter(2, StorageClass="Const", DataType="uint8")  % # FRD world-fixed frame, arbitrary heading reference
VELOCITY_FRAME_BODY_FRD = Simulink.Parameter(3, StorageClass="Const", DataType="uint8")  % # FRD body-fixed frame

VEHICLE_ODOMETRY = enum(AddClassNameToEnumNames=true)
  POSE_FRAME_UNKNOWN = 0
  POSE_FRAME_NED = 1  % # NED earth-fixed frame
  POSE_FRAME_FRD = 2  % # FRD world-fixed frame, arbitrary heading reference
  VELOCITY_FRAME_UNKNOWN = 0
  VELOCITY_FRAME_NED = 1  % # NED earth-fixed frame
  VELOCITY_FRAME_FRD = 2  % # FRD world-fixed frame, arbitrary heading reference
  VELOCITY_FRAME_BODY_FRD = 3  % # FRD body-fixed frame

ROI_NONE = Simulink.Parameter(0, StorageClass="Const", DataType="uint8")  % # No region of interest
ROI_WPNEXT = Simulink.Parameter(1, StorageClass="Const", DataType="uint8")  % # Point toward next MISSION with optional offset
ROI_WPINDEX = Simulink.Parameter(2, StorageClass="Const", DataType="uint8")  % # Point toward given MISSION
ROI_LOCATION = Simulink.Parameter(3, StorageClass="Const", DataType="uint8")  % # Point toward fixed location
ROI_TARGET = Simulink.Parameter(4, StorageClass="Const", DataType="uint8")  % # Point toward target
ROI_ENUM_END = Simulink.Parameter(5, StorageClass="Const", DataType="uint8")

VEHICLE_ROI = enum(AddClassNameToEnumNames=true)
  ROI_NONE = 0  % # No region of interest
  ROI_WPNEXT = 1  % # Point toward next MISSION with optional offset
  ROI_WPINDEX = 2  % # Point toward given MISSION
  ROI_LOCATION = 3  % # Point toward fixed location
  ROI_TARGET = 4  % # Point toward target
  ROI_ENUM_END = 5

ARMING_STATE_INIT = Simulink.Parameter(0, StorageClass="Const", DataType="uint8")
ARMING_STATE_STANDBY = Simulink.Parameter(1, StorageClass="Const", DataType="uint8")
ARMING_STATE_ARMED = Simulink.Parameter(2, StorageClass="Const", DataType="uint8")
ARMING_STATE_STANDBY_ERROR = Simulink.Parameter(3, StorageClass="Const", DataType="uint8")
ARMING_STATE_SHUTDOWN = Simulink.Parameter(4, StorageClass="Const", DataType="uint8")
ARMING_STATE_IN_AIR_RESTORE = Simulink.Parameter(5, StorageClass="Const", DataType="uint8")
ARMING_STATE_MAX = Simulink.Parameter(6, StorageClass="Const", DataType="uint8")
ARM_DISARM_REASON_TRANSITION_TO_STANDBY = Simulink.Parameter(0, StorageClass="Const", DataType="uint8")
ARM_DISARM_REASON_RC_STICK = Simulink.Parameter(1, StorageClass="Const", DataType="uint8")
ARM_DISARM_REASON_RC_SWITCH = Simulink.Parameter(2, StorageClass="Const", DataType="uint8")
ARM_DISARM_REASON_COMMAND_INTERNAL = Simulink.Parameter(3, StorageClass="Const", DataType="uint8")
ARM_DISARM_REASON_COMMAND_EXTERNAL = Simulink.Parameter(4, StorageClass="Const", DataType="uint8")
ARM_DISARM_REASON_MISSION_START = Simulink.Parameter(5, StorageClass="Const", DataType="uint8")
ARM_DISARM_REASON_SAFETY_BUTTON = Simulink.Parameter(6, StorageClass="Const", DataType="uint8")
ARM_DISARM_REASON_AUTO_DISARM_LAND = Simulink.Parameter(7, StorageClass="Const", DataType="uint8")
ARM_DISARM_REASON_AUTO_DISARM_PREFLIGHT = Simulink.Parameter(8, StorageClass="Const", DataType="uint8")
ARM_DISARM_REASON_KILL_SWITCH = Simulink.Parameter(9, StorageClass="Const", DataType="uint8")
ARM_DISARM_REASON_LOCKDOWN = Simulink.Parameter(10, StorageClass="Const", DataType="uint8")
ARM_DISARM_REASON_FAILURE_DETECTOR = Simulink.Parameter(11, StorageClass="Const", DataType="uint8")
ARM_DISARM_REASON_SHUTDOWN = Simulink.Parameter(12, StorageClass="Const", DataType="uint8")
ARM_DISARM_REASON_UNIT_TEST = Simulink.Parameter(13, StorageClass="Const", DataType="uint8")
NAVIGATION_STATE_MANUAL = Simulink.Parameter(0, StorageClass="Const", DataType="uint8")  % # Manual mode
NAVIGATION_STATE_ALTCTL = Simulink.Parameter(1, StorageClass="Const", DataType="uint8")  % # Altitude control mode
NAVIGATION_STATE_POSCTL = Simulink.Parameter(2, StorageClass="Const", DataType="uint8")  % # Position control mode
NAVIGATION_STATE_AUTO_MISSION = Simulink.Parameter(3, StorageClass="Const", DataType="uint8")  % # Auto mission mode
NAVIGATION_STATE_AUTO_LOITER = Simulink.Parameter(4, StorageClass="Const", DataType="uint8")  % # Auto loiter mode
NAVIGATION_STATE_AUTO_RTL = Simulink.Parameter(5, StorageClass="Const", DataType="uint8")  % # Auto return to launch mode
NAVIGATION_STATE_UNUSED3 = Simulink.Parameter(8, StorageClass="Const", DataType="uint8")  % # Free slot
NAVIGATION_STATE_UNUSED = Simulink.Parameter(9, StorageClass="Const", DataType="uint8")  % # Free slot
NAVIGATION_STATE_ACRO = Simulink.Parameter(10, StorageClass="Const", DataType="uint8")  % # Acro mode
NAVIGATION_STATE_UNUSED1 = Simulink.Parameter(11, StorageClass="Const", DataType="uint8")  % # Free slot
NAVIGATION_STATE_DESCEND = Simulink.Parameter(12, StorageClass="Const", DataType="uint8")  % # Descend mode (no position control)
NAVIGATION_STATE_TERMINATION = Simulink.Parameter(13, StorageClass="Const", DataType="uint8")  % # Termination mode
NAVIGATION_STATE_OFFBOARD = Simulink.Parameter(14, StorageClass="Const", DataType="uint8")
NAVIGATION_STATE_STAB = Simulink.Parameter(15, StorageClass="Const", DataType="uint8")  % # Stabilized mode
NAVIGATION_STATE_UNUSED2 = Simulink.Parameter(16, StorageClass="Const", DataType="uint8")  % # Free slot
NAVIGATION_STATE_AUTO_TAKEOFF = Simulink.Parameter(17, StorageClass="Const", DataType="uint8")  % # Takeoff
NAVIGATION_STATE_AUTO_LAND = Simulink.Parameter(18, StorageClass="Const", DataType="uint8")  % # Land
NAVIGATION_STATE_AUTO_FOLLOW_TARGET = Simulink.Parameter(19, StorageClass="Const", DataType="uint8")  % # Auto Follow
NAVIGATION_STATE_AUTO_PRECLAND = Simulink.Parameter(20, StorageClass="Const", DataType="uint8")  % # Precision land with landing target
NAVIGATION_STATE_ORBIT = Simulink.Parameter(21, StorageClass="Const", DataType="uint8")  % # Orbit in a circle
NAVIGATION_STATE_AUTO_VTOL_TAKEOFF = Simulink.Parameter(22, StorageClass="Const", DataType="uint8")  % # Takeoff, transition, establish loiter
NAVIGATION_STATE_MAX = Simulink.Parameter(23, StorageClass="Const", DataType="uint8")
FAILURE_NONE = Simulink.Parameter(0, StorageClass="Const", DataType="uint16")
FAILURE_ROLL = Simulink.Parameter(1, StorageClass="Const", DataType="uint16")  % # (1 << 0)
FAILURE_PITCH = Simulink.Parameter(2, StorageClass="Const", DataType="uint16")  % # (1 << 1)
FAILURE_ALT = Simulink.Parameter(4, StorageClass="Const", DataType="uint16")  % # (1 << 2)
FAILURE_EXT = Simulink.Parameter(8, StorageClass="Const", DataType="uint16")  % # (1 << 3)
FAILURE_ARM_ESC = Simulink.Parameter(16, StorageClass="Const", DataType="uint16")  % # (1 << 4)
FAILURE_BATTERY = Simulink.Parameter(32, StorageClass="Const", DataType="uint16")  % # (1 << 5)
FAILURE_IMBALANCED_PROP = Simulink.Parameter(64, StorageClass="Const", DataType="uint16")  % # (1 << 6)
FAILURE_MOTOR = Simulink.Parameter(128, StorageClass="Const", DataType="uint16")  % # (1 << 7)
HIL_STATE_OFF = Simulink.Parameter(0, StorageClass="Const", DataType="uint8")
HIL_STATE_ON = Simulink.Parameter(1, StorageClass="Const", DataType="uint8")
VEHICLE_TYPE_UNKNOWN = Simulink.Parameter(0, StorageClass="Const", DataType="uint8")
VEHICLE_TYPE_ROTARY_WING = Simulink.Parameter(1, StorageClass="Const", DataType="uint8")
VEHICLE_TYPE_FIXED_WING = Simulink.Parameter(2, StorageClass="Const", DataType="uint8")
VEHICLE_TYPE_ROVER = Simulink.Parameter(3, StorageClass="Const", DataType="uint8")
VEHICLE_TYPE_AIRSHIP = Simulink.Parameter(4, StorageClass="Const", DataType="uint8")

VEHICLE_STATUS = enum(AddClassNameToEnumNames=true)
  ARMING_STATE_INIT = 0
  ARMING_STATE_STANDBY = 1
  ARMING_STATE_ARMED = 2
  ARMING_STATE_STANDBY_ERROR = 3
  ARMING_STATE_SHUTDOWN = 4
  ARMING_STATE_IN_AIR_RESTORE = 5
  ARMING_STATE_MAX = 6
  ARM_DISARM_REASON_TRANSITION_TO_STANDBY = 0
  ARM_DISARM_REASON_RC_STICK = 1
  ARM_DISARM_REASON_RC_SWITCH = 2
  ARM_DISARM_REASON_COMMAND_INTERNAL = 3
  ARM_DISARM_REASON_COMMAND_EXTERNAL = 4
  ARM_DISARM_REASON_MISSION_START = 5
  ARM_DISARM_REASON_SAFETY_BUTTON = 6
  ARM_DISARM_REASON_AUTO_DISARM_LAND = 7
  ARM_DISARM_REASON_AUTO_DISARM_PREFLIGHT = 8
  ARM_DISARM_REASON_KILL_SWITCH = 9
  ARM_DISARM_REASON_LOCKDOWN = 10
  ARM_DISARM_REASON_FAILURE_DETECTOR = 11
  ARM_DISARM_REASON_SHUTDOWN = 12
  ARM_DISARM_REASON_UNIT_TEST = 13
  NAVIGATION_STATE_MANUAL = 0  % # Manual mode
  NAVIGATION_STATE_ALTCTL = 1  % # Altitude control mode
  NAVIGATION_STATE_POSCTL = 2  % # Position control mode
  NAVIGATION_STATE_AUTO_MISSION = 3  % # Auto mission mode
  NAVIGATION_STATE_AUTO_LOITER = 4  % # Auto loiter mode
  NAVIGATION_STATE_AUTO_RTL = 5  % # Auto return to launch mode
  NAVIGATION_STATE_UNUSED3 = 8  % # Free slot
  NAVIGATION_STATE_UNUSED = 9  % # Free slot
  NAVIGATION_STATE_ACRO = 10  % # Acro mode
  NAVIGATION_STATE_UNUSED1 = 11  % # Free slot
  NAVIGATION_STATE_DESCEND = 12  % # Descend mode (no position control)
  NAVIGATION_STATE_TERMINATION = 13  % # Termination mode
  NAVIGATION_STATE_OFFBOARD = 14
  NAVIGATION_STATE_STAB = 15  % # Stabilized mode
  NAVIGATION_STATE_UNUSED2 = 16  % # Free slot
  NAVIGATION_STATE_AUTO_TAKEOFF = 17  % # Takeoff
  NAVIGATION_STATE_AUTO_LAND = 18  % # Land
  NAVIGATION_STATE_AUTO_FOLLOW_TARGET = 19  % # Auto Follow
  NAVIGATION_STATE_AUTO_PRECLAND = 20  % # Precision land with landing target
  NAVIGATION_STATE_ORBIT = 21  % # Orbit in a circle
  NAVIGATION_STATE_AUTO_VTOL_TAKEOFF = 22  % # Takeoff, transition, establish loiter
  NAVIGATION_STATE_MAX = 23
  FAILURE_NONE = 0
  FAILURE_ROLL = 1  % # (1 << 0)
  FAILURE_PITCH = 2  % # (1 << 1)
  FAILURE_ALT = 4  % # (1 << 2)
  FAILURE_EXT = 8  % # (1 << 3)
  FAILURE_ARM_ESC = 16  % # (1 << 4)
  FAILURE_BATTERY = 32  % # (1 << 5)
  FAILURE_IMBALANCED_PROP = 64  % # (1 << 6)
  FAILURE_MOTOR = 128  % # (1 << 7)
  HIL_STATE_OFF = 0
  HIL_STATE_ON = 1
  VEHICLE_TYPE_UNKNOWN = 0
  VEHICLE_TYPE_ROTARY_WING = 1
  VEHICLE_TYPE_FIXED_WING = 2
  VEHICLE_TYPE_ROVER = 3
  VEHICLE_TYPE_AIRSHIP = 4

POINT_0 = Simulink.Parameter(0, StorageClass="Const", DataType="uint8")
POINT_1 = Simulink.Parameter(1, StorageClass="Const", DataType="uint8")
POINT_2 = Simulink.Parameter(2, StorageClass="Const", DataType="uint8")
POINT_3 = Simulink.Parameter(3, StorageClass="Const", DataType="uint8")
POINT_4 = Simulink.Parameter(4, StorageClass="Const", DataType="uint8")
NUMBER_POINTS = Simulink.Parameter(5, StorageClass="Const", DataType="uint8")

VEHICLE_TRAJECTORY_BEZIER = enum(AddClassNameToEnumNames=true)
  POINT_0 = 0
  POINT_1 = 1
  POINT_2 = 2
  POINT_3 = 3
  POINT_4 = 4
  NUMBER_POINTS = 5

MAV_TRAJECTORY_REPRESENTATION_WAYPOINTS = Simulink.Parameter(0, StorageClass="Const", DataType="uint8")

VEHICLE_TRAJECTORY_WAYPOINT = enum(AddClassNameToEnumNames=true)
  MAV_TRAJECTORY_REPRESENTATION_WAYPOINTS = 0
  POINT_0 = 0
  POINT_1 = 1
  POINT_2 = 2
  POINT_3 = 3
  POINT_4 = 4
  NUMBER_POINTS = 5

VEHICLE_VTOL_STATE_UNDEFINED = Simulink.Parameter(0, StorageClass="Const", DataType="uint8")
VEHICLE_VTOL_STATE_TRANSITION_TO_FW = Simulink.Parameter(1, StorageClass="Const", DataType="uint8")
VEHICLE_VTOL_STATE_TRANSITION_TO_MC = Simulink.Parameter(2, StorageClass="Const", DataType="uint8")
VEHICLE_VTOL_STATE_MC = Simulink.Parameter(3, StorageClass="Const", DataType="uint8")
VEHICLE_VTOL_STATE_FW = Simulink.Parameter(4, StorageClass="Const", DataType="uint8")

VTOL_VEHICLE_STATUS = enum(AddClassNameToEnumNames=true)
  VEHICLE_VTOL_STATE_UNDEFINED = 0
  VEHICLE_VTOL_STATE_TRANSITION_TO_FW = 1
  VEHICLE_VTOL_STATE_TRANSITION_TO_MC = 2
  VEHICLE_VTOL_STATE_MC = 3
  VEHICLE_VTOL_STATE_FW = 4